# Dynamo graph Dyn_00_02_Arithmetic and Logic.dyn (Dynamo 2.12.0.5650)

# group: Numbers!
number = DoubleInput(5)

this_is_an_integer = DoubleInput(5)
this_is_a_float = DoubleInput(5.483)

# group: Number | Integer sliders
integer_slider = IntegerSlider(2, range=0..10 step 1)
watch = Watch(integer_slider)
number_slider = DoubleSlider(0.3798, range=0..1 step 0.3798)
watch_2 = Watch(number_slider)

# group: Basic Operations
number_2 = DoubleInput(5)
number_3 = DoubleInput(3)
add = number_2 + number_3
watch_3 = Watch(add)
sub = number_2 - number_3
watch_4 = Watch(sub)
mul = number_2 * number_3
watch_5 = Watch(mul)
div = number_2 / number_3
watch_6 = Watch(div)
mod = number_2 % number_3
watch_7 = Watch(mod)

# group: Ignore | Get signs
number_4 = DoubleInput(-5.932)
abs = Math.Abs(number=number_4)
watch_8 = Watch(abs)
sign = Math.Sign(number=number_4)
watch_9 = Watch(sign)

# group: Exponential | Square root
number_5 = DoubleInput(5)
number_6 = DoubleInput(2)
pow = Math.Pow(number=number_5, power=number_6)
watch_10 = Watch(pow)
sqrt = Math.Sqrt(number=pow)
watch_11 = Watch(sqrt)

# group: Trigonometry
number_7 = DoubleInput(45)
cos = Math.Cos(angle=number_7)
watch_12 = Watch(cos)
sin = Math.Sin(angle=number_7)
watch_13 = Watch(sin)
tan = Math.Tan(angle=number_7)
watch_14 = Watch(tan)
number_8 = DoubleInput(0.5)
acos = Math.Acos(ratio=number_8)
watch_15 = Watch(acos)
asin = Math.Asin(ratio=number_8)
watch_16 = Watch(asin)
atan = Math.Atan(ratio=number_8)
watch_17 = Watch(atan)

# group: Round nearest
number_9 = DoubleInput(5.867)
round = Math.Round(number=number_9)
watch_18 = Watch(round)
number_10 = DoubleInput(2)
round_2 = Math.Round(number=number_9, digits=number_10)
watch_19 = Watch(round_2)

# group: Round Up | Down
number_11 = DoubleInput(5.867)
ceiling = Math.Ceiling(number=number_11)
watch_20 = Watch(ceiling)
floor = Math.Floor(number=number_11)
watch_21 = Watch(floor)

# group: Sequence, Remap Range
number_12 = DoubleInput(1)
number_13 = DoubleInput(9)
sequence = Sequence(start=number_12, amount=number_13, step=number_12)
watch_22 = Watch(sequence)
number_14 = DoubleInput(0)
number_15 = DoubleInput(255)
remapRange = Math.RemapRange(numbers=watch_22, newMin=number_14, newMax=number_15)
watch_23 = Watch(remapRange)

# group: Sum
sum = Math.Sum(values=watch_23)
watch_24 = Watch(sum)

# group: Number Range, Average Value
number_16 = DoubleInput(1)
number_17 = DoubleInput(9)

range = Range(start=number_16, end=number_17, step=number_16)

# group (continued): Number Range, Average Value
watch_25 = Watch(range)
average = Math.Average(numbers=watch_25)
watch_26 = Watch(average)

# group: Not Equal | Equal
number_18 = DoubleInput(3)
eq = number_18 == number_18
watch_27 = Watch(eq)
number_19 = DoubleInput(5)
ne = number_19 != number_18
watch_28 = Watch(ne)

# group: Greater or Less than
number_20 = DoubleInput(5)
number_21 = DoubleInput(3)
gt = number_20 > number_21
watch_29 = Watch(gt)
lt = number_20 < number_21
watch_30 = Watch(lt)

# group: Greather|equal or Less|equal
number_22 = DoubleInput(5)
number_23 = DoubleInput(3)
ge = number_22 >= number_23
watch_31 = Watch(ge)
le = number_22 <= number_23
watch_32 = Watch(le)

# group: True | False Booleans
boolean = BoolSelector(false)
watch_33 = Watch(boolean)
boolean_2 = BoolSelector(true)
watch_34 = Watch(boolean_2)

# group: Not (inverse boolean)
boolean_3 = BoolSelector(false)
not_ = Not(x=boolean_3)
watch_35 = Watch(not_)

# group: And (all must be True)
boolean_4 = BoolSelector(true)
boolean_5 = BoolSelector(false)
and_ = And(bool0=boolean_4, bool1=boolean_4, bool2=boolean_4, bool3=boolean_5)
watch_36 = Watch(and_)

# group: Or (at least one is True)
boolean_6 = BoolSelector(false)
boolean_7 = BoolSelector(true)
or_ = Or(bool0=boolean_6, bool1=boolean_6, bool2=boolean_6, bool3=boolean_7)
watch_37 = Watch(or_)

# group: XOr (Only One is True)
boolean_8 = BoolSelector(false)
boolean_9 = BoolSelector(true)
xor = Math.Xor(bool=boolean_8, otherBool=boolean_9)
watch_38 = Watch(xor)

# group: Convert Units
number_24 = DoubleInput(191)
convert_between_units = DynamoConvert(number_24, MeasurementType="Length", FromConversion="Centimeters", ToConversion="Feet")
watch_39 = Watch(convert_between_units)
number_25 = DoubleInput(10000)
convert_between_units_2 = DynamoConvert(number_25, MeasurementType="Area", FromConversion="SquareMeter", ToConversion="Hectares")
watch_40 = Watch(convert_between_units_2)

# group: Convert Degrees <> Radians
PI = Math.PI()
radiansToDegrees = Math.RadiansToDegrees(radians=PI)
watch_41 = Watch(radiansToDegrees)
number_26 = DoubleInput(160)
degreesToRadians = Math.DegreesToRadians(degrees=number_26)
watch_42 = Watch(degreesToRadians)

# group: Logic If statement
boolean_10 = BoolSelector(false)
number_27 = DoubleInput(5)
number_28 = DoubleInput(10)
if_ = RefactoredIf(test=boolean_10, true=number_27, false=number_28)
watch_43 = Watch(if_)
