# Dynamo graph Dyn_00_06_Working with Revit Data.dyn (Dynamo 2.12.0.5650)

# group: Element Collectors
family_types = FamilyTypes("Bar Chair:Bar Chair")
all_elements_of_family_type = ElementsOfFamilyType(Family_Type=family_types)
all_elements_in_active_view = ElementsInView()
categories = Categories("OST_Walls")
all_elements_of_category = ElementsOfCategory(Category=categories)
element_types = ElementTypes("FloorType")
all_elements_of_type = ElementsOfType(element_type=element_types)

watch = Watch(all_elements_of_category)
watch_2 = Watch(all_elements_of_type)

# group: Collectors (better)
code_block = CodeBlock { "Bar Chair"; }
byName = FamilyType.ByName(name=code_block)
code_block_2 = CodeBlock { "Walls"; }
byName_2 = Category.ByName(name=code_block_2)

code_block_3 = CodeBlock { Category.ByName("Rooms"); }
all_elements_of_category_2 = ElementsOfCategory(Category=code_block_3)

# group: Rooms
area = Room.Area(room=all_elements_of_category_2)
number = Room.Number()  # unwired: room
height = Room.Height()  # unwired: room
volume = Room.Volume()  # unwired: room
setName = Room.SetName()  # unwired: room, value
setNumber = Room.SetNumber()  # unwired: room, value
name = Room.Name(room=all_elements_of_category_2)

# group: Get Special
select_revision = RevitRevisions("Seq. 1 - Revision 1")
levels = Levels("Level 1")
select_phase = RevitPhases("Learning Content")

# group: Collector (manual)
select_model_element = DSModelElementSelection()  # nothing selected
select_model_elements = DSModelElementsSelection()  # nothing selected

# group: Specify element
views = Views("Planting Schedule")
sheets = Sheets("Plans")
levels_2 = Levels("Level 1")

sheetName = Sheet.SheetName(sheet=sheets)
sheetNumber = Sheet.SheetNumber(sheet=sheets)
all_elements_at_level = ElementsAtLevel(Level=levels_2)
getCategory = Element.GetCategory(element=all_elements_at_level)
string_from_object = FromObject(object=getCategory)
code_block_4 = CodeBlock { "Walls"; }
eq = string_from_object == code_block_4
filterByBoolMask = List.FilterByBoolMask(list=all_elements_at_level, mask=eq)
watch_3 = Watch(filterByBoolMask.in)

# group: Active
current = Document.Current()
activeView = Document.ActiveView(document=current)
code_block_5 = CodeBlock(x=current) { x; }

all_elements_of_category_3 = ElementsOfCategory(Category=byName_2)

# group: Parameters
parameters = Element.Parameters(element=all_elements_of_category_3)
parameterType = Parameter.ParameterType(parameter=parameters)
value = Parameter.Value(parameter=parameters)
isShared = Parameter.IsShared(parameter=parameters)

# group: Element ID's
id = Element.Id(element=all_elements_of_category_3)
# note: ID is the Revit
# Unique ID is the hardcoded one
uniqueId = Element.UniqueId(element=all_elements_of_category_3)

# group: Element location
getLocation = Element.GetLocation(element=all_elements_of_category_3)
setLocation = Element.SetLocation()  # unwired: element, geometry

# group: Element Data
geometry = Element.Geometry(element=all_elements_of_category_3)
name_2 = Element.Name(element=all_elements_of_category_3)
getCategory_2 = Element.GetCategory(element=all_elements_of_category_3)
elementType = Element.ElementType(element=all_elements_of_category_3)

code_block_6 = CodeBlock { "Comments"; }
code_block_7 = CodeBlock { "Base Constraint"; "Unconnected Height"; }

# group: Get | Set Data
getParameterValueByName = Element.GetParameterValueByName(element=all_elements_of_category_3, parameterName=code_block_7.out0)
getParameterValueByName_2 = Element.GetParameterValueByName(element=all_elements_of_category_3, parameterName=code_block_7.out1)

elevation = Level.Elevation(level=getParameterValueByName)
add = elevation + getParameterValueByName_2
string_from_object_2 = FromObject(object=add)

# group (continued): Get | Set Data
setParameterByName = Element.SetParameterByName(element=all_elements_of_category_3, parameterName=code_block_6, value=string_from_object_2)  # frozen

# group: Set Room Data
code_block_8 = CodeBlock { "Name"; }
watch_4 = Watch(name)
toUpper = String.ToUpper(string=watch_4)
setParameterByName_2 = Element.SetParameterByName(element=all_elements_of_category_2, parameterName=code_block_8, value=toUpper)  # frozen
