# Dynamo graph Dyn_00_07_Working with Excel.dyn (Dynamo 2.12.0.5650)

file_path = Filename("..\..\Desktop\New Microsoft Excel Worksheet.xlsx")
code_block = CodeBlock { "Sheet1"; 0; true; false; }
string = StringInput("ID")
code_block_2 = CodeBlock()
# ---------- code_block_2.designscript (8 lines) ----------
["Name",
"Number",
"Unbounded Height",
"Department",
"Base Finish",
"Ceiling Finish",
"Wall Finish",
"Floor Finish"];
# ----------------------------------------
addItemToFront = List.AddItemToFront(item=string, list=code_block_2)
code_block_3 = CodeBlock { cat = Category.ByName("Rooms"); ElementQueries.OfCategory(cat); }
all_elements_of_category = ElementsOfCategory(Category=code_block_3.cat)
id = Element.Id(element=all_elements_of_category)
getParameterValueByName = Element.GetParameterValueByName(parameterName=code_block_2)  # unwired: element
map = List.Map(list=all_elements_of_category, function=getParameterValueByName)
code_block_4 = CodeBlock { ""; }
eq = map == code_block_4
string_2 = StringInput("$$")
if_ = RefactoredIf(test=eq@L1, true=string_2, false=map@L1)
count = List.Count(list=code_block_2)
chop = List.Chop(list=if_, lengths=count)
transpose = List.Transpose(lists=chop)
addItemToFront_2 = List.AddItemToFront(item=id, list=transpose)
transpose_2 = List.Transpose(lists=addItemToFront_2)
addItemToFront_3 = List.AddItemToFront(item=addItemToFront, list=transpose_2)
exportToExcel = Data.ExportToExcel(filePath=file_path, sheetName=code_block.out0, startRow=code_block.out1, startColumn=code_block.out1, data=addItemToFront_3, overWrite=code_block.out2, writeAsString=code_block.out2)  # frozen
file_from_path = FileObject(path=file_path)
importExcel = Data.ImportExcel(file=file_from_path, sheetName=code_block.out0, readAsStrings=code_block.out2, showExcel=code_block.out3)
code_block_5 = CodeBlock { 1; }

# group: Select Rooms from ID
string_from_object = FromObject(object=id)
transpose_3 = List.Transpose(lists=importExcel)
dropItems = List.DropItems(list=transpose_3@L2, amount=code_block_5)

values = CodeBlock(x=dropItems) { ID = x[0]; name = x[1]; number = x[2]; h = String.ToNumber(x[3]); [name, number, h]; }

# group (continued): Select Rooms from ID
indexOf = List.IndexOf(list=string_from_object, element=values.ID)
getItemAtIndex = List.GetItemAtIndex(list=all_elements_of_category, index=indexOf)

setParameterByName = Element.SetParameterByName(element=getItemAtIndex)  # unwired: parameterName, value
parameter_names = CodeBlock { p1 = "Name"; p2 = "Number"; p3 = "Limit Offset"; [p1,p2,p3]; }
combine = List.Combine(combineFunction=setParameterByName, list0=parameter_names.out3, list1=values.out4)
parameters = Element.Parameters(element=all_elements_of_category)

# group: CodeBlocks
file_path_2 = Filename("..\..\Desktop\New Microsoft Excel Worksheet.xlsx")
code_block_6 = CodeBlock { "Sheet1"; 0; true; false; }
get_all_elements = CodeBlock { cat = Category.ByName("Rooms"); ElementQueries.OfCategory(cat); }
get_parameter_values = CodeBlock(e=get_all_elements.out1)
# ---------- get_parameter_values.designscript (15 lines) ----------
// Getting ElementID
id = e.Id;

// Define which parameters will be used for Data extraction
param = ["Name","Number","Limit Offset","Department",
"Base Finish","Ceiling Finish","Wall Finish","Floor Finish"];

// Get Parameter Data from elements
values = Element.GetParameterValueByName(e,param<1>);

// Add IDs to the Dataset
add_1 = List.AddItemToFront(id,values);

// Add Parameter names (headers) for Excel
add_2 = List.AddItemToFront(param, List.Transpose(add_1));
# ----------------------------------------
exportToExcel_2 = Data.ExportToExcel(filePath=file_path_2, sheetName=code_block_6.out0, startRow=code_block_6.out1, startColumn=code_block_6.out1, data=get_parameter_values.add_2, overWrite=code_block_6.out2, writeAsString=code_block_6.out2)  # frozen
code_block_7 = CodeBlock { Strin; }  # unwired: Strin
file_from_path_2 = FileObject(path=file_path_2)
importExcel_2 = Data.ImportExcel(file=file_from_path_2, sheetName=code_block_6.out0, readAsStrings=code_block_6.out2, showExcel=code_block_6.out3)
code_block_8 = CodeBlock(room_collector=get_all_elements.out1, input=importExcel_2)
# ---------- code_block_8.designscript (25 lines) ----------
//Getting rooms from Collector
room_collector;
room_id = (room_collector.Id);
room_id_str = room_id + "";

// Getting Excel Data and Split it
param_names = input[0];
other_values = List.DropItems(input,1);
excel_data = List.Transpose(other_values);

// Split the Values
ID = excel_data[0];
name = excel_data[1];
number = excel_data[2];
limit = String.ToNumber(excel_data[3]);
department = excel_data[4];

param_values = [name,number,limit,department];

// Compare Excel Room IDs with Revit IDs
rooms_in_excel = List.IndexOf(room_id_str, ID);
rooms = List.GetItemAtIndex(room_collector, rooms_in_excel);

//Set the parameters values
Element.SetParameterByName(rooms, param_names,param_values);
# ----------------------------------------
watch = Watch(code_block_8.param_names)
