# Dynamo graph Dyn_00_08_Family Types and Instances.dyn (Dynamo 2.12.0.5650)

# group: Family Types & Instance
family_types = FamilyTypes("RPC Tree - Deciduous:Hawthorn - 25'")
all_elements_of_family_type = ElementsOfFamilyType(Family_Type=family_types)
name = Family.Name(family=family_types)
family = FamilyType.Family(familyType=family_types)
types = Family.Types(family=family)

name_2 = Family.Name(family=family)

# group: Familytypes by Name
byFamilyAndName = FamilyType.ByFamilyAndName()  # unwired: family, name
byFamilyNameAndTypeName = FamilyType.ByFamilyNameAndTypeName()  # unwired: familyName, typeName

# group: Family | Type by Name
string = StringInput("Honey Locust - 25'")
byName = FamilyType.ByName(name=string)
string_2 = StringInput("RCP Tree - Deciduous")
byName_2 = Family.ByName(name=string_2)

name_3 = FamilyType.Name(familyType=byName)
name_4 = Family.Name(family=byName_2)

# group: Level Types
levels = Levels("Level 1")
elevation = Level.Elevation(level=levels)
name_5 = Level.Name(level=levels)

parameters = Element.Parameters(element=levels)

# group: Create Floors
byOutlineTypeAndLevel = Floor.ByOutlineTypeAndLevel()  # unwired: outlineCurves, floorType, level
byOutlineTypeAndLevel_2 = Floor.ByOutlineTypeAndLevel()  # unwired: outline, floorType, level

# group: Create Walls
byCurveAndHeight = Wall.ByCurveAndHeight()  # unwired: curve, height, level, wallType
byCurveAndLevels = Wall.ByCurveAndLevels()  # unwired: curve, startLevel, endLevel, wallType

# group: Create Roof
byOutlineTypeAndLevel_3 = Roof.ByOutlineTypeAndLevel()  # unwired: outline, roofType, level
byOutlineExtrusionTypeAndLevel = Roof.ByOutlineExtrusionTypeAndLevel()  # unwired: outline, roofType, level, plane, extrusionStart, extrusionEnd

# group: System Families
floor_types = FloorTypes("Generic 300")
name_6 = FloorType.Name(floorType=floor_types)
roof_types = RoofTypes("Sloped Glazing")
name_7 = RoofType.Name(roofType=roof_types)
wall_types = WallTypes("Cavity wall_sliders")
name_8 = WallType.Name(wallType=wall_types)

# group: Type by Name
byName_3 = FloorType.ByName(name=name_6)
byName_4 = RoofType.ByName(name=name_7)
byName_5 = WallType.ByName(name=name_8)

# group: Change Parameter
code_block = CodeBlock { "Fire Rating"; "30"; }
setParameterByName = Element.SetParameterByName(element=byName_5, parameterName=code_block.out0, value=code_block.out1)

# group: Structural Family Types
structural_framing_types = StructuralFramingTypes("No structural framing types available.")
structural_column_types = StructuralColumnTypes("L127X127X9.5")

# group: Family Instance Properties
select_model_element = DSModelElementSelection()  # 1 picked in the model
getHost = FamilyInstance.GetHost(familyInstance=select_model_element)
facingOrientation = FamilyInstance.FacingOrientation(familyInstance=select_model_element)
location = FamilyInstance.Location(familyInstance=select_model_element)

getLocation = Element.GetLocation(element=select_model_element)

# group: Same?
string_from_object = FromObject(object=location)
string_from_object_2 = FromObject(object=getLocation)
eq = string_from_object == string_from_object_2
watch = Watch(eq)

# group: Element to Family
select_model_element_2 = DSModelElementSelection()  # nothing selected
geometry = Element.Geometry(element=select_model_element_2)
byUnion = Solid.ByUnion(solids=geometry)
code_block_2 = CodeBlock { "Sample"; Category.ByName("Generic Models"); }
file_path = Filename("No file selected.")
string_3 = StringInput("")
byName_6 = Material.ByName(name=string_3)
byGeometry = FamilyType.ByGeometry(solidGeometry=byUnion, name=code_block_2.out0, category=code_block_2.out1, templatePath=file_path, material=byName_6)

# group: Family Creation
byCoordinates = FamilyInstance.ByCoordinates()  # unwired: familyType
byFace = FamilyInstance.ByFace()  # unwired: familyType, face, line
byFace_2 = FamilyInstance.ByFace()  # unwired: familyType, face, location, referenceDirection
byPoint = FamilyInstance.ByPoint()  # unwired: familyType, point

# group: Family Creation(2)
byPointAndLevel = FamilyInstance.ByPointAndLevel()  # unwired: familyType, point, level
setRotation = FamilyInstance.SetRotation()  # unwired: familyInstance, degree
