# Dynamo graph Dyn_00_08_Family Types and Instances_example01.dyn (Dynamo 2.12.0.5650)
# packages: archi-lab.net 2022.212.3222, Genius Loci 2022.6.16

# group: Get Line Style from the view
all_elements_in_active_view = ElementsInView()
code_block = CodeBlock { "Line Style"; }
getParameterValueByName = Element.GetParameterValueByName(element=all_elements_in_active_view, parameterName=code_block)
code_block_2 = CodeBlock(e=getParameterValueByName) { e.Name; }

# group: Pick Lines for Floor Edge
line_styles = LineStyleUi("Floor")
code_block_3 = CodeBlock(e=line_styles) { e.Name; }
eq = code_block_2 == code_block_3
filterByBoolMask = List.FilterByBoolMask(list=all_elements_in_active_view, mask=eq)
curve = DetailCurve.Curve(detailCurve=filterByBoolMask.in)

# group: Create Floor
byJoinedCurves = PolyCurve.ByJoinedCurves(curves=curve)
floor_types = FloorTypes("Standard")
levels = Levels("Level 0")
byOutlineTypeAndLevel = Floor.ByOutlineTypeAndLevel(outlineCurves=byJoinedCurves, floorType=floor_types, level=levels)

# group: Pick Lines for Floor Edge
line_styles_2 = LineStyleUi("Wall")
code_block_4 = CodeBlock(e=line_styles_2) { e.Name; }
eq_2 = code_block_2 == code_block_4
filterByBoolMask_2 = List.FilterByBoolMask(list=all_elements_in_active_view, mask=eq_2)
curve_2 = DetailCurve.Curve(detailCurve=filterByBoolMask_2.in)

# group: Create Walls
levels_2 = Levels("Level 0")
levels_3 = Levels("Level 1")
wall_types = WallTypes("Wall-Partn_12P-70MStd-12P")
byCurveAndLevels = Wall.ByCurveAndLevels(curve=curve_2, startLevel=levels_2, endLevel=levels_3, wallType=wall_types)

code_block_5 = CodeBlock { 0.5; }

# group: Filled Regions - Doors
select_filled_region_type = FilledRegionTypes("Door")
all_elements_of_type = Custom[All Elements of Type+](type=select_filled_region_type)  # package Genius Loci; Get the instances of the given type. Works with ElementType, FamilyType, ViewFamilyType, Wall/Floor/Roof/CeilingType, GroupType, FilledRegionType and TextNoteType.
filled_region_boundary_curves = Custom[Filled Region Boundary Curves](filledRegion=all_elements_of_type)  # package archi-lab.net; This node will get the boundary curves for a filled region.
byJoinedCurves_2 = PolyCurve.ByJoinedCurves(curves=filled_region_boundary_curves)
patch = Curve.Patch(curve=byJoinedCurves_2)
pointAtParameter = Surface.PointAtParameter(surface=patch, u=code_block_5, v=code_block_5)

# group: Find Intersecting Wall for each Filled Region
family_types = FamilyTypes("Doors_ExtDbl_Flush:1810x2110mm")
code_block_6 = CodeBlock { Category.ByName("Walls"); }
all_elements_of_category = ElementsOfCategory(Category=code_block_6)
code_block_7 = CodeBlock { 500; }
thicken = Surface.Thicken(surface=patch, thickness=code_block_7)
flatten = List.Flatten(list=thicken)
geometry = Element.Geometry(element=all_elements_of_category)
doesIntersect = Geometry.DoesIntersect(geometry=flatten, other=geometry, lacing=CrossProduct)
flatten_2 = List.Flatten(list=doesIntersect@L3)
code_block_8 = CodeBlock { true; }
indexOf = List.IndexOf(list=flatten_2@L2, element=code_block_8)
getItemAtIndex = List.GetItemAtIndex(list=all_elements_of_category, index=indexOf)
flatten_3 = List.Flatten(list=pointAtParameter)
byHostAndPoint = FamilyInstance.ByHostAndPoint(familyType=family_types, host=getItemAtIndex, point=flatten_3)
