# Dynamo graph Dyn_00_09_Points and Lines.dyn (Dynamo 2.12.0.5650)

code_block = CodeBlock { 0..10..1; }
code_block_2 = CodeBlock { 0..5..1; }
byCoordinates = Point.ByCoordinates(x=code_block, y=code_block_2, lacing=CrossProduct)

# group: Previously used
getLocation = Element.GetLocation()  # unwired: element

# group: Range for spacing
code_block_3 = CodeBlock { 0; }
grid_count_100 = IntegerSlider(2500, range=1000..5000 step 100)
code_block_4 = CodeBlock { 200; }
range = Range(start=code_block_3, end=grid_count_100, step=code_block_4)

# group: Point By Coordinates
code_block_5 = CodeBlock { 0; }
byCoordinates_2 = Point.ByCoordinates(x=range, y=range, z=code_block_5, lacing=CrossProduct)

# group: Reverse engineering
X = Point.X(point=byCoordinates_2)
Y = Point.Y(point=byCoordinates_2)
Z = Point.Z(point=byCoordinates_2)

# group: Vector Creation
XAxis = Vector.XAxis()
YAxis = Vector.YAxis()
ZAxis = Vector.ZAxis()
reverse = Vector.Reverse()  # unwired: vector
byTwoPoints = Vector.ByTwoPoints()  # unwired: start, end
byCoordinates_3 = Vector.ByCoordinates()

# group: Vector measurement
angleAboutAxis = Vector.AngleAboutAxis()  # unwired: vector, otherVector, rotationAxis
angleWithVector = Vector.AngleWithVector()  # unwired: vector, otherVector

# group: Attractor Point
maximumItem = List.MaximumItem(list=range)
number_slider = DoubleSlider(0.56, range=0..1 step 0.01)
number_slider_2 = DoubleSlider(0.64, range=0..1 step 0.01)
code_block_6 = CodeBlock(max=maximumItem, x=number_slider, y=number_slider_2) { max*x; max*y; }
code_block_7 = CodeBlock { 0; }
byCoordinates_4 = Point.ByCoordinates(x=code_block_6.out0, y=code_block_6.out1, z=code_block_7)

# group: Height Range
min_ceiling_height = IntegerSlider(1250, range=500..3000 step 50)
max_ceiling_height = IntegerSlider(2200, range=500..3000 step 50)

code_block_8 = CodeBlock(x=max_ceiling_height) { x-100; }

# group: Map Distance between grid and Attractor Point
distanceTo = Geometry.DistanceTo(geometry=byCoordinates_2, other=byCoordinates_4)
remapRange = Math.RemapRange(numbers=distanceTo, newMin=min_ceiling_height, newMax=code_block_8)

# group: Translate Geometry
ZAxis_2 = Vector.ZAxis()
translate = Geometry.Translate(geometry=byCoordinates_2, direction=ZAxis_2, distance=remapRange)

# group: NURBS from points
byControlPoints = NurbsCurve.ByControlPoints(points=translate)
byLoft = PolySurface.ByLoft(crossSections=byControlPoints)

# group: Translate Geometry
ZAxis_3 = Vector.ZAxis()
translate_2 = Geometry.Translate(geometry=byCoordinates_2, direction=ZAxis_3, distance=max_ceiling_height)

# group: Line by start end Point
byStartPointEndPoint = Line.ByStartPointEndPoint(startPoint=translate, endPoint=translate_2)

# group: Make Forms
code_block_9 = CodeBlock { 50; }  # frozen
byCenterPointRadius = Circle.ByCenterPointRadius(centerPoint=translate, radius=code_block_9)
flatten = List.Flatten(list=byCenterPointRadius)
byCenterPointRadius_2 = Circle.ByCenterPointRadius(centerPoint=translate_2, radius=code_block_9)
flatten_2 = List.Flatten(list=byCenterPointRadius_2)
list_create = List.Create(item0=flatten, item1=flatten_2)
transpose = List.Transpose(lists=list_create)
byLoft_2 = Solid.ByLoft(crossSections=transpose)

# group: Place Families (adaptive)
flatten_3 = List.Flatten(list=translate)  # frozen
flatten_4 = List.Flatten(list=translate_2)
list_create_2 = List.Create(item0=flatten_3, item1=flatten_4)
transpose_2 = List.Transpose(lists=list_create_2)
family_types = FamilyTypes()  # nothing selected
byPoints = AdaptiveComponent.ByPoints(points=transpose_2, familyType=family_types)
