# Dynamo graph Dyn_GenDesign.dyn "Housing" (Dynamo 2.12.0.5650)
# packages: GenerativeDesign.Revit 1.10.10.0, GenerativeDesign 1.10.10.0

IN_Boundary = DSModelElementMutlipleSelection()  # 4 picked in the model; graph input
code_block = CodeBlock(e=IN_Boundary) { List.Flatten(e.Curves, -1); }
byJoinedCurves = PolyCurve.ByJoinedCurves(curves=code_block)
remember = Data.Remember(byJoinedCurves)
code_block_2 = CodeBlock { 255; 0; }
byARGB = Color.ByARGB(alpha=code_block_2.out0, red=code_block_2.out0, green=code_block_2.out1, blue=code_block_2.out1)
byGeometryColor = Modifiers.GeometryColor.ByGeometryColor(geometry=remember, color=byARGB)
in_width_depth = IntegerSlider(4100, range=1000..5000 step 100)  # graph input
code_block_3 = CodeBlock(l=in_width_depth)
# ---------- code_block_3.designscript (2 lines) ----------
//Offset towards inside
(l*-1)/2;
# ----------------------------------------
offset = Curve.Offset(curve=remember, distance=code_block_3)
byPatch = Surface.ByPatch(closedCurve=offset)
IN_u = DoubleSlider(0.53, range=0..1 step 0.01)  # graph input
IN_v = DoubleSlider(0.66, range=0..1 step 0.01)  # graph input
pointAtParameter = Surface.PointAtParameter(surface=byPatch, u=IN_u, v=IN_v)
ZAxis = Vector.ZAxis()
byOriginNormal = Plane.ByOriginNormal(origin=pointAtParameter, normal=ZAxis)
byWidthLength = Rectangle.ByWidthLength(plane=byOriginNormal, width=in_width_depth, length=in_width_depth)
ZAxis_2 = Vector.ZAxis()
convert_between_units = DynamoConvert(in_width_depth, MeasurementType="Length", FromConversion="Millimeters", ToConversion="Meters")
code_block_4 = CodeBlock(l=convert_between_units) { area = l*l; limit = 100; h = (limit / area) * 1000; }
extrudeAsSolid = Curve.ExtrudeAsSolid(curve=byWidthLength, direction=ZAxis_2, distance=code_block_4.h)
code_block_5 = CodeBlock { 255; 0; }
byARGB_2 = Color.ByARGB(alpha=code_block_5.out0, red=code_block_5.out1, green=code_block_5.out1, blue=code_block_5.out0)
byGeometryColor_2 = Modifiers.GeometryColor.ByGeometryColor(geometry=extrudeAsSolid, color=byARGB_2)
OUT_Geometry = Watch(byGeometryColor_2)  # graph output
floor = Math.Floor(number=code_block_4.h)
OUT_Height = Watch(floor)  # graph output
select_model_elements = DSModelElementsSelection()  # 1 picked in the model
geometry = Element.Geometry(element=select_model_elements)
byUnion = Solid.ByUnion(solids=geometry)
remember_2 = Data.Remember(byUnion)
code_block_6 = CodeBlock { 255; 125; }
byARGB_3 = Color.ByARGB(alpha=code_block_6.out1)
byGeometryColor_3 = Modifiers.GeometryColor.ByGeometryColor(geometry=remember_2, color=byARGB_3)
GF_CostValue = DoubleInput(100)
climb_CostValue = DoubleInput(5)
code_block_7 = CodeBlock { 1500; }
code_block_8 = CodeBlock(h=code_block_4.h, FloorHeight=code_block_7) { Vector.ZAxis(); 0..h..FloorHeight; }
count = List.Count(list=code_block_8.out1)
code_block_9 = CodeBlock(g=GF_CostValue, c=climb_CostValue, cv=count) { g..g+(c-1)*cv..cv; }
translate = Geometry.Translate(geometry=pointAtParameter, direction=code_block_8.out0, distance=code_block_8.out1)
code_block_10 = CodeBlock { Vector.YAxis(); Vector.ZAxis(); 0..350..10; }
rotate = Vector.Rotate(vector=code_block_10.out0, axis=code_block_10.out1, degrees=code_block_10.out2)
code_block_11 = CodeBlock { 20000; }
byStartPointDirectionLength = Line.ByStartPointDirectionLength(startPoint=translate, direction=rotate, length=code_block_11, lacing=CrossProduct)
doesIntersect = Geometry.DoesIntersect(geometry=byStartPointDirectionLength, other=remember_2)
countFalse = List.CountFalse(list=doesIntersect@L2)
mul = code_block_9 * countFalse
sum = Math.Sum(values=mul)
OUT_Yield = Watch(sum)  # graph output
