# Dynamo graph Dyn_WIP_CAD report.dyn "Report" (Dynamo 2.6.2.15705)

# group: NODE DETAILS
# note: AUTHOR + COPYRIGHT
# Copyright 2017 Bimorph Consultancy
# Thomas Mahon
# @Thomas__Mahon
# note: CONTACT
# www.bimorph.co.uk
# info@bimorph.co.uk
# @bimorphBIM
# note: GITHUB
# To report bugs or suggest improvements or new features, visit:
# https://github.com/ThomasMahon/bimorphNodes/
# note: FOLLOW US
# Follow us to get the latest digital engineering news & be the first to hear about bimorphNodes updates:
# FACEBOOK:  facebook.com/bimorphBIM
# LINKEDIN:  linkedin.com/company/bimorph-bim
# TWITTER:  @bimorphBIM
# note: USER GUIDE + DOWNLOADS
# For bimorphNodes user guides and downloadable example graphs, visit:
# www.bimorph.co.uk/bimorph-nodes
# note: PACKAGE NAME
# bimorphNodes

code_block = CodeBlock()
# ---------- code_block.designscript (3 lines) ----------
//To report the current document leave unconnected. To report an external Revit document or Family
//input a File Path and the file will be audited silently (without needing to open the file)
filePath:string="";
# ----------------------------------------
python_script = Python(IN[0]=code_block)
# ---------- python_script.python (86 lines) ----------
import clr

# Import RevitAPI
clr.AddReference("RevitAPI")
import Autodesk
from Autodesk.Revit.DB import *

# Import DocumentManager and TransactionManager
clr.AddReference("RevitServices")
import RevitServices
from RevitServices.Persistence import DocumentManager
#
def convertToList(listToConvert):
	if isinstance(listToConvert, list):
		return listToConvert
	else:
		return [listToConvert]

def cadAuditReporter(doc):
	cadLinkCollector = FilteredElementCollector(doc).OfClass(ImportInstance)
	cadLinks = cadLinkCollector.ToElements()
	
	CADLinkList = []
	CADImportList = []
	report = []
	for cad in cadLinks:
		name = cad.Parameter[BuiltInParameter.IMPORT_SYMBOL_NAME].AsString()
		isLinked = cad.IsLinked
		viewSpecific = cad.ViewSpecific 
		levelHost = doc.GetElement(cad.LevelId)
		
		ownerViewId = "Owner View : N/A"
		if viewSpecific:
			ownerViewId = doc.GetElement( cad.OwnerViewId )
			
		workSetId = cad.WorksetId
		worksetNames = None
		wSetsInDoc = FilteredWorksetCollector( doc )
		for w in wSetsInDoc:
			if w.Id == workSetId:
				worksetNames = "Workset : " + w.Name
		
		try:
			cadType = doc.GetElement( cad.GetTypeId() )
			cadExternalRef = cadType.GetExternalFileReference()
			path = ModelPathUtils.ConvertModelPathToUserVisiblePath( cadExternalRef.GetAbsolutePath() )
		
		except:
			path = "Path : N/A"
		
		if isLinked:
			cadType = doc.GetElement( cad.GetTypeId() )
			exRef = cadType.GetExternalFileReference()
			linkStatus = exRef.GetLinkedFileStatus()
		else:
			linkStatus = "Not a Link"
		
		CADLinkList.Add( cad ) if isLinked else CADImportList.Add( cad )		
		report.Add( [cad, name, "Is Linked : " + str(isLinked), "Status : " + str(linkStatus), "View Specific : " + str(viewSpecific), ownerViewId, worksetNames, path, levelHost] )
			
	return report, CADLinkList, CADImportList

uiapp = DocumentManager.Instance.CurrentUIApplication
app = uiapp.Application

processDocument = None
if IN[0] == "" or IN[0] == []:
	doc = DocumentManager.Instance.CurrentDBDocument
	processDocument = cadAuditReporter(doc)
	report = processDocument[0]
	CADLinkList = processDocument[1]
	CADImportList = processDocument[2]
	
else:
	report = []
	CADLinkList = []
	CADImportList = []
	filePath = convertToList(IN[0])
	for path in filePath:
		doc = app.OpenDocumentFile(FilePath( str(path) ), OpenOptions())
		processDocument = cadAuditReporter(doc) 
		report.Add(processDocument[0])
		CADLinkList.Add(processDocument[1])
		CADImportList.Add(processDocument[2])

OUT = "No Linked or Imported CAD files found" if report == [] else report, CADLinkList, CADImportList
# ----------------------------------------
code_block_2 = CodeBlock(output=python_script) { report = output[0]; cad_links = output[1]; cad_imports = output[2]; }
code_block_3 = CodeBlock(CADLinks=code_block_2.cad_links) { CADLinks; }
code_block_4 = CodeBlock(CADImports=code_block_2.cad_imports) { CADImports; }
code_block_5 = CodeBlock()
# ---------- code_block_5.designscript (2 lines) ----------
//To refresh, switch a bool input to its opposing state
refresh:bool=true;
# ----------------------------------------
code_block_6 = CodeBlock(report=code_block_2.report)
# ---------- code_block_6.designscript (10 lines) ----------
report;

// Get report values
cad_instance = List.GetItemAtIndex(report@L2<1>, 0);
cad_name = List.GetItemAtIndex(report@L2<1>, 1);
is_cad_linked = List.GetItemAtIndex(report@L2<1>, 2);
cad_status = List.GetItemAtIndex(report@L2<1>, 3);
cad_view_placed = List.GetItemAtIndex(report@L2<1>, 5);
cad_path = List.GetItemAtIndex(report@L2<1>, 7);
cad_level_placed = List.GetItemAtIndex(report@L2<1>, 8);
# ----------------------------------------
watch = Watch(code_block_6.report)
