# Dynamo graph Dyn_WIP_Cleanup.dyn (Dynamo 2.12.1.8246)

# note: Checking / Outputs
# Orange indicates checking nodes to ensure the script has deployed correctly.
# note: Working / Functions
# Green indicates the working of the script. No changes should be made in these groups unless advised.
# note: Variables / Inputs
# Red indicates Variables that can be altered per project and must be set accordingly before running the script.

# group: Dyn_WIP_Cleanup
# note: Workflow
# To be filled in!

# group: Excel file!
# note: Needed Excel File for exporting values!

# group: KAAN Architecten
# note: Date: 2022117

# group: Families Collector
python_script = Python()  # IronPython2; frozen; unwired: IN[0]
# ---------- python_script.python (40 lines) ----------
"""
FILTERED ELEMENT COLLECTOR
"""
# Importing Reference Modules
import clr # CLR ( Common Language Runtime Module )
clr.AddReference("RevitServices") # Adding the RevitServices.dll special Dynamo
# module to deal with Revit
import RevitServices # Importing RevitServices
from RevitServices.Persistence import DocumentManager # From RevitServices import
# the Document Manager
clr.AddReference("RevitAPI") # Adding the RevitAPI.dll module to access the Revit
# API
import Autodesk # Here we import the Autodesk namespace
# From the Autodesk namespace - derived down to the Revit Database, we import only
# the Filtered Element Collector and BuiltInCategory classes
from Autodesk.Revit.DB import FilteredElementCollector, FamilyInstance, Family

# Here we give the Revit Document a nickname of 'doc' which allows us to simply
# call 'doc' later without having to type the long namespace name
doc = DocumentManager.Instance.CurrentDBDocument

familyInstanceCollector = FilteredElementCollector(doc).OfClass(FamilyInstance).WhereElementIsNotElementType().ToElements()

systemFamilies = FilteredElementCollector(doc).WhereElementIsElementType().ToElements()

inPlaceFamilies = []

# Collect all InPlace families
for instance in familyInstanceCollector:
	symbol = instance.Symbol.Family
	if symbol.IsInPlace:
		inPlaceFamilies.append(instance)

loadableFamilies = [family for family in familyInstanceCollector if family not in inPlaceFamilies]

# Create a dictionary to output
output = {'inPlaceFamilies' : inPlaceFamilies, 'loadableFamilies' : loadableFamilies, 'systemFamilies' : systemFamilies}

# To get our results back inside of Dynamo, we need to append a list to the OUT port
OUT = output
# ----------------------------------------

code_block = CodeBlock(input=python_script)  # frozen
# ---------- code_block.designscript (3 lines) ----------
Dictionary.ValueAtKey(input, "systemFamilies");
Dictionary.ValueAtKey(input, "loadableFamilies");
Dictionary.ValueAtKey(input, "inPlaceFamilies");
# ----------------------------------------
code_block_2 = CodeBlock(e=code_block.out1)
# ---------- code_block_2.designscript (5 lines) ----------
fam_type = Element.GetParameterValueByName(e, "Family");
family = FamilyType.Family(fam_type);

//Grabbing unique items
List.UniqueItems(family);
# ----------------------------------------
family_get_subcategory = Python(IN[0]=code_block_2.out2)  # IronPython2
# ---------- family_get_subcategory.python (51 lines) ----------
#Alban de Chasteigner 2019
#twitter : @geniusloci_bim
#geniusloci.bim@gmail.com

import clr
clr.AddReference("RevitAPI")
import Autodesk
from Autodesk.Revit.DB import *

clr.AddReference("RevitNodes")
import Revit
clr.ImportExtensions(Revit.Elements)

clr.AddReference("RevitServices")
import RevitServices
from RevitServices.Persistence import DocumentManager
from RevitServices.Transactions import TransactionManager
doc = DocumentManager.Instance.CurrentDBDocument

families = UnwrapElement(IN[0]) if isinstance(IN[0],list) else [UnwrapElement(IN[0])]
fCat,subCategory = [],[]

TransactionManager.Instance.ForceCloseTransaction()
for fam in families:
	if isinstance(fam,FamilyInstance):
		family=fam.Symbol.Family
		if family.IsEditable :
			famDoc = doc.EditFamily(family)
			cate=Revit.Elements.Category.ById((family.FamilyCategoryId).IntegerValue)
	elif isinstance(fam,Family):
		#if fam.IsInPlace == False :
		if fam.IsEditable :
			family=fam
		famDoc = doc.EditFamily(family)
		cate=Revit.Elements.Category.ById((family.FamilyCategoryId).IntegerValue)
	#elif isinstance(fam,Document):
		#famDoc = fam
		#cate=Revit.Elements.Category.ById((famDoc.OwnerFamily.FamilyCategoryId).IntegerValue)
	else: pass	
	category = famDoc.OwnerFamily.FamilyCategory
	subcat=category.SubCategories
	for i in subcat:
		try:
			subCategory.append(Revit.Elements.Category.ById(i.Id.IntegerValue))
		except : subCategory.append(None)
	fCat.append(cate)
	if not isinstance(fam,Document):
		famDoc.Close(False)
	
if isinstance(IN[0], list): OUT = fCat,subCategory
else: OUT = fCat[0],subCategory
# ----------------------------------------

# group: Excel file location
file_path = Filename(".\New Microsoft Excel Worksheet.xlsx")

code_block_3 = CodeBlock { "Model"; }
# note: Export to excel?
boolean = BoolSelector(true)

# group: Collectors
documentelement_collector = Python()  # IronPython2
# ---------- documentelement_collector.python (111 lines) ----------
import clr
clr.AddReference('RevitAPI')
from Autodesk.Revit.DB import *

clr.AddReference("RevitNodes")
import Revit
clr.ImportExtensions(Revit.Elements)
clr.ImportExtensions(Revit.GeometryConversion)

clr.AddReference("RevitServices")
import RevitServices
from RevitServices.Persistence import DocumentManager
from RevitServices.Transactions import TransactionManager

from System.Collections.Generic import *

doc = DocumentManager.Instance.CurrentDBDocument
collector = FilteredElementCollector(doc)

SpaceCats = List[BuiltInCategory]()
SpaceCats.Add(BuiltInCategory.OST_Rooms)
SpaceCats.Add(BuiltInCategory.OST_Areas)

BuiltInCats = List[BuiltInCategory]()
BuiltInCats.Add(BuiltInCategory.OST_Ceilings)
BuiltInCats.Add(BuiltInCategory.OST_Columns)
BuiltInCats.Add(BuiltInCategory.OST_Casework)
BuiltInCats.Add(BuiltInCategory.OST_CurtainWallPanels)
BuiltInCats.Add(BuiltInCategory.OST_CurtainWallMullions)
BuiltInCats.Add(BuiltInCategory.OST_Doors)
BuiltInCats.Add(BuiltInCategory.OST_Floors)
BuiltInCats.Add(BuiltInCategory.OST_Furniture)
BuiltInCats.Add(BuiltInCategory.OST_GenericModel)
BuiltInCats.Add(BuiltInCategory.OST_Mass)
BuiltInCats.Add(BuiltInCategory.OST_Parking)
BuiltInCats.Add(BuiltInCategory.OST_PlumbingFixtures)
BuiltInCats.Add(BuiltInCategory.OST_StairsRailing)
BuiltInCats.Add(BuiltInCategory.OST_Ramps)
BuiltInCats.Add(BuiltInCategory.OST_Roofs)
BuiltInCats.Add(BuiltInCategory.OST_Stairs)
BuiltInCats.Add(BuiltInCategory.OST_StructuralColumns)
BuiltInCats.Add(BuiltInCategory.OST_StructuralFraming)
BuiltInCats.Add(BuiltInCategory.OST_Topography)
BuiltInCats.Add(BuiltInCategory.OST_Windows)
BuiltInCats.Add(BuiltInCategory.OST_Walls)
BuiltInCats.Add(BuiltInCategory.OST_Grids)
BuiltInCats.Add(BuiltInCategory.OST_Levels)

Materials = List[BuiltInCategory]()
Materials.Add(BuiltInCategory.OST_Materials)

OpeningCats = List[BuiltInCategory]()
OpeningCats.Add(BuiltInCategory.OST_CeilingOpening)
OpeningCats.Add(BuiltInCategory.OST_FloorOpening)
OpeningCats.Add(BuiltInCategory.OST_RoofOpening)
OpeningCats.Add(BuiltInCategory.OST_ShaftOpening)

CoordCats = List[BuiltInCategory]()
CoordCats.Add(BuiltInCategory.OST_DuctTerminal)
CoordCats.Add(BuiltInCategory.OST_FireAlarmDevices)
CoordCats.Add(BuiltInCategory.OST_LightingFixtures)
CoordCats.Add(BuiltInCategory.OST_SecurityDevices)
CoordCats.Add(BuiltInCategory.OST_Sprinklers)

AnnCats = List[BuiltInCategory]()
AnnCats.Add(BuiltInCategory.OST_Callouts)
AnnCats.Add(BuiltInCategory.OST_DetailComponents)
AnnCats.Add(BuiltInCategory.OST_Dimensions)
AnnCats.Add(BuiltInCategory.OST_ElevationMarks)
AnnCats.Add(BuiltInCategory.OST_Elev)
AnnCats.Add(BuiltInCategory.OST_FilledRegion)
AnnCats.Add(BuiltInCategory.OST_GridHeads)
AnnCats.Add(BuiltInCategory.OST_LevelHeads)
AnnCats.Add(BuiltInCategory.OST_Lines)
AnnCats.Add(BuiltInCategory.OST_MaskingRegion)

LayoutCats = List[BuiltInCategory]()
LayoutCats.Add(BuiltInCategory.OST_ScheduleGraphics)
LayoutCats.Add(BuiltInCategory.OST_Schedules)
LayoutCats.Add(BuiltInCategory.OST_PanelScheduleGraphics)
LayoutCats.Add(BuiltInCategory.OST_ColorFillLegends)
LayoutCats.Add(BuiltInCategory.OST_TitleBlocks)
LayoutCats.Add(BuiltInCategory.OST_Views)
LayoutCats.Add(BuiltInCategory.OST_Sheets)

GroupCats = List[BuiltInCategory]()
GroupCats.Add(BuiltInCategory.OST_IOSDetailGroups)
GroupCats.Add(BuiltInCategory.OST_IOSModelGroups)



SpaceFilter = ElementMulticategoryFilter(SpaceCats)
BuiltInFilter = ElementMulticategoryFilter(BuiltInCats)
MaterialFilter = ElementMulticategoryFilter(Materials)
OpeningFilter = ElementMulticategoryFilter(OpeningCats)
CoordFilter = ElementMulticategoryFilter(CoordCats)
AnnFilter = ElementMulticategoryFilter(AnnCats)
LayoutFilter = ElementMulticategoryFilter(LayoutCats)
GroupFilter = ElementMulticategoryFilter(GroupCats)

SpaceElements = FilteredElementCollector(doc).WherePasses(SpaceFilter).ToElements()
BuiltInElements = FilteredElementCollector(doc).WherePasses(BuiltInFilter).ToElements()
MaterialElements = FilteredElementCollector(doc).WherePasses(MaterialFilter).ToElements()
OpeningElements = FilteredElementCollector(doc).WherePasses(OpeningFilter).ToElements()
CoordElements = FilteredElementCollector(doc).WherePasses(CoordFilter).ToElements()
AnnElements = FilteredElementCollector(doc).WherePasses(AnnFilter).WhereElementIsNotElementType().ToElements()
LayoutElements = FilteredElementCollector(doc).WherePasses(LayoutFilter).WhereElementIsNotElementType().ToElements()
GroupElements = FilteredElementCollector(doc).WherePasses(GroupFilter).WhereElementIsNotElementType().ToElements()


OUT = SpaceElements, BuiltInElements,  GroupElements, MaterialElements, OpeningElements, CoordElements, AnnElements, LayoutElements
# ----------------------------------------
documentline_collector = Python()  # IronPython2
# ---------- documentline_collector.python (76 lines) ----------
import clr
clr.AddReference('ProtoGeometry')
from Autodesk.DesignScript.Geometry import *

# Import ToDSType(bool) extension method
clr.AddReference("RevitNodes")
import Revit
clr.ImportExtensions(Revit.Elements)

# Import geometry conversion extension methods
clr.ImportExtensions(Revit.GeometryConversion)

# Import DocumentManager and TransactionManager
clr.AddReference("RevitServices")
import RevitServices
from RevitServices.Persistence import DocumentManager
from RevitServices.Transactions import TransactionManager
from System.Collections.Generic import *

# Import RevitAPI
clr.AddReference("RevitAPI")
import Autodesk
from Autodesk.Revit.DB import *

doc = DocumentManager.Instance.CurrentDBDocument
uiapp = DocumentManager.Instance.CurrentUIApplication
app = uiapp.Application
uidoc=DocumentManager.Instance.CurrentUIApplication.ActiveUIDocument

# Start Transaction
TransactionManager.Instance.EnsureInTransaction(doc)

lineStyle = doc.Settings.Categories.get_Item(BuiltInCategory.OST_Lines)
lineStyleSubTypes = lineStyle.SubCategories

listNames = []
listRGB = []
lineWeight = []
listPattern = []
patname = []
listout = []
listpatid = []
for i in lineStyleSubTypes:
	name = i.Name
	#rgb = [i.LineColor.Red, i.LineColor.Green, i.LineColor.Blue]
	rgb = i.LineColor
	weight = i.GetLineWeight(GraphicsStyleType.Projection)
	listNames.append(name)
	listRGB.append(rgb)
	lineWeight.append(weight)
	id = i.GetLinePatternId(GraphicsStyleType.Projection)
	pat = LinePatternElement.GetLinePattern(doc,id)
	listPattern.append(pat)
	listpatid.append(id)
	try:
		patname.append(pat.Name)
	except:
		patname.append("Solid")
		
	style = i.GetGraphicsStyle(GraphicsStyleType.Projection)
	listout.append(style)


pattern_names = []
pattern_ids = []
for type in FilteredElementCollector(doc).OfClass(LinePatternElement).ToElements():
    patterns = type.ToDSType(True)
    pattern_names.append(patterns.Name)
    pattern_ids.append(patterns)



# End Transaction
TransactionManager.Instance.TransactionTaskDone()

OUT = lineStyleSubTypes, listNames, listRGB, lineWeight, listPattern, patname, listpatid, pattern_ids, pattern_names
# ----------------------------------------
documentworkset_collector = Python()  # IronPython2
# ---------- documentworkset_collector.python (27 lines) ----------
# Load the Python Standard and DesignScript Libraries
import clr
clr.AddReference("RevitNodes")
import Revit
clr.ImportExtensions(Revit.Elements)
clr.ImportExtensions(Revit.GeometryConversion)
clr.AddReference("RevitServices")
import RevitServices
from RevitServices.Persistence import DocumentManager
from RevitServices.Transactions import TransactionManager
clr.AddReference("RevitAPI")
import Autodesk
from Autodesk.Revit.DB import *

# The inputs to this node will be stored as a list in the IN variables.
doc = DocumentManager.Instance.CurrentDBDocument


# Place your code below this line
worksets = FilteredWorksetCollector(doc).OfKind(WorksetKind.UserWorkset).ToWorksets()

names = [w.Name for w in worksets]

ids = [w.Id.IntegerValue for w in worksets]

# Assign your output to the OUT variable.
OUT = [worksets, names, ids]
# ----------------------------------------

code_block_4 = CodeBlock(model=documentelement_collector, graphics=documentline_collector, worksets=documentworkset_collector)
# ---------- code_block_4.designscript (30 lines) ----------
// Element Collector
rooms_out = model[0];

model_elements_out = model[1];
openings_out = model[4];
coordination_out = model[5];

groups = model[2];

layout_elements = model[7];

materials_out = model[3];

annotation_elements_out = model[6];


// Line Styles
line_style_names = graphics[1];
line_RGB = graphics[2];
line_weight = graphics[3];
line_pattern_name = graphics[5];
line_pattern_id = graphics[6];
// Line Patterns
file_line_pattern_id = graphics[7];
file_line_pattern_name = graphics[8];


// Worksets
workset_ids = worksets[2];
workset_names = worksets[1];
# ----------------------------------------
group_by_cat = CodeBlock(rooms=code_block_4.rooms_out, model_elements=code_block_4.model_elements_out, openings=code_block_4.openings_out, coordination=code_block_4.coordination_out, groups=code_block_4.groups, views=code_block_4.layout_elements, material=code_block_4.materials_out, annotation=code_block_4.annotation_elements_out)
# ---------- group_by_cat.designscript (36 lines) ----------
space_input = rooms;
model_input = List.Flatten([model_elements, openings, coordination]);
groups_input = groups;
view_input = views;
material_input = material;
ann_input = annotation;


// Get category names
space_cats = Element.GetCategory(space_input) + "";
model_cats = Element.GetCategory(model_input) + "";
groups_cats = Element.GetCategory(groups_input) + "";
view_cats =  Element.GetCategory(view_input) + "";
material_cats = Element.GetCategory(material_input) + "";
ann_cats = Element.GetCategory(ann_input) + "";


// Group Lists based on category names
space_by_cat = List.GroupByKey(space_input, space_cats);
model_by_cat = List.GroupByKey(model_input, model_cats);
groups_by_cat = List.GroupByKey(groups_input, groups_cats);
view_by_cat = List.GroupByKey(view_input, view_cats);
material_by_cat = List.GroupByKey(material_input, material_cats);
ann_by_cat = List.GroupByKey(ann_input, ann_cats);


// Output grouped elements based on category (sublists)
space_groups = Dictionary.ValueAtKey(space_by_cat, "groups");
model_groups = Dictionary.ValueAtKey(model_by_cat, "groups");
groups_groups = Dictionary.ValueAtKey(groups_by_cat, "groups");
view_groups = Dictionary.ValueAtKey(view_by_cat, "groups");
material_groups = Dictionary.ValueAtKey(material_by_cat, "groups");
ann_groups = Dictionary.ValueAtKey(ann_by_cat, "groups");


// Dictionary.ValueAtKey(dict_by_cat, "unique keys");
# ----------------------------------------
code_block_5 = CodeBlock(categories=group_by_cat.model_cats, grouped_by_cat=group_by_cat.model_groups)  # frozen
# ---------- code_block_5.designscript (21 lines) ----------
// Inputs
categories;
grouped_by_cat;


// Getting elements count (instances and types)
count = List.Count(grouped_by_cat<2>);
count_string = categories + ": " + count + " items";

// Element information
cats = Element.GetCategory(grouped_by_cat<2>);
ids = grouped_by_cat.Id<2>;
GUIDs = grouped_by_cat.UniqueId<2>;

flatten_cats = List.Flatten(cats);
flatten_ids = List.Flatten(ids);
flatten_GUIDs = List.Flatten(GUIDs);

// Names - there will be a bunch of nulls
names = grouped_by_cat.Name<2>;
flatten_names = List.Flatten(names);
# ----------------------------------------
string_from_object = FromObject(object=code_block_5.flatten_names)
code_block_6 = CodeBlock(input=string_from_object) { String.Replace(input,"null",""); }
code_block_7 = CodeBlock()
# ---------- code_block_7.designscript (5 lines) ----------
[
"Category",
"ID",
"GUID",
"Name" ];
# ----------------------------------------
code_block_8 = CodeBlock(a=code_block_5.flatten_cats, b=code_block_5.flatten_ids, c=code_block_5.flatten_GUIDs, d=code_block_6, headers=code_block_7) { combined = [a,b,c,d]; trans = List.Transpose(combined); List.AddItemToFront(headers, trans); }

# group: Gate
code_block_9 = CodeBlock(Test=boolean, data=code_block_8.out2)
# ---------- code_block_9.designscript (6 lines) ----------
Test?
0:
null;

data;
true;
# ----------------------------------------

exportToExcel = Data.ExportToExcel(filePath=file_path, sheetName=code_block_3, startRow=code_block_9.out0, startColumn=code_block_9.out0, data=code_block_9.data, overWrite=code_block_9.out2, writeAsString=code_block_9.out2)
code_block_10 = CodeBlock(mats=group_by_cat.material_groups) { List.Flatten(mats); }

# group: Assets
get_asset = Python(IN[0]=code_block_10)  # IronPython2
# ---------- get_asset.python (37 lines) ----------
#Inspired by Boris Shafiro from Autodesk
#Alban de Chasteigner 2018
#twitter : @geniusloci_bim
#geniusloci.bim@gmail.com

import clr
clr.AddReference('RevitAPI')
from Autodesk.Revit.DB import *
clr.AddReference('RevitServices')
import RevitServices
from RevitServices.Persistence import DocumentManager
doc = DocumentManager.Instance.CurrentDBDocument
 
mats = UnwrapElement(IN[0]) if isinstance(IN[0],list) else [UnwrapElement(IN[0])]
assetElems,names,assets,assetTypes,titles=[],[],[],[],[]

for mat in mats:
	appearanceAssetId = mat.AppearanceAssetId
	if appearanceAssetId != ElementId.InvalidElementId:
		assetElem = doc.GetElement(appearanceAssetId)
	else:
		assetElem = ElementId.InvalidElementId
	if hasattr(assetElem, 'GetRenderingAsset'):
		asset = assetElem.GetRenderingAsset()
	else:
		asset = None
	assetElems.append(assetElem)
	assets.append(asset)
	if hasattr(asset, 'AssetType'):
		assetType, title, name = asset.AssetType, asset.Title, asset.Name
	else:
		assetType, title, name = None, None, None
	assetTypes.append(assetType)
	titles.append(title)
	names.append(name)

OUT = assetElems,assets,assetTypes,titles,names
# ----------------------------------------
code_block_11 = CodeBlock(x=get_asset) { asset_el = x[0]; asset_name = asset_el.Name; }

string_from_object_2 = FromObject(object=code_block_11.asset_name)
code_block_12 = CodeBlock(asset_name=string_from_object_2) { String.Replace(asset_name,"null",""); }
watch = Watch(code_block_12)
watch_2 = Watch(code_block_5.count_string)

# group: Warnings
code_block_13 = CodeBlock()
# ---------- code_block_13.designscript (11 lines) ----------
// Get current document
doc = Revit.Document.Current;

// Collect model warnnings
warning_collector = Warning.GetWarnings(doc);
warning_count = List.Count(warning_collector);

// Get relevatn warning information
Warning.Severity(warning_collector);
Warning.Description(warning_collector);
Warning.GetFailingElements(warning_collector);
# ----------------------------------------

code_block_14 = CodeBlock(e=code_block_10) { name = e.Name; new_name = "K_" + name; }
code_block_15 = CodeBlock(elements=code_block_14.name) { elements; }
code_block_16 = CodeBlock(name=code_block_14.new_name) { name; }

# group: Element Set Name
python_script_2 = Python(IN[0]=code_block_15, IN[1]=code_block_16)  # IronPython2; frozen
# ---------- python_script_2.python (57 lines) ----------
import clr
clr.AddReference('RevitAPI')
from Autodesk.Revit.DB import *

clr.AddReference("RevitNodes")
import Revit
clr.ImportExtensions(Revit.Elements)

clr.AddReference("RevitServices")
import RevitServices
from RevitServices.Persistence import DocumentManager
from RevitServices.Transactions import TransactionManager

doc = DocumentManager.Instance.CurrentDBDocument
items = UnwrapElement(IN[0])
names = IN[1]

def SetElementName(item, name):
	# family parameters
	if item.GetType().ToString() == "Autodesk.Revit.DB.FamilyParameter":
		try: 
			doc.FamilyManager.RenameParameter(item, name)
			return True
		except: return False
	# regular revit worksets
	elif item.GetType().ToString() =="Autodesk.Revit.DB.Workset":
		try: 
			doc.GetWorksetTable().RenameWorkset(doc, item.Id, name)
			return True
		except: return False
	# archilab worksets (dynamo 1.x)
	elif item.GetType().ToString() == "Archilab.Grimshaw.Elements.Workset":
		try: 
			doc.GetWorksetTable().RenameWorkset(doc, WorksetId(item.Id), name)
			return True
		except: return False
	# archilab worksets (dynamo 2.x)
	elif item.GetType().ToString() == "archilab.Revit.Elements.Workset":
		try: 
			doc.GetWorksetTable().RenameWorkset(doc, WorksetId(item.Id), name)
			return True
		except: return False
	# everything else that has a name property
	else:
		try: 
			item.Name = name
			return True
		except: return False

TransactionManager.Instance.EnsureInTransaction(doc)
if isinstance(IN[0], list):
	if isinstance(names, list): OUT = [SetElementName(x, y) for x, y in zip(items, names)]
	else: OUT = [SetElementName(x, names) for x in items]
else:
	if isinstance(names, list): OUT = SetElementName(items, names[0])
	else: OUT = SetElementName(items, names)
TransactionManager.Instance.TransactionTaskDone()
# ----------------------------------------

watch_3 = Watch(code_block_4.line_style_names)
watch_4 = Watch(code_block_4.file_line_pattern_name)
watch_5 = Watch(code_block_4.line_pattern_name)

# group: Get Line Types
element_types = ElementTypes("LinePatternElement")
all_elements_of_type = ElementsOfType(element_type=element_types)
# note: Important stuff
# Purple will indicate something important is going on here.
code_block_17 = CodeBlock(lines=all_elements_of_type)
# ---------- code_block_17.designscript (8 lines) ----------
lines;
line_name = lines.Name;
filter = "K_";

bool_val = String.Contains(line_name,filter);
bool_mask = List.FilterByBoolMask(lines,bool_val);

Dictionary.ValueAtKey(bool_mask,"out");
# ----------------------------------------
code_block_18 = CodeBlock { type = Element.ElementType.ByName("LinePatternElement"); ElementQueries.OfElementType(type); }

# group: Get Subcategories
# note: Untouched Python
get_category_properties = Python()  # IronPython2; frozen; unwired: IN[0]
# ---------- get_category_properties.python (49 lines) ----------
#Alban de Chasteigner 2018
#twitter : @geniusloci_bim
#geniusloci.bim@gmail.com

import clr
clr.AddReference('RevitAPI')
from Autodesk.Revit.DB import *

clr.AddReference("RevitNodes")
import Revit
clr.ImportExtensions(Revit.Elements)

clr.AddReference('DSCoreNodes')
import DSCore
from DSCore import Color

clr.AddReference("RevitServices")
import RevitServices
from RevitServices.Persistence import DocumentManager
doc = DocumentManager.Instance.CurrentDBDocument

cat = UnwrapElement(IN[0]) if isinstance(IN[0],list) else [UnwrapElement(IN[0])]

subcat = cat[0].SubCategories

subCategory,listGraph,listPattern,patname,listpatid,lineProjWeight,lineProjCut,listRGB,listMaterial = [],[],[],[],[],[],[],[],[]

for i in subcat:
	subCategory.append(Revit.Elements.Category.ById(i.Id.IntegerValue))
	id = i.GetLinePatternId(GraphicsStyleType.Projection)
	pat = LinePatternElement.GetLinePattern(doc,id)
	projWeight = i.GetLineWeight(GraphicsStyleType.Projection)
	cutWeight = i.GetLineWeight(GraphicsStyleType.Cut)
	rgb = DSCore.Color.ByARGB(255,i.LineColor.Red, i.LineColor.Green, i.LineColor.Blue)
	listMaterial.append(i.Material)
	listRGB.append(rgb)
	lineProjWeight.append(projWeight)
	lineProjCut.append(cutWeight)
	listPattern.append(pat)
	listpatid.append(doc.GetElement(id))
	try:
		patname.append(pat.Name)
	except:
		patname.append("Solid")
		
	style = i.GetGraphicsStyle(GraphicsStyleType.Projection)
	listGraph.append(style)

OUT = listGraph, subCategory, listpatid, patname, lineProjWeight, lineProjCut,listRGB,listMaterial
# ----------------------------------------
code_block_19 = CodeBlock(x=get_category_properties)
# ---------- code_block_19.designscript (8 lines) ----------
graphic_style = x[0];
subcat = x[1];
line_pattern = x[2];
line_pattern_name = x[3];
projection_line_w = x[4];
cut_line_w = x[5];
line_colors = x[6];
material = x[7];
# ----------------------------------------
code_block_20 = CodeBlock()
# ---------- code_block_20.designscript (36 lines) ----------
cats = ["Air Terminals",
"Casework",
"Columns",
"Curtain Panels",
"Curtain Wall Mullions",
"Detail Items",
"Doors",
"Electrical Equipment",
"Electrical Fixtures",
"Entourage",
"Fire Alarm Devices",
"Furniture",
"Furniture Systems",
"Generic Models",
"Lighting Devices",
"Lighting Fixtures",
"Lines",
"Mechanical Equipment",
"Planting",
"Parking",
"Plumbing Fixtures",
"Railings",
"Ramps",
"Security Devices",
"Specialty Equipment",
"Sprinklers",
"Structural Columns",
"Structural Framing",
"Windows",

"Generic Annotations",
"Title Blocks",
"Reference Planes"];


Revit.Category.ByName(cats);
# ----------------------------------------
get_category_properties_2 = Python(IN[0]=code_block_20.out1)  # IronPython2
# ---------- get_category_properties_2.python (34 lines) ----------
import clr
clr.AddReference('RevitAPI')
from Autodesk.Revit.DB import *

clr.AddReference("RevitNodes")
import Revit
clr.ImportExtensions(Revit.Elements)

clr.AddReference('DSCoreNodes')
import DSCore
from DSCore import Color

clr.AddReference("RevitServices")
import RevitServices
from RevitServices.Persistence import DocumentManager
doc = DocumentManager.Instance.CurrentDBDocument

cat = UnwrapElement(IN[0]) if isinstance(IN[0],list) else [UnwrapElement(IN[0])]


subcat =[]
for i in range(len(cat)):
	subcat.append(cat[i].SubCategories)

# subcat = cat[0].SubCategories

subCategory = []

for i in subcat:
	for c in i:
		subCategory.append(Revit.Elements.Category.ById(c.Id.IntegerValue))


OUT =  subCategory
# ----------------------------------------
# note: Delete LineStyles if not K_
code_block_21 = CodeBlock(subcat=get_category_properties_2)
# ---------- code_block_21.designscript (7 lines) ----------
subcat_name = subcat.Name;
filter = "K_";

bool_val = String.Contains(subcat_name,filter);
bool_mask = List.FilterByBoolMask(subcat,bool_val);

Dictionary.ValueAtKey(bool_mask,"out");
# ----------------------------------------
join = List.Join(list0=code_block_17.out5, list1=code_block_21.out4)
delete_elements = Python(IN[0]=join)  # IronPython2; unwired: IN[1]
# ---------- delete_elements.python (47 lines) ----------
#Copyright(c) 2016, Dimitar Venkov
# @5devene, dimitar.ven@gmail.com

import clr
clr.AddReference('RevitAPI')
from Autodesk.Revit.DB import*
clr.AddReference('RevitServices')
import RevitServices
from RevitServices.Persistence import DocumentManager
from RevitServices.Transactions import TransactionManager

def tolist(obj1):
	if hasattr(obj1,"__iter__"): return obj1
	else: return [obj1]

elems = UnwrapElement(tolist(IN[0]))
inputdocs = tolist(UnwrapElement(IN[1]))

#Part of script from Clockwork
for inputdoc in inputdocs :
	if inputdoc == None:
		doc = DocumentManager.Instance.CurrentDBDocument
	elif inputdoc.GetType().ToString() == "Autodesk.Revit.DB.Document":
		doc = inputdoc
	elif inputdoc.GetType().ToString() == "Autodesk.Revit.DB.RevitLinkInstance":
		doc = inputdoc.GetLinkDocument()
	else: doc = None
	
	TransactionManager.Instance.ForceCloseTransaction()
	t = Transaction(doc,'delete')
	t.Start()

deleted, failed = [], []

for e in elems:
	id = None
	try:
		id = e.Id
		del_id = doc.Delete(id)
		deleted.extend([d.ToString() for d in del_id])
	except:
		if id is not None:
			failed.append(id.ToString() )
s = set(deleted)
failed1 = [x for x in failed if x not in s]
t.Commit()
OUT = len(deleted), ';'.join(deleted), ';'.join(failed1)
# ----------------------------------------
code_block_22 = CodeBlock(x=delete_elements) { count = x[0]; deleted_ids = x[1]; failed_ids = x[2]; }

code_block_23 = CodeBlock(elements=code_block_11.asset_el) { elements; }
code_block_24 = CodeBlock(e=code_block_12) { name = e.Name; new_name = "K_" + name; }
code_block_25 = CodeBlock(name=code_block_24.new_name) { name; }
python_script_3 = Python(IN[0]=code_block_23, IN[1]=code_block_25)  # IronPython2; frozen; same code as python_script_2
