# Dynamo graph Dyn_WIP_CollectElementsByCategory andLink.dyn "ByCategory and Link" (Dynamo 2.12.1.8246)

# note: Important stuff
# Purple will indicate something important is going on here.
# note: Checking / Outputs
# Orange indicates checking nodes to ensure the script has deployed correctly.

# group: KAAN Architecten
# note: 15-11-2022

# group: Collect all Revit Linked Docs
# note: Working / Functions
# Green indicates the working of the script. No changes should be made in these groups unless advised.
# note: Variables / Inputs
# Red indicates Variables that can be altered per project and must be set accordingly before running the script.
linkeddoc_collector = Python()  # CPython3; graph input
# ---------- linkeddoc_collector.python (25 lines) ----------
#Alban de Chasteigner 2020
#twitter : @geniusloci_bim
#geniusloci.bim@gmail.com
#https://github.com/albandechasteigner/GeniusLociForDynamo

import clr
clr.AddReference("RevitServices")
import RevitServices
from RevitServices.Persistence import DocumentManager
doc = DocumentManager.Instance.CurrentDBDocument
uiapp = DocumentManager.Instance.CurrentUIApplication
app = uiapp.Application
docs = app.Documents

titles,documents = [],[]

for dc in docs:
	if dc.Title != doc.Title:
		documents.Add(dc)
		titles.Add(dc.Title)
	else:
		docu=dc
		titl=dc.Title

OUT = [docu]+documents,[titl]+titles
# ----------------------------------------
code_block = CodeBlock(x=linkeddoc_collector) { documents =x[0]; filename = x[1]; }

# group: Rvt
code_block_2 = CodeBlock { "ARC"; }

# group: Category name
code_block_3 = CodeBlock { "Rooms"; }

# group: Filter and Collect all Elements
contains = String.Contains(string=code_block.filename, searchFor=code_block_2)
# note: Collect elements based on RVT link(s) and Category(ies)
filterByBoolMask = List.FilterByBoolMask(list=code_block.documents, mask=contains)
code_block_4 = CodeBlock(link_doc=filterByBoolMask.in, cat_name=code_block_3)
# ---------- code_block_4.designscript (5 lines) ----------
// Use only if you want to query a linked model*/
link_doc;

//Category
Category.ByName(cat_name);
# ----------------------------------------

get_elements_from_linked_model = Python(IN[0]=code_block_4.link_doc, IN[1]=code_block_4.out1)  # CPython3
# ---------- get_elements_from_linked_model.python (37 lines) ----------
import clr
clr.AddReference('ProtoGeometry')
from Autodesk.DesignScript.Geometry import *

# Import RevitAPI
clr.AddReference("RevitAPI")
import Autodesk
from Autodesk.Revit.DB import *

import System

import sys
pyt_path = r'C:\Program Files (x86)\IronPython 2.7\Lib'
sys.path.append(pyt_path)

#The inputs to this node will be stored as a list in the IN variable.
dataEnteringNode = IN

_linkDoc = IN[0]
_category = IN[1]
result = []

for doc in _linkDoc:
	try:
		errorReport = None
		filter = ElementCategoryFilter(System.Enum.ToObject(BuiltInCategory, _category.Id))
		result.append(FilteredElementCollector(doc).WherePasses(filter).WhereElementIsNotElementType().ToElements())
	except:
		# if error accurs anywhere in the process catch it
		import traceback
		errorReport = traceback.format_exc()

#Assign your output to the OUT variable
if errorReport == None:
	OUT = result
else:
	OUT = errorReport
# ----------------------------------------
flatten = List.Flatten(list=get_elements_from_linked_model)
