# Dynamo graph Dyn_WIP_Get Element Host.dyn "Doors_Host" (Dynamo 2.12.1.8246)

# note: Important stuff
# Purple will indicate something important is going on here.
# note: Checking / Outputs
# Orange indicates checking nodes to ensure the script has deployed correctly.
# note: Working / Functions
# Green indicates the working of the script. No changes should be made in these groups unless advised.
# note: Variables / Inputs
# Red indicates Variables that can be altered per project and must be set accordingly before running the script.

# group: Excel file!
# note: Needed Excel File for exporting values!

# group: Dyn_WIP_Cleanup
# note: Workflow
# To be filled in!

# group: KAAN Architecten
# note: Date: 2023.01.13

# group: Excel Location
file_path = Filename(".\New Microsoft Excel Worksheet.xlsx")

code_block = CodeBlock { "Sheet1"; 0; true; }

# group: Input Category
code_block_2 = CodeBlock { "Doors"; }

# group: Select All elements
# note: Windows could also work!
code_block_3 = CodeBlock(cat_name=code_block_2) { cat = Category.ByName(cat_name); ElementQueries.OfCategory(cat); }

# group: Get Host +
getHost = Python(IN[0]=code_block_3.out1)  # "Element.GetHost"; IronPython2
# ---------- getHost.python (26 lines) ----------
import clr
clr.AddReference('ProtoGeometry')
from Autodesk.DesignScript.Geometry import *
clr.AddReference('RevitAPI')
import Autodesk
from Autodesk.Revit.DB import * 

toList = lambda x : x if hasattr(x, '__iter__') else [x]
lstelems = toList(UnwrapElement(IN[0]))

def getHostLink(elem):
	hostRvt = elem.Host
	hostfaceref = elem.HostFace 
	if isinstance(hostRvt, RevitLinkInstance):
		linkdoc = hostRvt.GetLinkDocument()
		hostelem = linkdoc.GetElement(hostfaceref.LinkedElementId)
		return hostelem
	else:
		return 	hostRvt
	
lsthost = []
for elem in lstelems:
	host = getHostLink(elem)
	lsthost.append(host)
	
OUT = lsthost	
# ----------------------------------------

# group: Filter out Dummy hosting elements
# note: Filter out dummy hosting elements
code_block_4 = CodeBlock(host=getHost, element=code_block_3.out1)
# ---------- code_block_4.designscript (12 lines) ----------
//Get element name
host_name = String.ToLower(host.Name);

// replace null values
replace_nulls = String.Replace(host_name, "null", "");

// Search for dummy elements
bool_mask = String.Contains(replace_nulls, "dum");

// Filter our dummy host elements
filter_bool = List.FilterByBoolMask(element, bool_mask);
Dictionary.ValueAtKey(filter_bool, "out");
# ----------------------------------------

# group: Get Host+
getHost_2 = Python(IN[0]=code_block_4.out4)  # "Element.GetHost"; IronPython2; same code as getHost

# group: Get Element Parameters
code_block_5 = CodeBlock(element=code_block_4.out4, host=getHost_2)
# ---------- code_block_5.designscript (9 lines) ----------
element.Id;
host.Id;


// If type parameter then use this:
element_type = Element.ElementType(element);

Element.GetParameterValueByName(element,"FireRating");
Element.GetParameterValueByName(host,"FireRating");
# ----------------------------------------

list_create = List.Create(item0=code_block_5.out0, item1=code_block_5.out3, item2=code_block_5.out1, item3=code_block_5.out4)

# group: Headers (as list)
code_block_6 = CodeBlock()
# ---------- code_block_6.designscript (4 lines) ----------
["Door Id",
"Door FireRating",
"Host Id",
"Host FireRating" ];
# ----------------------------------------

code_block_7 = CodeBlock(data=list_create, headers=code_block_6)
# ---------- code_block_7.designscript (4 lines) ----------
list_trans = List.Transpose(data);

// Add headers name
List.AddItemToFront(headers);
# ----------------------------------------
exportExcel = Data.ExportExcel(filePath=file_path, sheetName=code_block.out0, startRow=code_block.out1, startColumn=code_block.out1, data=code_block_7.out1, overWrite=code_block.out2)  # frozen
