# Dynamo graph Dyn_WIP_GetRevisionCloud.dyn (Dynamo 2.6.2.15705)

file_path = Filename(".\New Microsoft Excel Worksheet.xlsx")
code_block = CodeBlock { "Sheet1"; 0; true; }
code_block_2 = CodeBlock()
# ---------- code_block_2.designscript (8 lines) ----------
["UniqueID",
"Id",
"Revision",
"Revision Date",
"Revision Number",
"Comments",
"Workset"
];
# ----------------------------------------
code_block_3 = CodeBlock { cat = Category.ByName("Revision Clouds"); ElementQueries.OfCategory(cat); }
code_block_4 = CodeBlock(e=code_block_3.out1)
# ---------- code_block_4.designscript (10 lines) ----------
// Get Unique Id and Id
e.UniqueId;
e.Id;

// Grab parameters
Element.GetParameterValueByName(e,"Revision");
Element.GetParameterValueByName(e,"Revision Date");
Element.GetParameterValueByName(e,"Revision Number");
Element.GetParameterValueByName(e,"Comments");
Element.GetParameterValueByName(e,"Workset");
# ----------------------------------------
code_block_5 = CodeBlock(e=code_block_4.out2) { e.Name; }

# group: Worksets Collector
view_workset_collector = Python()  # unwired: IN[0]
# ---------- view_workset_collector.python (23 lines) ----------
# Load the Python Standard and DesignScript Libraries
import clr
clr.AddReference("RevitServices")
import RevitServices
from RevitServices.Persistence import DocumentManager
from RevitServices.Transactions import TransactionManager
clr.AddReference("RevitAPI")
import Autodesk
from Autodesk.Revit.DB import *

# The inputs to this node will be stored as a list in the IN variables.
doc = DocumentManager.Instance.CurrentDBDocument


# Place your code below this line
worksets = FilteredWorksetCollector(doc).OfKind(WorksetKind.ViewWorkset).ToWorksets()

names = [w.Name for w in worksets]

ids = [w.Id.IntegerValue for w in worksets]

# Assign your output to the OUT variable.
OUT = [worksets, names, ids]
# ----------------------------------------
# note: WorksetKind:
# OtherWorkset
# FamilyWorkset
# ViewWorkset
# StandardWorkset
# UserWorkset
userworkset_collector = Python()  # unwired: IN[0]
# ---------- userworkset_collector.python (23 lines) ----------
# Load the Python Standard and DesignScript Libraries
import clr
clr.AddReference("RevitServices")
import RevitServices
from RevitServices.Persistence import DocumentManager
from RevitServices.Transactions import TransactionManager
clr.AddReference("RevitAPI")
import Autodesk
from Autodesk.Revit.DB import *

# The inputs to this node will be stored as a list in the IN variables.
doc = DocumentManager.Instance.CurrentDBDocument


# Place your code below this line
worksets = FilteredWorksetCollector(doc).OfKind(WorksetKind.UserWorkset).ToWorksets()

names = [w.Name for w in worksets]

ids = [w.Id.IntegerValue for w in worksets]

# Assign your output to the OUT variable.
OUT = [worksets, names, ids]
# ----------------------------------------

code_block_6 = CodeBlock(input=view_workset_collector) { k = input[2]; v = input[1]; }
string_from_object = FromObject(obj=code_block_6.k)
byKeysValues = DesignScript.Builtin.Dictionary.ByKeysValues(keys=string_from_object, values=code_block_6.v)
string_from_object_2 = FromObject(obj=code_block_4.out6)
valueAtKey = DesignScript.Builtin.Dictionary.ValueAtKey(dictionary=byKeysValues, key=string_from_object_2)
code_block_7 = CodeBlock(input=valueAtKey)
# ---------- code_block_7.designscript (5 lines) ----------
// Split Strings based on " char
split = String.Split(input,"\"");

// Grab last item (view name)
List.LastItem(split@L2<2>);
# ----------------------------------------
list_create = List.Create(item0=code_block_4.out0, item1=code_block_4.out1, item2=code_block_5, item3=code_block_4.out3, item4=code_block_4.out4, item5=code_block_4.out5, item6=code_block_7.out1)
transpose = List.Transpose(lists=list_create)
addItemToFront = List.AddItemToFront(item=code_block_2, list=transpose)
exportExcel = Data.ExportExcel(filePath=file_path, sheetName=code_block.out0, startRow=code_block.out1, startCol=code_block.out1, data=addItemToFront, overWrite=code_block.out2)
