# Dynamo graph Dyn_WIP_Grab ObjectStyles.dyn "WIP_Grab ObjectStyles" (Dynamo 2.12.1.8246)

# note: Working / Functions
# Green indicates the working of the script. No changes should be made in these groups unless advised.
# note: Checking / Outputs
# Orange indicates checking nodes to ensure the script has deployed correctly.
# note: Important stuff
# Purple will indicate something important is going on here.
# note: Variables / Inputs
# Red indicates Variables that can be altered per project and must be set accordingly before running the script.

# group: Dyn_04_List Mgmt
# note: Contents
# 1.Create List
# 2. List Lacing (mgmt)
# 3. List Flatten and Sort
# 	• Lacing + Sort + Extra Sort
# 4. Model element selection query
# 5. BoolMask
# 6. List Cycle | Repeat | Unique items
# 7. List Mix | Max (values)
# 8. List IndexOf
# 9. Remap Range!
# 10. List Shuffle | Reverse
# 11. List Join | Create
# 12. List Transpose!
# 13. List Flatten | Chop list
# 14. Take | Drop EveryNthItem
# 15. List Count @ level
# 16. List Get item at index (@level)
# 14. List.Map??
# 15. List ReplaceItemAtIndex
# 16. List Lacing (Auto, Shortest, Longest, Cross)
# Practical example!
# 	• Extract total area of each wall type? (List.GroupByKey)

# note: Approach01: Elements collector
python_script = Python()  # CPython3; frozen; unwired: IN[0]
# ---------- python_script.python (44 lines) ----------
"""
FILTERED ELEMENT COLLECTOR
"""
__author__ = 'Sol Amour - amoursol@gmail.com'
__twitter__ = '@solamour'
__version__ = '1.0.0'

# Importing Reference Modules
import clr # CLR ( Common Language Runtime Module )
clr.AddReference("RevitServices") # Adding the RevitServices.dll special Dynamo
# module to deal with Revit
import RevitServices # Importing RevitServices
from RevitServices.Persistence import DocumentManager # From RevitServices import
# the Document Manager
clr.AddReference("RevitAPI") # Adding the RevitAPI.dll module to access the Revit
# API
import Autodesk # Here we import the Autodesk namespace
# From the Autodesk namespace - derived down to the Revit Database, we import only
# the Filtered Element Collector and BuiltInCategory classes
from Autodesk.Revit.DB import FilteredElementCollector, FamilyInstance, Family

# Here we give the Revit Document a nickname of 'doc' which allows us to simply
# call 'doc' later without having to type the long namespace name
doc = DocumentManager.Instance.CurrentDBDocument

familyInstanceCollector = FilteredElementCollector(doc).OfClass(FamilyInstance).WhereElementIsNotElementType().ToElements()

systemFamilies = FilteredElementCollector(doc).WhereElementIsElementType().ToElements()

inPlaceFamilies = []

# Collect all InPlace families
for instance in familyInstanceCollector:
	symbol = instance.Symbol.Family
	if symbol.IsInPlace:
		inPlaceFamilies.append(instance)

loadableFamilies = [family for family in familyInstanceCollector if family not in inPlaceFamilies]

# Create a dictionary to output
output = {'inPlaceFamilies' : inPlaceFamilies, 'loadableFamilies' : loadableFamilies, 'systemFamilies' : systemFamilies}

# To get our results back inside of Dynamo, we need to append a list to the OUT port
OUT = output
# ----------------------------------------
code_block = CodeBlock(t1=python_script)  # frozen
# ---------- code_block.designscript (3 lines) ----------
Dictionary.ValueAtKey(t1, "systemFamilies");
Dictionary.ValueAtKey(t1, "loadableFamilies");
Dictionary.ValueAtKey(t1, "inPlaceFamilies");
# ----------------------------------------
code_block_2 = CodeBlock(e=code_block.out1)
# ---------- code_block_2.designscript (5 lines) ----------
fam_type = Element.GetParameterValueByName(e, "Family");
family = FamilyType.Family(fam_type);

//Grabbing unique items
List.UniqueItems(family);
# ----------------------------------------
family_get_subcategory = Python(IN[0]=code_block_2.out2)  # IronPython2
# ---------- family_get_subcategory.python (51 lines) ----------
#Alban de Chasteigner 2019
#twitter : @geniusloci_bim
#geniusloci.bim@gmail.com

import clr
clr.AddReference("RevitAPI")
import Autodesk
from Autodesk.Revit.DB import *

clr.AddReference("RevitNodes")
import Revit
clr.ImportExtensions(Revit.Elements)

clr.AddReference("RevitServices")
import RevitServices
from RevitServices.Persistence import DocumentManager
from RevitServices.Transactions import TransactionManager
doc = DocumentManager.Instance.CurrentDBDocument

families = UnwrapElement(IN[0]) if isinstance(IN[0],list) else [UnwrapElement(IN[0])]
fCat,subCategory = [],[]

TransactionManager.Instance.ForceCloseTransaction()
for fam in families:
	if isinstance(fam,FamilyInstance):
		family=fam.Symbol.Family
		if family.IsEditable :
			famDoc = doc.EditFamily(family)
			cate=Revit.Elements.Category.ById((family.FamilyCategoryId).IntegerValue)
	elif isinstance(fam,Family):
		#if fam.IsInPlace == False :
		if fam.IsEditable :
			family=fam
		famDoc = doc.EditFamily(family)
		cate=Revit.Elements.Category.ById((family.FamilyCategoryId).IntegerValue)
	#elif isinstance(fam,Document):
		#famDoc = fam
		#cate=Revit.Elements.Category.ById((famDoc.OwnerFamily.FamilyCategoryId).IntegerValue)
	else: pass	
	category = famDoc.OwnerFamily.FamilyCategory
	subcat=category.SubCategories
	for i in subcat:
		try:
			subCategory.append(Revit.Elements.Category.ById(i.Id.IntegerValue))
		except : subCategory.append(None)
	fCat.append(cate)
	if not isinstance(fam,Document):
		famDoc.Close(False)
	
if isinstance(IN[0], list): OUT = fCat,subCategory
else: OUT = fCat[0],subCategory
# ----------------------------------------
code_block_3 = CodeBlock(x=family_get_subcategory) { category_name = x[0]; subcategories = x[1]; }
get_subcategories_properties = Python(IN[0]=code_block_3.subcategories)  # IronPython2
# ---------- get_subcategories_properties.python (45 lines) ----------
import clr
clr.AddReference('RevitAPI')
from Autodesk.Revit.DB import *

clr.AddReference("RevitNodes")
import Revit
clr.ImportExtensions(Revit.Elements)

clr.AddReference('DSCoreNodes')
import DSCore
from DSCore import Color

clr.AddReference("RevitServices")
import RevitServices
from RevitServices.Persistence import DocumentManager
from RevitServices.Transactions import TransactionManager

doc = DocumentManager.Instance.CurrentDBDocument
subcat = UnwrapElement(IN[0])
if not hasattr(subcat, '__iter__'):
    subcat = [subcat]

listGraph,listPattern,patname,listpatid,lineProjWeight,lineProjCut,listRGB,listMaterial = [],[],[],[],[],[],[],[]

for i in subcat:
	id = i.GetLinePatternId(GraphicsStyleType.Projection)
	pat = LinePatternElement.GetLinePattern(doc,id)
	projWeight = i.GetLineWeight(GraphicsStyleType.Projection)
	cutWeight = i.GetLineWeight(GraphicsStyleType.Cut)
	rgb = DSCore.Color.ByARGB(255,i.LineColor.Red, i.LineColor.Green, i.LineColor.Blue)
	listMaterial.append(i.Material)
	listRGB.append(rgb)
	lineProjWeight.append(projWeight)
	lineProjCut.append(cutWeight)
	listPattern.append(pat)
	listpatid.append(doc.GetElement(id))
	try:
		patname.append(pat.Name)
	except:
		patname.append("Solid")
		
	style = i.GetGraphicsStyle(GraphicsStyleType.Projection)
	listGraph.append(style)

OUT = listGraph, listpatid, patname, lineProjWeight, lineProjCut,listRGB,listMaterial
# ----------------------------------------
code_block_4 = CodeBlock(x=get_subcategories_properties)
# ---------- code_block_4.designscript (7 lines) ----------
graphic_style = x[0];
line_pattern = x[1];
line_pattern_name = x[2];
projection_line_weight = x[3];
cut_line_weight =x[4];
line_color = x[5];
material = x[6];
# ----------------------------------------
# note: Approach02: Select a Category
categories = Categories("OST_Lines")  # graph input
all_elements_of_category = ElementsOfCategory(Category=categories)
code_block_5 = CodeBlock(i=all_elements_of_category) { Element.ElementType(i); }
code_block_6 = CodeBlock(fam_type=code_block_5)
# ---------- code_block_6.designscript (4 lines) ----------
family = FamilyType.Family(fam_type);

//Grabbing unique items
List.Clean(List.UniqueItems(family),false);
# ----------------------------------------
get_subcategories_properties_2 = Python(IN[0]=all_elements_of_category)  # IronPython2; same code as get_subcategories_properties
code_block_7 = CodeBlock(x=get_subcategories_properties_2)  # same code as code_block_4
family_get_subcategory_2 = Python(IN[0]=all_elements_of_category)  # IronPython2; same code as family_get_subcategory
code_block_8 = CodeBlock(x=family_get_subcategory_2) { category_name = x[0]; subcategories = x[1]; }
# note: Approach03: Pick a Family
family_types = FamilyTypes("DI_Escape route symbol:Up")  # frozen
code_block_9 = CodeBlock(fam_type=family_types)  # same code as code_block_6
family_get_subcategory_3 = Python(IN[0]=code_block_9.out1)  # IronPython2; same code as family_get_subcategory
code_block_10 = CodeBlock(x=family_get_subcategory_3) { category_name = x[0]; subcategories = x[1]; }
get_subcategories_properties_3 = Python(IN[0]=code_block_10.subcategories)  # IronPython2; same code as get_subcategories_properties
code_block_11 = CodeBlock(x=get_subcategories_properties_3)  # same code as code_block_4
# note: WorksetKind types:
# OtherWorkset
# FamilyWorkset
# ViewWorkset
# StandardWorkset
# UserWorkset
get_worksets = Python()  # CPython3; unwired: IN[0]
# ---------- get_worksets.python (27 lines) ----------
# Load the Python Standard and DesignScript Libraries
import clr
clr.AddReference("RevitNodes")
import Revit
clr.ImportExtensions(Revit.Elements)
clr.ImportExtensions(Revit.GeometryConversion)
clr.AddReference("RevitServices")
import RevitServices
from RevitServices.Persistence import DocumentManager
from RevitServices.Transactions import TransactionManager
clr.AddReference("RevitAPI")
import Autodesk
from Autodesk.Revit.DB import *

# The inputs to this node will be stored as a list in the IN variables.
doc = DocumentManager.Instance.CurrentDBDocument


# Place your code below this line
worksets = FilteredWorksetCollector(doc).OfKind(WorksetKind.ViewWorkset).ToWorksets()

names = [w.Name for w in worksets]

ids = [w.Id.IntegerValue for w in worksets]

# Assign your output to the OUT variable.
OUT = [worksets, names, ids]
# ----------------------------------------
string_from_object = FromObject(object=get_worksets)
code_block_12 = CodeBlock(input=string_from_object) { k = input[2]; v = input[1]; }
byKeysValues = DesignScript.Builtin.Dictionary.ByKeysValues(keys=code_block_12.k, values=code_block_12.v)
# note: Approach03: Pick a Category
categories_2 = Categories("OST_RvtLinks")  # graph input; frozen
all_elements_of_category_2 = ElementsOfCategory(Category=categories_2)
code_block_13 = CodeBlock(input=all_elements_of_category_2) { Element.GetParameterValueByName(input,"Workset"); }
string_from_object_2 = FromObject(object=code_block_13)
valueAtKey = DesignScript.Builtin.Dictionary.ValueAtKey(dictionary=byKeysValues, key=string_from_object_2)
watch = Watch(valueAtKey)
family_types_2 = FamilyTypes("DI_Escape route symbol:Up")  # frozen
all_elements_of_family_type = ElementsOfFamilyType(Family_Type=family_types_2)
code_block_14 = CodeBlock(input=all_elements_of_family_type) { Element.GetParameterValueByName(input,"Workset"); }
string_from_object_3 = FromObject(object=code_block_14)
valueAtKey_2 = DesignScript.Builtin.Dictionary.ValueAtKey(dictionary=byKeysValues, key=string_from_object_3)
watch_2 = Watch(valueAtKey_2)

# group: Get Document
get_document = Python()  # IronPython2; frozen; unwired: IN[0]
# ---------- get_document.python (32 lines) ----------
# Boilerplate text
import clr

clr.AddReference("RevitServices")
import RevitServices
from RevitServices.Persistence import DocumentManager 

clr.AddReference("RevitAPI")
import Autodesk 
from Autodesk.Revit.DB import *

#Inputdoc by Andreas Dieckmann
if isinstance(IN[0], list):
	inputdoc = UnwrapElement(IN[0])
else:
	inputdoc = [UnwrapElement(IN[0])]

if inputdoc[0] == None:
	doc = DocumentManager.Instance.CurrentDBDocument
	test = "No input detected"
elif inputdoc[0].GetType().ToString() == "Autodesk.Revit.DB.Document":
	doc = inputdoc[0]
	test = "A document was provided."
elif inputdoc[0].GetType().ToString() == "Autodesk.Revit.DB.RevitLinkInstance":
	doc = inputdoc[0].GetLinkDocument()
	test = "From linked instance."
else:
	doc = DocumentManager.Instance.CurrentDBDocument
	test = "Invalid input, current document used."

# Preparing output to Dynamo
OUT = doc,test
# ----------------------------------------
code_block_15 = CodeBlock(x=get_document) { x[0]; x[1]; }
code_block_16 = CodeBlock(document=code_block_15.out0) { document; }

cad_imports = Python(IN[0]=code_block_16)  # IronPython2
# ---------- cad_imports.python (34 lines) ----------
# Made by Gavin Crump
# Free for use
# BIM Guru, www.bimguru.com.au

# Boilerplate text
import clr

clr.AddReference("RevitNodes")
import Revit
clr.ImportExtensions(Revit.Elements)

clr.AddReference("RevitAPI")
import Autodesk
from Autodesk.Revit.DB import *

doc = IN[0]

# Collect all imports
col = FilteredElementCollector(doc).OfClass(ImportInstance).ToElements()

# Get instance properties
cadImp, cadImpType, cadImpView = [], [], []

for i in col:
	try:
		if i.IsLinked != True:
			cadImp.append(i)
			cadImpType.append(i.Document.GetElement(i.GetTypeId()))
			cadImpView.append(doc.GetElement(i.OwnerViewId))
	except:
		pass

# Preparing output to Dynamo
OUT = [cadImp, cadImpType, cadImpView]
# ----------------------------------------
code_block_17 = CodeBlock(out=cad_imports) { isntances = out[0]; type = out[1]; ownerView = out[2]; }
code_block_18 = CodeBlock(input=code_block_17.isntances) { Element.GetParameterValueByName(input,"Workset"); }
string_from_object_4 = FromObject(object=code_block_18)
valueAtKey_3 = DesignScript.Builtin.Dictionary.ValueAtKey(dictionary=byKeysValues, key=string_from_object_4)
watch_3 = Watch(valueAtKey_3)
cad_links = Python(IN[0]=code_block_16)  # IronPython2
# ---------- cad_links.python (34 lines) ----------
# Made by Gavin Crump
# Free for use
# BIM Guru, www.bimguru.com.au

# Boilerplate text
import clr

clr.AddReference("RevitNodes")
import Revit
clr.ImportExtensions(Revit.Elements)

clr.AddReference("RevitAPI")
import Autodesk
from Autodesk.Revit.DB import *

doc = IN[0]

# Collect all imports
col = FilteredElementCollector(doc).OfClass(ImportInstance).ToElements()

# Get instance properties
cadLnk, cadLnkType, cadLnkView = [], [], []

for i in col:
	try:
		if i.IsLinked == True:
			cadLnk.append(i)
			cadLnkType.append(i.Document.GetElement(i.GetTypeId()))
			cadLnkView.append(doc.GetElement(i.OwnerViewId))
	except:
		pass

# Preparing output to Dynamo
OUT = [cadLnk, cadLnkType, cadLnkView]
# ----------------------------------------
code_block_19 = CodeBlock(out=cad_links) { isntances = out[0]; type = out[1]; ownerView = out[2]; }
code_block_20 = CodeBlock(input=code_block_19.isntances) { Element.GetParameterValueByName(input,"Workset"); }
string_from_object_5 = FromObject(object=code_block_20)
valueAtKey_4 = DesignScript.Builtin.Dictionary.ValueAtKey(dictionary=byKeysValues, key=string_from_object_5)
watch_4 = Watch(valueAtKey_4)
categories_3 = Categories("OST_Lines")  # graph input
get_category_properties = Python(IN[0]=categories_3)  # CPython3
# ---------- get_category_properties.python (49 lines) ----------
#Alban de Chasteigner 2018
#twitter : @geniusloci_bim
#geniusloci.bim@gmail.com

import clr
clr.AddReference('RevitAPI')
from Autodesk.Revit.DB import *

clr.AddReference("RevitNodes")
import Revit
clr.ImportExtensions(Revit.Elements)

clr.AddReference('DSCoreNodes')
import DSCore
from DSCore import Color

clr.AddReference("RevitServices")
import RevitServices
from RevitServices.Persistence import DocumentManager
doc = DocumentManager.Instance.CurrentDBDocument

cat = UnwrapElement(IN[0]) if isinstance(IN[0],list) else [UnwrapElement(IN[0])]

subcat = cat[0].SubCategories

subCategory,listGraph,listPattern,patname,listpatid,lineProjWeight,lineProjCut,listRGB,listMaterial = [],[],[],[],[],[],[],[],[]

for i in subcat:
	subCategory.append(Revit.Elements.Category.ById(i.Id.IntegerValue))
	id = i.GetLinePatternId(GraphicsStyleType.Projection)
	pat = LinePatternElement.GetLinePattern(doc,id)
	projWeight = i.GetLineWeight(GraphicsStyleType.Projection)
	cutWeight = i.GetLineWeight(GraphicsStyleType.Cut)
	rgb = DSCore.Color.ByARGB(255,i.LineColor.Red, i.LineColor.Green, i.LineColor.Blue)
	listMaterial.append(i.Material)
	listRGB.append(rgb)
	lineProjWeight.append(projWeight)
	lineProjCut.append(cutWeight)
	listPattern.append(pat)
	listpatid.append(doc.GetElement(id))
	try:
		patname.append(pat.Name)
	except:
		patname.append("Solid")
		
	style = i.GetGraphicsStyle(GraphicsStyleType.Projection)
	listGraph.append(style)

OUT = listGraph, subCategory, listpatid, patname, lineProjWeight, lineProjCut,listRGB,listMaterial
# ----------------------------------------
code_block_21 = CodeBlock(x=get_category_properties)
# ---------- code_block_21.designscript (8 lines) ----------
graphic_style = x[0];
subcat = x[1];
line_pattern = x[2];
line_pattern_name = x[3];
projection_line_w = x[4];
cut_line_w = x[5];
line_colors = x[6];
material = x[7];
# ----------------------------------------
watch_5 = Watch(code_block_21.subcat)
