# Dynamo graph Dyn_WIP_Image Sampler.dyn (Dynamo 2.12.1.8246)

# note: Important stuff
# Purple will indicate something important is going on here.
# note: Variables / Inputs
# Red indicates Variables that can be altered per project and must be set accordingly before running the script.

# group: KAAN Architecten
# note: 15-11-2022

# group: Image input
# note: Checking / Outputs
# Orange indicates checking nodes to ensure the script has deployed correctly.
# note: Working / Functions
# Green indicates the working of the script. No changes should be made in these groups unless advised.
# note: Black and white images work best!
file_path = Filename("..\1_ISMO_KAAN-Architecten-©Fernando-Guerra-FGSG-rgb-1-920x690.jpg")

# group: Process image
file_from_path = FileObject(path=file_path)
readFromFile = Image.ReadFromFile(file=file_from_path)
watch_image = WatchImageCore(image=readFromFile)

# group: Grid size (samples)
integer_slider = IntegerSlider(90, range=10..100 step 10)

# group: Image sampling
pixels = Image.Pixels(image=watch_image, xSamples=integer_slider, ySamples=integer_slider)
dimensions = Image.Dimensions(image=watch_image)

# group: Pixels data
red = Color.Red(color=pixels)
blue = Color.Blue(color=pixels)
green = Color.Green(color=pixels)
alpha = Color.Alpha(color=pixels)
brightness = Color.Brightness(color=pixels)

flatten = List.Flatten(list=brightness)
minimumItem = List.MinimumItem(list=flatten)
maximumItem = List.MaximumItem(list=flatten)

# group: Points Grid
code_block = CodeBlock { x= 1..nrX..1; y= 1..nrY..1; }  # unwired: nrX, nrY
code_block_2 = CodeBlock(x=code_block.x, y=code_block.x) { Point.ByCoordinates(x<1>,y<2>); }

# group: Boost!
# note: Higher value = bigger circles
code_block_3 = CodeBlock(a=brightness) { a*0.3; }

# group: Surface creation!
# note: We could also apply any other geometrical shape, but circle is the easiest
byCenterPointRadius = Circle.ByCenterPointRadius(centerPoint=code_block_2, radius=code_block_3)
byPatch = Surface.ByPatch(closedCurve=byCenterPointRadius)  # frozen
byUnion = Surface.ByUnion(surfaces=byPatch)

# group: 3D geometry
# note: Unfreeze these nodes by right click on them Freeze. It will take a bit to calculate
code_block_4 = CodeBlock { 1; }
extrude = Curve.Extrude(curve=byCenterPointRadius, distance=code_block_4)  # frozen

code_block_5 = CodeBlock(width=dimensions.width, samples=integer_slider, height=dimensions.height) { nrX = width % samples; nrY =  height % samples; }
watch = Watch(code_block_5.nrX)

# group: Grid size (samples)
integer_slider_2 = IntegerSlider(20, range=10..100 step 10)

# group: Grid size (samples)
integer_slider_3 = IntegerSlider(30, range=10..100 step 10)

code_block_6 = CodeBlock(width=dimensions.width, samplesX=integer_slider_2, height=dimensions.height, samplesY=integer_slider_3) { nrX = width % samplesX; nrY =  height % samplesY; }
