# Dynamo graph Dyn_WIP_Rename Families.dyn (Dynamo 2.12.1.8246)

# note: Important stuff
# Purple will indicate something important is going on here.
# note: Variables / Inputs
# Red indicates Variables that can be altered per project and must be set accordingly before running the script.
# note: Checking / Outputs
# Orange indicates checking nodes to ensure the script has deployed correctly.
# note: Working / Functions
# Green indicates the working of the script. No changes should be made in these groups unless advised.

# group: Dyn_WIP_Cleanup
# note: Workflow
# To be filled in!

# group: Excel file!
# note: Needed Excel File for exporting values!

# group: KAAN Architecten
# note: Date: 2022117

# group: !!!
# note: Add K_ Filter in the Script for element names

# group: System Families collector
# note: Workflow
# To be filled in!

# group: Loadable Families collector
# note: Workflow
# To be filled in!

# group: Loadable System L
# note: Workflow
# To be filled in!

code_block = CodeBlock { "Detail Items"; }
code_block_2 = CodeBlock(cat=code_block) { Category.ByName(cat); }
all_elements_of_category = ElementsOfCategory(Category=code_block_2)
code_block_3 = CodeBlock(e=all_elements_of_category) { e.Name; }
code_block_4 = CodeBlock(e=all_elements_of_category) { Element.ElementType(e); }
code_block_5 = CodeBlock(e=code_block_4) { e.Name; }
code_block_6 = CodeBlock()  # //Rename
documentelement_collector = Python()  # IronPython2
# ---------- documentelement_collector.python (43 lines) ----------
import clr
clr.AddReference('RevitAPI')
from Autodesk.Revit.DB import *

clr.AddReference("RevitNodes")
import Revit
clr.ImportExtensions(Revit.Elements)
clr.ImportExtensions(Revit.GeometryConversion)

clr.AddReference("RevitServices")
import RevitServices
from RevitServices.Persistence import DocumentManager
from RevitServices.Transactions import TransactionManager

from System.Collections.Generic import *

doc = DocumentManager.Instance.CurrentDBDocument
collector = FilteredElementCollector(doc)

BuiltInCats = List[BuiltInCategory]()
BuiltInCats.Add(BuiltInCategory.OST_Ceilings)
BuiltInCats.Add(BuiltInCategory.OST_Floors)
BuiltInCats.Add(BuiltInCategory.OST_Ramps)
BuiltInCats.Add(BuiltInCategory.OST_Roofs)
BuiltInCats.Add(BuiltInCategory.OST_Stairs)
BuiltInCats.Add(BuiltInCategory.OST_Topography)
BuiltInCats.Add(BuiltInCategory.OST_Walls)

Materials = List[BuiltInCategory]()
Materials.Add(BuiltInCategory.OST_Materials)

BuiltInFilter = ElementMulticategoryFilter(BuiltInCats)
MaterialFilter = ElementMulticategoryFilter(Materials)


BuiltIn_elem = FilteredElementCollector(doc).WherePasses(BuiltInFilter).WhereElementIsElementType().ToElements()
MaterialElements = FilteredElementCollector(doc).WherePasses(MaterialFilter).ToElements()


BuiltIn_names = [Element.Name.__get__(i) for i in BuiltIn_elem]


OUT = BuiltIn_elem, BuiltIn_names, MaterialElements
# ----------------------------------------
code_block_7 = CodeBlock(x=documentelement_collector) { builtin_elem = x[0]; builtin_names = x[1]; material_elem = x[2]; }
code_block_8 = CodeBlock(e=code_block_7.material_elem)
# ---------- code_block_8.designscript (5 lines) ----------
elements = e;
name = e.Name;

// New name
new_name = "K_" + name;
# ----------------------------------------

# group: SetName (Rename)
python_script = Python(IN[0]=code_block_8.elements, IN[1]=code_block_8.new_name)  # IronPython2; frozen
# ---------- python_script.python (57 lines) ----------
import clr
clr.AddReference('RevitAPI')
from Autodesk.Revit.DB import *

clr.AddReference("RevitNodes")
import Revit
clr.ImportExtensions(Revit.Elements)

clr.AddReference("RevitServices")
import RevitServices
from RevitServices.Persistence import DocumentManager
from RevitServices.Transactions import TransactionManager

doc = DocumentManager.Instance.CurrentDBDocument
items = UnwrapElement(IN[0])
names = IN[1]

def SetElementName(item, name):
	# family parameters
	if item.GetType().ToString() == "Autodesk.Revit.DB.FamilyParameter":
		try: 
			doc.FamilyManager.RenameParameter(item, name)
			return True
		except: return False
	# regular revit worksets
	elif item.GetType().ToString() =="Autodesk.Revit.DB.Workset":
		try: 
			doc.GetWorksetTable().RenameWorkset(doc, item.Id, name)
			return True
		except: return False
	# archilab worksets (dynamo 1.x)
	elif item.GetType().ToString() == "Archilab.Grimshaw.Elements.Workset":
		try: 
			doc.GetWorksetTable().RenameWorkset(doc, WorksetId(item.Id), name)
			return True
		except: return False
	# archilab worksets (dynamo 2.x)
	elif item.GetType().ToString() == "archilab.Revit.Elements.Workset":
		try: 
			doc.GetWorksetTable().RenameWorkset(doc, WorksetId(item.Id), name)
			return True
		except: return False
	# everything else that has a name property
	else:
		try: 
			item.Name = name
			return True
		except: return False

TransactionManager.Instance.EnsureInTransaction(doc)
if isinstance(IN[0], list):
	if isinstance(names, list): OUT = [SetElementName(x, y) for x, y in zip(items, names)]
	else: OUT = [SetElementName(x, names) for x in items]
else:
	if isinstance(names, list): OUT = SetElementName(items, names[0])
	else: OUT = SetElementName(items, names)
TransactionManager.Instance.TransactionTaskDone()
# ----------------------------------------

# group: Assets
get_asset = Python(IN[0]=code_block_7.material_elem)  # IronPython2
# ---------- get_asset.python (37 lines) ----------
#Inspired by Boris Shafiro from Autodesk
#Alban de Chasteigner 2018
#twitter : @geniusloci_bim
#geniusloci.bim@gmail.com

import clr
clr.AddReference('RevitAPI')
from Autodesk.Revit.DB import *
clr.AddReference('RevitServices')
import RevitServices
from RevitServices.Persistence import DocumentManager
doc = DocumentManager.Instance.CurrentDBDocument
 
mats = UnwrapElement(IN[0]) if isinstance(IN[0],list) else [UnwrapElement(IN[0])]
assetElems,names,assets,assetTypes,titles=[],[],[],[],[]

for mat in mats:
	appearanceAssetId = mat.AppearanceAssetId
	if appearanceAssetId != ElementId.InvalidElementId:
		assetElem = doc.GetElement(appearanceAssetId)
	else:
		assetElem = ElementId.InvalidElementId
	if hasattr(assetElem, 'GetRenderingAsset'):
		asset = assetElem.GetRenderingAsset()
	else:
		asset = None
	assetElems.append(assetElem)
	assets.append(asset)
	if hasattr(asset, 'AssetType'):
		assetType, title, name = asset.AssetType, asset.Title, asset.Name
	else:
		assetType, title, name = None, None, None
	assetTypes.append(assetType)
	titles.append(title)
	names.append(name)

OUT = assetElems,assets,assetTypes,titles,names
# ----------------------------------------
code_block_9 = CodeBlock(x=get_asset) { asset_el = x[0]; asset_name = asset_el.Name; }

code_block_10 = CodeBlock(elements=code_block_9.asset_el) { elements; }
string_from_object = FromObject(object=code_block_9.asset_name)
code_block_11 = CodeBlock(asset_name=string_from_object) { String.Replace(asset_name,"null",""); }
code_block_12 = CodeBlock(e=code_block_11) { name = e.Name; new_name = "K_" + name; }
code_block_13 = CodeBlock(name=code_block_12.new_name) { name; }

# group: SetName (Rename)
python_script_2 = Python(IN[0]=code_block_10, IN[1]=code_block_13)  # IronPython2; frozen; same code as python_script

element_types = ElementTypes("FillPatternElement")
all_elements_of_type = ElementsOfType(element_type=element_types)
code_block_14 = CodeBlock(e=all_elements_of_type) { e.Name; }
code_block_15 = CodeBlock { 1; }
dropItems = List.DropItems(list=code_block_14, amount=code_block_15)
code_block_16 = CodeBlock(name=dropItems) { "K_"  + name; }

# group: SetName (Rename)
python_script_3 = Python(IN[0]=code_block_14, IN[1]=code_block_16)  # IronPython2; frozen; same code as python_script

# group: Collect Families and Types
python_script_4 = Python()  # IronPython2; unwired: IN[0]
# ---------- python_script_4.python (37 lines) ----------
import clr

clr.AddReference('RevitAPI')
from Autodesk.Revit.DB import *
from Autodesk.Revit.DB.Structure import *

clr.AddReference('RevitAPIUI')
from Autodesk.Revit.UI import *

clr.AddReference('System')
from System.Collections.Generic import List

clr.AddReference('RevitNodes')
import Revit
clr.ImportExtensions(Revit.GeometryConversion)
clr.ImportExtensions(Revit.Elements)

clr.AddReference('RevitServices')
import RevitServices
from RevitServices.Persistence import DocumentManager
from RevitServices.Transactions import TransactionManager

doc = DocumentManager.Instance.CurrentDBDocument
uidoc=DocumentManager.Instance.CurrentUIApplication.ActiveUIDocument

#Preparing input from dynamo to revit
element = UnwrapElement(IN[0])

#Do some action in a Transaction
TransactionManager.Instance.EnsureInTransaction(doc)

fams = FilteredElementCollector(doc).OfClass(Family).ToElements()
famTypes = FilteredElementCollector(doc).OfClass(FamilySymbol).ToElements()

TransactionManager.Instance.TransactionTaskDone()

OUT = fams,famTypes
# ----------------------------------------

code_block_17 = CodeBlock(x=python_script_4)
# ---------- code_block_17.designscript (12 lines) ----------
// Family Names
fam_name = x[0];
fam_name.Name;


// Get Family types based on family name
Family.Types(fam_name);


// Family Types
fam_types = x[1];
fam_types.Name;
# ----------------------------------------
watch = Watch(code_block_17.out2)
watch_2 = Watch(code_block_17.out1)
code_block_18 = CodeBlock(elements=code_block_7.builtin_elem, names=code_block_7.builtin_names)
# ---------- code_block_18.designscript (5 lines) ----------
elements;
names;

// New name
new_name = "K_" + names;
# ----------------------------------------

# group: SetName (Rename)
python_script_5 = Python(IN[0]=code_block_18.elements, IN[1]=code_block_18.new_name)  # IronPython2; frozen; same code as python_script

# group: SetName (Rename)
python_script_6 = Python()  # IronPython2; frozen; unwired: IN[0], IN[1]; same code as python_script

# group: Get Line Types
element_types_2 = ElementTypes("LinePatternElement")
all_elements_of_type_2 = ElementsOfType(element_type=element_types_2)
code_block_19 = CodeBlock(lines=all_elements_of_type_2)
# ---------- code_block_19.designscript (8 lines) ----------
lines;
line_name = lines.Name;
filter = "K_";

bool_val = String.Contains(line_name,filter);
bool_mask = List.FilterByBoolMask(lines,bool_val);

Dictionary.ValueAtKey(bool_mask,"out");
# ----------------------------------------
code_block_20 = CodeBlock { type = Element.ElementType.ByName("LinePatternElement"); ElementQueries.OfElementType(type); }

# group: Get Subcategories
code_block_21 = CodeBlock()
# ---------- code_block_21.designscript (36 lines) ----------
cats = ["Air Terminals",
"Casework",
"Columns",
"Curtain Panels",
"Curtain Wall Mullions",
"Detail Items",
"Doors",
"Electrical Equipment",
"Electrical Fixtures",
"Entourage",
"Fire Alarm Devices",
"Furniture",
"Furniture Systems",
"Generic Models",
"Lighting Devices",
"Lighting Fixtures",
"Lines",
"Mechanical Equipment",
"Planting",
"Parking",
"Plumbing Fixtures",
"Railings",
"Ramps",
"Security Devices",
"Specialty Equipment",
"Sprinklers",
"Structural Columns",
"Structural Framing",
"Windows",

"Generic Annotations",
"Title Blocks",
"Reference Planes"];


Revit.Category.ByName(cats);
# ----------------------------------------
get_category_properties = Python(IN[0]=code_block_21.out1)  # IronPython2
# ---------- get_category_properties.python (34 lines) ----------
import clr
clr.AddReference('RevitAPI')
from Autodesk.Revit.DB import *

clr.AddReference("RevitNodes")
import Revit
clr.ImportExtensions(Revit.Elements)

clr.AddReference('DSCoreNodes')
import DSCore
from DSCore import Color

clr.AddReference("RevitServices")
import RevitServices
from RevitServices.Persistence import DocumentManager
doc = DocumentManager.Instance.CurrentDBDocument

cat = UnwrapElement(IN[0]) if isinstance(IN[0],list) else [UnwrapElement(IN[0])]


subcat =[]
for i in range(len(cat)):
	subcat.append(cat[i].SubCategories)

# subcat = cat[0].SubCategories

subCategory = []

for i in subcat:
	for c in i:
		subCategory.append(Revit.Elements.Category.ById(c.Id.IntegerValue))


OUT =  subCategory
# ----------------------------------------
# note: Delete LineStyles if not K_
code_block_22 = CodeBlock(subcat=get_category_properties)
# ---------- code_block_22.designscript (7 lines) ----------
subcat_name = subcat.Name;
filter = "K_";

bool_val = String.Contains(subcat_name,filter);
bool_mask = List.FilterByBoolMask(subcat,bool_val);

Dictionary.ValueAtKey(bool_mask,"out");
# ----------------------------------------
join = List.Join(list0=code_block_19.out5, list1=code_block_22.out4)
delete_elements = Python(IN[0]=join)  # IronPython2; frozen; unwired: IN[1]
# ---------- delete_elements.python (47 lines) ----------
#Copyright(c) 2016, Dimitar Venkov
# @5devene, dimitar.ven@gmail.com

import clr
clr.AddReference('RevitAPI')
from Autodesk.Revit.DB import*
clr.AddReference('RevitServices')
import RevitServices
from RevitServices.Persistence import DocumentManager
from RevitServices.Transactions import TransactionManager

def tolist(obj1):
	if hasattr(obj1,"__iter__"): return obj1
	else: return [obj1]

elems = UnwrapElement(tolist(IN[0]))
inputdocs = tolist(UnwrapElement(IN[1]))

#Part of script from Clockwork
for inputdoc in inputdocs :
	if inputdoc == None:
		doc = DocumentManager.Instance.CurrentDBDocument
	elif inputdoc.GetType().ToString() == "Autodesk.Revit.DB.Document":
		doc = inputdoc
	elif inputdoc.GetType().ToString() == "Autodesk.Revit.DB.RevitLinkInstance":
		doc = inputdoc.GetLinkDocument()
	else: doc = None
	
	TransactionManager.Instance.ForceCloseTransaction()
	t = Transaction(doc,'delete')
	t.Start()

deleted, failed = [], []

for e in elems:
	id = None
	try:
		id = e.Id
		del_id = doc.Delete(id)
		deleted.extend([d.ToString() for d in del_id])
	except:
		if id is not None:
			failed.append(id.ToString() )
s = set(deleted)
failed1 = [x for x in failed if x not in s]
t.Commit()
OUT = len(deleted), ';'.join(deleted), ';'.join(failed1)
# ----------------------------------------
code_block_23 = CodeBlock(x=delete_elements) { count = x[0]; deleted_ids = x[1]; failed_ids = x[2]; }
# note: Untouched Python
get_category_properties_2 = Python()  # IronPython2; frozen; unwired: IN[0]
# ---------- get_category_properties_2.python (49 lines) ----------
#Alban de Chasteigner 2018
#twitter : @geniusloci_bim
#geniusloci.bim@gmail.com

import clr
clr.AddReference('RevitAPI')
from Autodesk.Revit.DB import *

clr.AddReference("RevitNodes")
import Revit
clr.ImportExtensions(Revit.Elements)

clr.AddReference('DSCoreNodes')
import DSCore
from DSCore import Color

clr.AddReference("RevitServices")
import RevitServices
from RevitServices.Persistence import DocumentManager
doc = DocumentManager.Instance.CurrentDBDocument

cat = UnwrapElement(IN[0]) if isinstance(IN[0],list) else [UnwrapElement(IN[0])]

subcat = cat[0].SubCategories

subCategory,listGraph,listPattern,patname,listpatid,lineProjWeight,lineProjCut,listRGB,listMaterial = [],[],[],[],[],[],[],[],[]

for i in subcat:
	subCategory.append(Revit.Elements.Category.ById(i.Id.IntegerValue))
	id = i.GetLinePatternId(GraphicsStyleType.Projection)
	pat = LinePatternElement.GetLinePattern(doc,id)
	projWeight = i.GetLineWeight(GraphicsStyleType.Projection)
	cutWeight = i.GetLineWeight(GraphicsStyleType.Cut)
	rgb = DSCore.Color.ByARGB(255,i.LineColor.Red, i.LineColor.Green, i.LineColor.Blue)
	listMaterial.append(i.Material)
	listRGB.append(rgb)
	lineProjWeight.append(projWeight)
	lineProjCut.append(cutWeight)
	listPattern.append(pat)
	listpatid.append(doc.GetElement(id))
	try:
		patname.append(pat.Name)
	except:
		patname.append("Solid")
		
	style = i.GetGraphicsStyle(GraphicsStyleType.Projection)
	listGraph.append(style)

OUT = listGraph, subCategory, listpatid, patname, lineProjWeight, lineProjCut,listRGB,listMaterial
# ----------------------------------------
code_block_24 = CodeBlock(x=get_category_properties_2)
# ---------- code_block_24.designscript (8 lines) ----------
graphic_style = x[0];
subcat = x[1];
line_pattern = x[2];
line_pattern_name = x[3];
projection_line_w = x[4];
cut_line_w = x[5];
line_colors = x[6];
material = x[7];
# ----------------------------------------
