# Dynamo graph Dyn_WIP_Rooms Adjacencies.dyn "WIP_Rooms Adjacencies" (Dynamo 2.12.1.8246)

categories = Categories("OST_Rooms")
all_elements_of_category = ElementsOfCategory(Category=categories)
code_block = CodeBlock { "Room Adjacencies"; }
code_block_2 = CodeBlock { ","; }
centerBoundary = Room.CenterBoundary(room=all_elements_of_category)
doesIntersect = Geometry.DoesIntersect(geometry=centerBoundary, other=centerBoundary@L2, lacing=CrossProduct)
code_block_3 = CodeBlock { 1; }
flatten = List.Flatten(amount=code_block_3)  # unwired: list
map = List.Map(list=doesIntersect, function=flatten)
boolean = BoolSelector(true)
contains = List.Contains(list=map@@L2, item=boolean)
allIndicesOf = List.AllIndicesOf(list=contains@@L2, item=boolean)
getItemAtIndex = List.GetItemAtIndex(list=all_elements_of_category, index=allIndicesOf)
number = Room.Number(room=getItemAtIndex@L2)
number_2 = Room.Number(room=all_elements_of_category)
code_block_4 = CodeBlock { ""; }
replace = String.Replace(string=number, searchFor=number_2, replaceWith=code_block_4)
code_block_5 = CodeBlock { ""; }
allIndicesOf_2 = List.AllIndicesOf(list=replace@L2, item=code_block_5)
removeItemAtIndex = List.RemoveItemAtIndex(list=replace@L2, indices=allIndicesOf_2)
join = String.Join(separator=code_block_2, string0=removeItemAtIndex@L2)
setParameterByName = Element.SetParameterByName(element=all_elements_of_category, parameterName=code_block, value=join)
