# Dynamo graph Dyn_XX_GridsBubbles_Off.dyn (Dynamo 2.13.1.3887)

# group: Get all Views
code_block = CodeBlock { cat = Category.ByName("Views"); ElementQueries.OfCategory(cat); }

code_block_2 = CodeBlock(i=code_block.out1) { List.Clean(i, false); }
code_block_3 = CodeBlock(views=code_block_2)
# ---------- code_block_3.designscript (16 lines) ----------
views;
search_for = "1200_";

is_vtemplate = Elements.View.IsViewTemplate(views);
bool_template = List.FilterByBoolMask(views,is_vtemplate);
only_views = Dictionary.ValueAtKey(bool_template, "out");


param = Elements.Element.GetParameterValueByName(only_views,"K_Browser03");


search = String.Contains(param,search_for);
clean_searhc = List.Clean(search, true);

bool_mask = List.FilterByBoolMask(only_views, search);
Dictionary.ValueAtKey(bool_mask,"in");
# ----------------------------------------
code_block_4 = CodeBlock(list_views=code_block_3.out9) { list_views; }
get_grids_in_views = Python(IN[0]=code_block_4)  # CPython3
# ---------- get_grids_in_views.python (24 lines) ----------
import System
import clr
clr.AddReference('RevitAPI')
clr.AddReference("RevitServices")

from Autodesk.Revit.DB import *
import RevitServices
from RevitServices.Persistence import DocumentManager


cat = BuiltInCategory.OST_Grids
views = UnwrapElement(IN[0])

BuiltInCategory.OST_Grids

elements = []
for view in views:
    doc=view.Document
    collector = FilteredElementCollector(doc, view.Id).OfCategory(cat).ToElements();
    
    elements.append(collector)


OUT = elements
# ----------------------------------------
code_block_5 = CodeBlock(grids=get_grids_in_views)
# ---------- code_block_5.designscript (16 lines) ----------
grids;

grid_curves = Grid.Curve(grids);

grid_start= Autodesk.Curve.StartPoint(grid_curves);
grid_end= Autodesk.Curve.EndPoint(grid_curves);

x_start = Math.Round(Point.X(grid_start),10);
x_end = Math.Round(Point.X(grid_end),10);
x_start > x_end;
x_start == x_end;


y_start = Math.Round(Point.Y(grid_start),10);
y_end = Math.Round(Point.Y(grid_end),10);
y_start > y_end;
# ----------------------------------------
code_block_6 = CodeBlock(grids_collector=get_grids_in_views, views=code_block_4, x_start=code_block_5.out6, x_equals=code_block_5.out7, y_start=code_block_5.out10) { grids_collector; views; x_start; x_equals; y_start; }
grid_bubble_off = Python(IN[0]=code_block_6.grids_collector, IN[1]=code_block_6.views, IN[2]=code_block_6.x_start, IN[3]=code_block_6.x_equals, IN[4]=code_block_6.y_start)  # CPython3
# ---------- grid_bubble_off.python (62 lines) ----------
import clr
clr.AddReference('ProtoGeometry')
from Autodesk.DesignScript.Geometry import *

clr.AddReference("RevitNodes")
import Revit
clr.ImportExtensions(Revit.Elements)

clr.ImportExtensions(Revit.GeometryConversion)

clr.AddReference("RevitServices")
import RevitServices

from RevitServices.Persistence import *
from RevitServices.Transactions import TransactionManager
from System.Collections.Generic import *

clr.AddReference("RevitAPI")
import Autodesk
from Autodesk.Revit.DB import *

doc = DocumentManager.Instance.CurrentDBDocument
uiapp = DocumentManager.Instance.CurrentUIApplication
app = uiapp.Application
uidoc = DocumentManager.Instance.CurrentUIApplication.ActiveUIDocument

if isinstance(IN[1], list):
	gridList = UnwrapElement(IN[0])
	viewList = UnwrapElement(IN[1])
	xVectorPositiveList = UnwrapElement(IN[2])
	verticalList = UnwrapElement(IN[3])
	yVectorPositiveList = UnwrapElement(IN[4])
else:
	gridList = [UnwrapElement(IN[0])]
	viewList = [UnwrapElement(IN[1])]
	xVectorPositiveList = [UnwrapElement(IN[2])]
	verticalList = [UnwrapElement(IN[3])]
	yVectorPositiveList = [UnwrapElement(IN[4])]
	
TransactionManager.Instance.EnsureInTransaction(doc)

for grids, xVectorPositives, verticals, yVectorPositives, view in zip(gridList, xVectorPositiveList, verticalList, yVectorPositiveList, viewList):

	for grid, xVectorPositive, vertical, yVectorPositive in zip(grids, xVectorPositives, verticals, yVectorPositives):
		if xVectorPositive: # DB-WW grids + Hotel
			grid.HideBubbleInView(DatumEnds.End0,view) 
			grid.ShowBubbleInView(DatumEnds.End1,view)
		elif not xVectorPositive and not vertical:    # BA grids
			grid.ShowBubbleInView(DatumEnds.End1,view) 
			grid.HideBubbleInView(DatumEnds.End0,view)
		elif not xVectorPositive and vertical and yVectorPositive:    # DB grids
			grid.HideBubbleInView(DatumEnds.End1,view)
			grid.ShowBubbleInView(DatumEnds.End0,view)
		else: # others
			grid.ShowBubbleInView(DatumEnds.End0,view)
			grid.HideBubbleInView(DatumEnds.End1,view)
	
TransactionManager.Instance.TransactionTaskDone()

doc.Regenerate()

OUT = viewList
# ----------------------------------------
watch = Watch(code_block_3.views)
