# Dynamo graph DynamoBasics_02.dyn (Dynamo 2.12.0.5650)

# note: Checking / Outputs
# Orange indicates checking nodes to ensure the script has deployed correctly.
# note: Working / Functions
# Green indicates the working of the script. No changes should be made in these groups unless advised.
# note: Important stuff
# Purple will indicate something important is going on here.

integer_slider = IntegerSlider(15, range=0..100 step 1)
# note: DesignScript
code_block = CodeBlock(x2=integer_slider, y2=integer_slider, z2=integer_slider) { p1 = Point.ByCoordinates(0,0,0); p2 = Point.ByCoordinates(x2,y2,z2); Line.ByStartPointEndPoint(p1,p2); }

# group: Nodes
byCoordinates = Point.ByCoordinates()
byCoordinates_2 = Point.ByCoordinates(x=integer_slider)
byStartPointEndPoint = Line.ByStartPointEndPoint(startPoint=byCoordinates, endPoint=byCoordinates_2)

integer_slider_2 = IntegerSlider(1, range=0..100 step 1)
integer_slider_3 = IntegerSlider(20, range=0..100 step 1)
integer_slider_4 = IntegerSlider(2, range=0..100 step 1)
code_block_2 = CodeBlock(start=integer_slider_2, stop=integer_slider_3, step=integer_slider_4) { 0..20..0.5; start..stop..step; }
byCoordinates_3 = Point.ByCoordinates(x=code_block_2.out1, y=code_block_2.out1, z=code_block_2.out1)

# group: Range
code_block_3 = CodeBlock { 0; 20; 0.1; }
range = Range(start=code_block_3.out0, end=code_block_3.out1, step=code_block_3.out2)

# group: Get item (first)
code_block_4 = CodeBlock { 0; }
getItemAtIndex = List.GetItemAtIndex(list=range, index=code_block_4)

code_block_5 = CodeBlock { 0; 20; 20; }

# group: Sequence
sequence = Sequence(start=code_block_5.out0, amount=code_block_5.out1, step=code_block_5.out2)

integer_slider_5 = IntegerSlider(1, range=0..100 step 1)
integer_slider_6 = IntegerSlider(20, range=0..100 step 1)
integer_slider_7 = IntegerSlider(11, range=0..100 step 1)
code_block_6 = CodeBlock(start=integer_slider_5, stop=integer_slider_6, numberofsubdivisions=integer_slider_7) { 0..20..#5; start..stop..#numberofsubdivisions; }

# group: Math Sin
integer_slider_8 = IntegerSlider(0, range=0..360 step 1)
integer_slider_9 = IntegerSlider(360, range=0..360 step 1)
integer_slider_10 = IntegerSlider(14, range=0..360 step 1)
code_block_7 = CodeBlock { 10; }
code_block_8 = CodeBlock { 50; }

range_2 = Range(start=integer_slider_8, end=integer_slider_9, step=integer_slider_10)

# group (continued): Math Sin
add = range_2 + code_block_7

sin = Math.Sin(angle=add)

# group (continued): Math Sin
mul = sin * code_block_8
byCoordinates_4 = Point.ByCoordinates(x=range_2, z=mul)

# group: NURB curve
integer_slider_11 = IntegerSlider(3, range=1..3 step 1)
byControlPoints = NurbsCurve.ByControlPoints(points=byCoordinates_4, degree=integer_slider_11)

# group: Inputs
start_number = IntegerSlider(0, range=0..360 step 1)
end_number = IntegerSlider(360, range=0..360 step 1)
step_value = IntegerSlider(14, range=0..360 step 1)
phase = IntegerSlider(17, range=0..50 step 1)
amplitude = IntegerSlider(46, range=0..50 step 1)
# note: Variables / Inputs
# Red indicates Variables that can be altered per project and must be set accordingly before running the script.
cruve_degree = IntegerSlider(3, range=1..5 step 1)

# group: Cruves
# note: DesignScript
code_block_9 = CodeBlock(startnumber=start_number, endnumber=end_number, step=step_value, phase_value=phase, amplitude_value=amplitude, degree=cruve_degree)
# ---------- code_block_9.designscript (6 lines) ----------
x_value = startnumber..endnumber..step;
phase_value;
amplitude_value;
z_value= Math.Sin(x_value + phase_value) * amplitude_value;
points = Point.ByCoordinates(x_value,0,z_value);
NurbsCurve.ByControlPoints(points,degree);
# ----------------------------------------
