# Dynamo graph DynamoBasics_04.dyn (Dynamo 2.12.0.5650)

# note: Working / Functions
# Green indicates the working of the script. No changes should be made in these groups unless advised.
# note: Variables / Inputs
# Red indicates Variables that can be altered per project and must be set accordingly before running the script.

# note: Important stuff
# Purple will indicate something important is going on here.
# note: Checking / Outputs
# Orange indicates checking nodes to ensure the script has deployed correctly.
points = CodeBlock { p1 = 0..10; p2 = 0..5; Point.ByCoordinates(p1,0,0); Point.ByCoordinates(p2,0,2); }

# group: Lacing (List Mgmt)
byStartPointEndPoint = Line.ByStartPointEndPoint(startPoint=points.out2, endPoint=points.out3)
byStartPointEndPoint_2 = Line.ByStartPointEndPoint(startPoint=points.out2, endPoint=points.out3, lacing=Longest)
byStartPointEndPoint_3 = Line.ByStartPointEndPoint(startPoint=points.out2, endPoint=points.out3, lacing=CrossProduct)

# group: Create List
code_block = CodeBlock { 2; 3; }
list_create = List.Create(item0=code_block.out0, item1=code_block.out1)
# note: DesignScript
list = CodeBlock { [1,2,3]; }
list_2 = CodeBlock { ["Name","Surname"]; }
list_sub_list = CodeBlock()
# ---------- list_sub_list.designscript (2 lines) ----------
[["Name1","Surname1"],
["Name2","Surname2"]];
# ----------------------------------------

# group: Lacing Mgmt
code_block_2 = CodeBlock { [2,3]; [5,4,6]; }
# note: 2x5
# 3x4
# 3x6
mul = code_block_2.out0 * code_block_2.out1  # lacing=Longest
# note: 2x5
# 3x4
mul_2 = code_block_2.out0 * code_block_2.out1
mul_3 = code_block_2.out0 * code_block_2.out1  # lacing=CrossProduct

# group: Flatten and Sort
sort = List.Sort(list=mul_3)
flatten = List.Flatten(list=mul_3)
sort_2 = List.Sort(list=flatten)

code_block_3 = CodeBlock { ["Name1","Name2","Name3"]; [3,2,1]; }

# group: Extra Sort
sortIndexByValue = List.SortIndexByValue()  # unwired: list
sortByKey = List.SortByKey(list=code_block_3.out0, keys=code_block_3.out1)
sortByFunction = List.SortByFunction()  # unwired: list, sortFunction

# group: Sort By Key (lenght)
flatten_2 = List.Flatten(list=byStartPointEndPoint_3)
length = Curve.Length(curve=flatten_2)
sortByKey_2 = List.SortByKey(list=flatten_2, keys=length)

# group: Plane creation (normal)
integer_slider = IntegerSlider(22, range=1..100 step 1)
integer_slider_2 = IntegerSlider(5, range=1..100 step 1)
integer_slider_3 = IntegerSlider(23, range=1..100 step 1)
byCoordinates = Vector.ByCoordinates(x=integer_slider, y=integer_slider_2, z=integer_slider_3)
# note: Normal = perpedincular to plane
byOriginNormal = Plane.ByOriginNormal(normal=byCoordinates)

# group: Circle on plane
integer_slider_4 = IntegerSlider(4, range=1..100 step 1)
byPlaneRadius = Circle.ByPlaneRadius(plane=byOriginNormal, radius=integer_slider_4)

# group: Coordinate System (local)
toCoordinateSystem = Plane.ToCoordinateSystem(plane=byOriginNormal)

# group: Points
integer_slider_5 = IntegerSlider(2, range=0..100 step 1)
number_slider = DoubleSlider(78.7, range=0..100 step 0.1)
number_slider_2 = DoubleSlider(66.9, range=0..100 step 0.1)
code_block_4 = CodeBlock(rotation=integer_slider_5, a=number_slider, p=number_slider_2) { x = 0..360*rotation..5; y = a*Math.Cos(x+p); z = a*Math.Sin(x+p); }
byCoordinates_2 = Point.ByCoordinates(x=code_block_4.x, y=code_block_4.y, z=code_block_4.z)

# group: Nurbs Curve
byControlPoints = NurbsCurve.ByControlPoints(points=byCoordinates_2)

# group: Planes at Curve Parameter
integer_slider_6 = IntegerSlider(50, range=0..100 step 1)
code_block_5 = CodeBlock(subdivisions=integer_slider_6) { 0..1..#subdivisions; }
planeAtParameter = Curve.PlaneAtParameter(curve=byControlPoints, param=code_block_5)

# group: Create Circles
code_block_6 = CodeBlock { 10; }
byPlaneRadius_2 = Circle.ByPlaneRadius(plane=planeAtParameter, radius=code_block_6)

# group: Scale Circle geometry
code_block_7 = CodeBlock(times=integer_slider_6) { 0.1..5..#times; }
scale = Geometry.Scale(geometry=byPlaneRadius_2, plane=planeAtParameter, xamount=code_block_7, yamount=code_block_7, zamount=code_block_7)

# group: Geometry!
byLoft = Solid.ByLoft(crossSections=scale)

code_block_8 = CodeBlock()  # //Exercise 01

# group: Curves
select_model_elements = DSModelElementsSelection()  # 8 picked in the model

# group: Analyze Curves geometry and plane
curves = Element.Curves(element=select_model_elements)
flatten_3 = List.Flatten(list=curves)
byJoinedCurves = PolyCurve.ByJoinedCurves(curves=flatten_3)
basePlane = PolyCurve.BasePlane(polyCurve=byJoinedCurves)
toCoordinateSystem_2 = Plane.ToCoordinateSystem(plane=basePlane)

# group: Points
integer_slider_7 = IntegerSlider(2, range=0..100 step 1)
number_slider_3 = DoubleSlider(78.7, range=0..100 step 0.1)
number_slider_4 = DoubleSlider(66.9, range=0..100 step 0.1)
code_block_9 = CodeBlock(rotation=integer_slider_7, a=number_slider_3, p=number_slider_4) { x = 0..360*rotation..5; y = a*Math.Cos(x+p); z = a*Math.Sin(x+p); }
byCoordinates_3 = Point.ByCoordinates(x=code_block_9.x, y=code_block_9.y, z=code_block_9.z)

# group: Nurbs Curve
byControlPoints_2 = NurbsCurve.ByControlPoints(points=byCoordinates_3)

# group: Planes at Curve Parameter
integer_slider_8 = IntegerSlider(50, range=0..100 step 1)
code_block_10 = CodeBlock(subdivisions=integer_slider_8) { 0..1..#subdivisions; }
planeAtParameter_2 = Curve.PlaneAtParameter(curve=byControlPoints_2, param=code_block_10)

toCoordinateSystem_3 = Plane.ToCoordinateSystem(plane=planeAtParameter_2)

# group: Transform
transform = Geometry.Transform(geometry=byJoinedCurves, fromCoordinateSystem=toCoordinateSystem_2, contextCoordinateSystem=toCoordinateSystem_3)

# group: Scale Circle geometry
code_block_11 = CodeBlock(times=integer_slider_8) { 0.1..5..#times; }
scale_2 = Geometry.Scale(geometry=transform, plane=planeAtParameter_2, xamount=code_block_11, yamount=code_block_11, zamount=code_block_11)

# group: Geometry!
byLoft_2 = Solid.ByLoft(crossSections=scale_2)

code_block_12 = CodeBlock()  # //Exercise 02

# group: Form into Revit (GM or Mass family)
explode = Geometry.Explode(geometry=scale_2)
referenceCurveByCurve = ModelCurve.ReferenceCurveByCurve(curve=explode)
byLoftCrossSections = Form.ByLoftCrossSections(curves=referenceCurveByCurve)
