# Dynamo graph DynamoBasics_05.dyn (Dynamo 2.12.0.5650)

# note: Working / Functions
# Green indicates the working of the script. No changes should be made in these groups unless advised.
# note: Variables / Inputs
# Red indicates Variables that can be altered per project and must be set accordingly before running the script.
# note: Checking / Outputs
# Orange indicates checking nodes to ensure the script has deployed correctly.

# group: All elements of Cat
categories = Categories()  # nothing selected
all_elements_of_category = ElementsOfCategory(Category=categories)
# note: DesignScript
code_block = CodeBlock { cat = Category.ByName("Walls"); ElementQueries.OfCategory(cat); }

code_block_2 = CodeBlock(x=code_block.out1) { x[0]; }

# group: Instance Param
parameters = Element.Parameters(element=code_block_2)

# group: Type Parameters
elementType = Element.ElementType(element=code_block_2)
parameters_2 = Element.Parameters(element=elementType)

code_block_3 = CodeBlock(e=code_block_2)
# ---------- code_block_3.designscript (5 lines) ----------
type_e = Elements.Element.ElementType(e);

ID = e.Id;
instance_parameters = e.Parameters;
type_parameters = type_e.Parameters;
# ----------------------------------------

# group: Element ID
id = Element.Id(element=code_block_2)

# group: Parameter Names
code_block_4 = CodeBlock { "Base Constraint"; "Length"; "Area"; }

# group: Get a Parameter
getParameterValueByName = Element.GetParameterValueByName(element=code_block.out1, parameterName=code_block_4.out2)
getParameterValueByName_2 = Element.GetParameterValueByName(element=code_block.out1, parameterName=code_block_4.out0)
getParameterValueByName_3 = Element.GetParameterValueByName(element=code_block.out1, parameterName=code_block_4.out1)

# group: Units converter
convert_between_units = DynamoConvert(getParameterValueByName, MeasurementType="Area", FromConversion="SquareMeter", ToConversion="SquareMillimeter")

# group: Element ID
id_2 = Element.Id(element=code_block.out1)
string_from_object = FromObject(object=id_2)

# group: Set Parameter Value
code_block_5 = CodeBlock { "Comments"; }
setParameterByName = Element.SetParameterByName(element=code_block.out1, parameterName=code_block_5, value=string_from_object)

# group: Getting Name and Type Name
code_block_6 = CodeBlock(e=code_block.out1) { e.Name; Elements.ElementType(e).Name; }

code_block_7 = CodeBlock(e=getParameterValueByName_2) { e.Name; }

# group: Merge and Transpose Data
list_create = List.Create(item0=string_from_object, item1=code_block_6.out0, item2=code_block_6.out1, item3=code_block_7, item4=getParameterValueByName_3, item5=getParameterValueByName)
transpose = List.Transpose(lists=list_create)

# group: Add Column Headers
code_block_8 = CodeBlock()
# ---------- code_block_8.designscript (7 lines) ----------
["Element ID",
"Element Name",
"Type Name",
"Level",
"Lenght",
"Area"
];
# ----------------------------------------
addItemToFront = List.AddItemToFront(item=code_block_8, list=transpose)

# group: Write Data to Excel
file_path = Filename("..\..\Desktop\Book1.xlsx")
code_block_9 = CodeBlock { "Revit Export"; 0; true; }
exportToExcel = Data.ExportToExcel(filePath=file_path, sheetName=code_block_9.out0, startRow=code_block_9.out1, startColumn=code_block_9.out1, data=addItemToFront, overWrite=code_block_9.out2, writeAsString=code_block_9.out2)

# group: Multi-Cat Selector
# note: Important stuff
# Purple will indicate something important is going on here.
code_block_10 = CodeBlock { cats = Category.ByName(["Walls","Floors","Ceilings"]); ElementQueries.OfCategory(cats); }
