# Dynamo graph Dyn_00_01_Getting started.dyn (Dynamo 2.12.0.5650)

number = DoubleInput(0)
number_2 = DoubleInput(5)
number_3 = DoubleInput(1)
sequence = Sequence(start=number, amount=number_2, step=number_3)
watch = Watch(sequence)
