# Dynamo graph Dyn_00_03_Strings and other Data Types.dyn (Dynamo 2.12.0.5650)

# group: String
string = StringInput("String")
string_2 = StringInput("This is a string!")
string_3 = StringInput("1")
string_4 = StringInput("1.52")

# group: Range | Sequence
string_5 = StringInput("A")
string_6 = StringInput("Z")
number = DoubleInput(2)
range = Range(start=string_5, end=string_6, step=number)
watch = Watch(range)
string_7 = StringInput("A")
number_2 = DoubleInput(20)
number_3 = DoubleInput(5)
sequence = Sequence(start=string_7, amount=number_2, step=number_3)
watch_2 = Watch(sequence)

# group: Strings from other Data Types
code_block = CodeBlock { 1..10..1; }
string_from_array = FromArray(array=code_block)
watch_3 = Watch(string_from_array)
string_from_object = FromObject(object=code_block)
watch_4 = Watch(string_from_object)

toNumber = String.ToNumber(string=watch_4)

# group: Data Types
number_4 = DoubleInput(2)
mul = code_block * number_4
mul_2 = string_from_object * number_4

# group: Concatenate | Join Strings
string_8 = StringInput("Concatenate")
string_9 = StringInput("some")
string_10 = StringInput("strings!")
concat = String.Concat(string0=string_8, string1=string_9, string2=string_10)
watch_5 = Watch(concat)
string_11 = StringInput("")
string_12 = StringInput("Join")
string_13 = StringInput("some")
string_14 = StringInput("strings!")
join = String.Join(separator=string_11, string0=string_12, string1=string_13, string2=string_14)
watch_6 = Watch(join)
string_15 = StringInput("Strings can also be ")
string_16 = StringInput("added using +")
add = string_15 + string_16
watch_7 = Watch(add)

# group: Concatenate | Join Lists
code_block_2 = CodeBlock { "a".."z"..1; }
concat_2 = String.Concat(string0=code_block_2)
watch_8 = Watch(concat_2)
string_17 = StringInput(",")
join_2 = String.Join(separator=string_17, string0=code_block_2)
watch_9 = Watch(join_2)
string_18 = StringInput("1")
code_block_3 = CodeBlock { 1..26..1; }
string_from_object_2 = FromObject(object=code_block_3)
join_3 = String.Join(separator=string_17, string0=code_block_2, string1=string_18, string2=string_from_object_2)
watch_10 = Watch(join_3)

# group: Begin | End
string_19 = StringInput("Hello World!")
string_20 = StringInput("hello")
boolean = BoolSelector(true)
startsWith = String.StartsWith(string=string_19, searchFor=string_20, ignoreCase=boolean)
watch_11 = Watch(startsWith)
string_21 = StringInput("World!")
endsWith = String.EndsWith(string=string_19, searchFor=string_21, ignoreCase=boolean)
watch_12 = Watch(endsWith)

# group: Contains
string_22 = StringInput("John Smith")
string_23 = StringInput("Fred Smithson")
string_24 = StringInput("Joe Biggs")
list_create = List.Create(item0=string_22, item1=string_23, item2=string_24)
string_25 = StringInput("Smith")
boolean_2 = BoolSelector(false)
contains = String.Contains(string=list_create, searchFor=string_25, ignoreCase=boolean_2)
watch_13 = Watch(contains)

# group: Exact Match
string_26 = StringInput("This")
eq = string_26 == string_26
watch_14 = Watch(eq)

# group: All | Frist | Last Index
string_27 = StringInput("This is a sentence")
string_28 = StringInput("e")
boolean_3 = BoolSelector(true)
allIndicesOf = String.AllIndicesOf(string=string_27, searchFor=string_28, ignoreCase=boolean_3)
watch_15 = Watch(allIndicesOf)
lastIndexOf = String.LastIndexOf(string=string_27, searchFor=string_28, ignoreCase=boolean_3)
watch_16 = Watch(lastIndexOf)
indexOf = String.IndexOf(string=string_27, searchFor=string_28, ignoreCase=boolean_3)
watch_17 = Watch(indexOf)

# group: Length | Count
string_29 = StringInput("This is my string")
length = String.Length(string=string_29)
watch_18 = Watch(length)
string_30 = StringInput("is")
boolean_4 = BoolSelector(true)
countOccurrences = String.CountOccurrences(string=string_29, searchFor=string_30, ignoreCase=boolean_4)
watch_19 = Watch(countOccurrences)

# group: Change Case
string_31 = StringInput("Hello World!")
toUpper = String.ToUpper(string=string_31)
watch_20 = Watch(toUpper)
toLower = String.ToLower(string=string_31)
watch_21 = Watch(toLower)
boolean_5 = BoolSelector(true)
changeCase = String.ChangeCase(string=string_31, upper=boolean_5)
watch_22 = Watch(changeCase)

# group: Padding
string_32 = StringInput("Surrounded")
number_5 = DoubleInput(16)
string_33 = StringInput("!")
center = String.Center(string=string_32, newLength=number_5, padChars=string_33)
watch_23 = Watch(center)
padLeft = String.PadLeft(string=string_32, newLength=number_5, padChars=string_33)
watch_24 = Watch(padLeft)
padRight = String.PadRight(string=string_32, newLength=number_5, padChars=string_33)
watch_25 = Watch(padRight)

# group: Insert
string_34 = StringInput("Superman is better than batman")
string_35 = StringInput("is")
boolean_6 = BoolSelector(true)
indexOf_2 = String.IndexOf(string=string_34, searchFor=string_35, ignoreCase=boolean_6)
number_6 = DoubleInput(2)
add_2 = indexOf_2 + number_6
string_36 = StringInput("n't")
insert = String.Insert(string=string_34, index=add_2, toInsert=string_36)
watch_26 = Watch(insert)

# group: Searching and Separating
string_37 = StringInput("Superman is so cool")
string_38 = StringInput("Superman")
string_39 = StringInput("Batman")
replace = String.Replace(string=string_37, searchFor=string_38, replaceWith=string_39)
watch_27 = Watch(replace)
string_40 = StringInput("This is a sentence")
string_41 = StringInput(" ")
split = String.Split(string=string_40, separator0=string_41)
watch_28 = Watch(split)
number_7 = DoubleInput(0)
number_8 = DoubleInput(8)
remove = String.Remove(string=string_40, startIndex=number_7, count=number_8)
watch_29 = Watch(remove)
number_9 = DoubleInput(2)
substring = String.Substring(string=string_40, startIndex=number_9, length=number_9)
watch_30 = Watch(substring)

# group: Cleaning Strings
string_42 = StringInput("        this is a sentence           ")
trimTrailingWhitespace = String.TrimTrailingWhitespace(string=string_42)
watch_31 = Watch(trimTrailingWhitespace)
trimLeadingWhitespace = String.TrimLeadingWhitespace(string=string_42)
watch_32 = Watch(trimLeadingWhitespace)
trimWhitespace = String.TrimWhitespace(string=string_42)
watch_33 = Watch(trimWhitespace)

# group: Location (User Defined)
number_10 = DoubleInput(45)
string_43 = StringInput("MyLocation")
byLatitudeAndLongitude = DynamoUnits.Location.ByLatitudeAndLongitude(latitude=number_10, longitude=number_10, name=string_43)
name = DynamoUnits.Location.Name(location=byLatitudeAndLongitude)
watch_34 = Watch(name)
latitude = DynamoUnits.Location.Latitude(location=byLatitudeAndLongitude)
watch_35 = Watch(latitude)
longitude = DynamoUnits.Location.Longitude(location=byLatitudeAndLongitude)
watch_36 = Watch(longitude)

# group: Mix | Create Colours
color_palette = ColorPalette({R: 102, G: 95, B: 31, A: 91})
number_11 = DoubleInput(2)
divide = Color.Divide(color=color_palette, dividend=number_11)
watch_37 = Watch(divide)
multiply = Color.Multiply(color=color_palette, multiplier=number_11)
watch_38 = Watch(multiply)
code_block_4 = CodeBlock { 50; 255; 0; }
byARGB = Color.ByARGB(alpha=code_block_4.out0, red=code_block_4.out1, green=code_block_4.out2, blue=code_block_4.out2)
byARGB_2 = Color.ByARGB(alpha=code_block_4.out0, red=code_block_4.out2, green=code_block_4.out2, blue=code_block_4.out1)
add_3 = Color.Add(color=byARGB, otherColor=byARGB_2)
watch_39 = Watch(add_3)

blue = Color.Blue(color=watch_39)
red = Color.Red(color=watch_39)
green = Color.Green(color=watch_39)
alpha = Color.Alpha(color=watch_39)
components = Color.Components(color=watch_39)
hue = Color.Hue(color=watch_39)
saturation = Color.Saturation(color=watch_39)
brightness = Color.Brightness(color=watch_39)

# group: Colour Ranges
color_range = ColorRange()  # unwired: colors, indices, value
byColorsAndParameters = ColorRange.ByColorsAndParameters()  # unwired: colors, parameters
getColorAtParameter = ColorRange.GetColorAtParameter(colorRange=byColorsAndParameters)  # unwired: parameter

# group: Date | Time
now = DateTime.Now()
today = DateTime.Today()
isDaylightSavingsTime = DateTime.IsDaylightSavingsTime(dateTime=today)
dayOfWeek = DateTime.DayOfWeek(dateTime=today)
dayOfYear = DateTime.DayOfYear(dateTime=today)
components_2 = DateTime.Components(dateTime=today)
date = DateTime.Date(dateTime=today)
