# Dynamo graph Dyn_00_04_List Management.dyn (Dynamo 2.12.0.5650)

code_block = CodeBlock { Category.ByName("Walls"); }
all_elements_of_category = ElementsOfCategory(Category=code_block)
string = StringInput("Area")
getParameterValueByName = Element.GetParameterValueByName(element=all_elements_of_category, parameterName=string)
watch = Watch(getParameterValueByName)

# group: Min | Max
minimumItem = List.MinimumItem(list=watch)
maximumItem = List.MaximumItem(list=watch)

# group: Index of
indexOf = List.IndexOf(list=watch, element=maximumItem)

code_block_2 = CodeBlock { 0; 1; }

# group: Remap Range
remapRange = Math.RemapRange(numbers=watch, newMin=code_block_2.out0, newMax=code_block_2.out1)

watch_2 = Watch(all_elements_of_category)
code_block_3 = CodeBlock { 3; }
code_block_4 = CodeBlock { 500; 50; }

# group: Cycle | Repeat
cycle = List.Cycle(list=watch, amount=code_block_3)
ofRepeatedItem = List.OfRepeatedItem(item=code_block_4.out0, amount=code_block_4.out1)

watch_3 = Watch(ofRepeatedItem)

# group: Unique
uniqueItems = List.UniqueItems(list=watch_3)

# group: Reverse | Shuffle
reverse = List.Reverse(list=watch)
shuffle = List.Shuffle(list=watch)

# group: Empty List
empty = List.Empty()
isEmpty = List.IsEmpty(list=empty)

string_2 = StringInput("Type")
getParameterValueByName_2 = Element.GetParameterValueByName(element=all_elements_of_category, parameterName=string_2)
watch_4 = Watch(getParameterValueByName_2)

# group: List of Lists
join = List.Join(list0=watch, list1=watch_2)
list_create = List.Create(item0=watch, item1=watch_2, item2=watch_4)

# group: Transpose
transpose = List.Transpose(lists=list_create)

integer_slider = IntegerSlider(1, range=0..3 step 1)
integer_slider_2 = IntegerSlider(2, range=0..3 step 1)

# group: Flatten | Chop
flatten = List.Flatten(list=transpose, amount=integer_slider)
chop = List.Chop(list=flatten, lengths=integer_slider_2)

# group: Take | Drop
code_block_5 = CodeBlock { 3; 0; }
takeEveryNthItem = List.TakeEveryNthItem(list=flatten, n=code_block_5.out0, offset=code_block_5.out1)
dropEveryNthItem = List.DropEveryNthItem(list=flatten, n=code_block_5.out0, offset=code_block_5.out1)

watch_5 = Watch(takeEveryNthItem)
watch_6 = Watch(dropEveryNthItem)

# group: Count @ Level
count = List.Count(list=chop)
count_2 = List.Count(list=chop@L1)
count_3 = List.Count(list=chop@L2)

watch_7 = Watch(count)
watch_8 = Watch(count_2)
watch_9 = Watch(count_3)

# group: Get at Index
code_block_6 = CodeBlock { 0; }
getItemAtIndex = List.GetItemAtIndex(list=chop, index=code_block_6)

# group: List Map
code_block_7 = CodeBlock { 0; }
getItemAtIndex_2 = List.GetItemAtIndex(index=code_block_7)  # unwired: list
map = List.Map(list=chop, function=getItemAtIndex_2)
# note: Map will aply a function to each list (or sublist)
code_block_8 = CodeBlock { 0; 5; }
replaceItemAtIndex = List.ReplaceItemAtIndex(index=code_block_8.out0, item=code_block_8.out1)  # unwired: list
map_2 = List.Map(list=chop, function=replaceItemAtIndex)

# group: Practical example
# note: Total area of each wall type?
filterByBoolMask = List.FilterByBoolMask()  # unwired: list, mask

id = Element.Id(element=watch_4)
groupByKey = List.GroupByKey(list=watch, keys=id)
watch_10 = Watch(groupByKey.groups)

# group: Sum
sum = Math.Sum(values=watch_10)

# group: List Lacing
code_block_9 = CodeBlock { 1..10..1; }
code_block_10 = CodeBlock { "a".."z"..1; }
add = code_block_9 + code_block_10
add_2 = code_block_9 + code_block_10  # lacing=Shortest
add_3 = code_block_9 + code_block_10  # lacing=Longest
add_4 = code_block_9 + code_block_10  # lacing=CrossProduct

# group: Bool Masks
number = DoubleInput(100)
gt = watch > number
filterByBoolMask_2 = List.FilterByBoolMask(list=watch_2, mask=gt)
watch_11 = Watch(filterByBoolMask_2.in)
