# Dynamo graph Dyn_00_04_List Management_example.dyn (Dynamo 2.12.0.5650)

# group: Input 2 lists
code_block = CodeBlock { " "; }
code_block_2 = CodeBlock { "A"; "Z"; 1; }
range = Range(start=code_block_2.out0, end=code_block_2.out1, step=code_block_2.out2)
addItemToEnd = List.AddItemToEnd(item=code_block, list=range)
code_block_3 = CodeBlock { 11; 37; 1; }
range_2 = Range(start=code_block_3.out0, end=code_block_3.out1, step=code_block_3.out2)
reverse = List.Reverse(list=range_2)

watch = Watch(addItemToEnd)
watch_2 = Watch(reverse)
string_from_object = FromObject(object=watch_2)
string = StringInput("THIS IS A TEST STRING")
string_2 = StringInput("")
split = String.Split(string=string, separator0=string_2)
indexOf = List.IndexOf(list=addItemToEnd, element=split)
getItemAtIndex = List.GetItemAtIndex(list=reverse, index=indexOf)
string_from_object_2 = FromObject(object=getItemAtIndex)
concat = String.Concat(string0=string_from_object_2)
string_3 = StringInput("")
split_2 = String.Split(string=concat, separator0=string_3)
flatten = List.Flatten(list=split_2)
code_block_4 = CodeBlock { 2; }
chop = List.Chop(list=flatten, lengths=code_block_4)
concat_2 = String.Concat()  # unwired: string0
map = List.Map(list=chop, function=concat_2)
flatten_2 = List.Flatten(list=map)
indexOf_2 = List.IndexOf(list=string_from_object, element=flatten_2)
getItemAtIndex_2 = List.GetItemAtIndex(list=watch, index=indexOf_2)
concat_3 = String.Concat(string0=getItemAtIndex_2)
