# Dynamo graph Dyn_00_05_DesignScript and codeblocks.dyn (Dynamo 2.12.0.5650)

# group: Code Blocks
# note: It accepts all kind of types
code_block = CodeBlock { 2; }
code_block_2 = CodeBlock { 1.0; }
code_block_3 = CodeBlock { "String"; }
code_block_4 = CodeBlock { true; }
code_block_5 = CodeBlock { false; }

code_block_6 = CodeBlock { 2; 1.0; "String"; true; false; }

# group: Implied statements
code_block_7 = CodeBlock { x=5; }
code_block_8 = CodeBlock { 2+2; }

watch = Watch(code_block_8)
# note: can feed a list!
code_block_9 = CodeBlock { [1,3]; }
code_block_10 = CodeBlock { 1; 2; }
code_block_11 = CodeBlock { 1; 2; }

# group: Statments
code_block_12 = CodeBlock(x=code_block_9) { x+5; }
code_block_13 = CodeBlock(x=code_block_10.out0, y=code_block_10.out1) { x+y; }
code_block_14 = CodeBlock(x=code_block_11.out0, y=code_block_11.out1) { x; x+y; x*y; x-y; }

watch_2 = Watch(code_block_12)
watch_3 = Watch(code_block_13)
watch_4 = Watch(code_block_14.out3)
code_block_15 = CodeBlock { 5; }

# group: Booleans
code_block_16 = CodeBlock(x=code_block_15) { x==5; x!=5; x>5; x<5; x>=5; x<=5; }

watch_5 = Watch(code_block_16.out1)

# group: Node to Code
code_block_17 = CodeBlock { 5; }
byCoordinates = Point.ByCoordinates(x=code_block_17, y=code_block_17, z=code_block_17)
point = CodeBlock(x=code_block_17, y=code_block_17, z=code_block_17) { Point.ByCoordinates(x,y,z); }

# group: Range
code_block_18 = CodeBlock { 1; 10; }
range = Range(start=code_block_18.out0, end=code_block_18.out1, step=code_block_18.out0)
range_2 = CodeBlock { 1..10..1; }
code_block_19 = CodeBlock { 25; }
# note: start,stop,step
range_3 = CodeBlock(x=code_block_19) { 1..x..1; }

# group: Sequence
code_block_20 = CodeBlock { 1; 10; }
sequence = Sequence(start=code_block_20.out0, amount=code_block_20.out1, step=code_block_20.out0)
sequence_2 = CodeBlock { 1..#10..1; }

# group: Complex example
code_block_21 = CodeBlock { 1; 10; }
range_4 = Range(start=code_block_21.out0, end=code_block_21.out1, step=code_block_21.out0)
code_block_22 = CodeBlock { 5; }
getItemAtIndex = List.GetItemAtIndex(list=range_4, index=code_block_22)
transpose = List.Transpose(lists=getItemAtIndex)
code_block_23 = CodeBlock { range = (1..10..1); item = List.GetItemAtIndex(range,5); List.Transpose(item); }
watch_6 = Watch(code_block_23.out2)

# group: Lists
code_block_24 = CodeBlock { [1,2,3]; }
code_block_25 = CodeBlock { str1="st1"; str2="st2"; str3="st3"; [str1,str2,str3]; }

watch_7 = Watch(code_block_24)
watch_8 = Watch(code_block_25.out3)

# group: Functions
code_block_26 = CodeBlock()
# ---------- code_block_26.designscript (5 lines) ----------
def squared(input)
{
//explanantion text
return = input*input;
};
# ----------------------------------------
code_block_27 = CodeBlock { 5; }
code_block_28 = CodeBlock(x=code_block_27) { squared(x); }
