# Dynamo graph Dyn_00_08_Family Types and Instances_example02.dyn (Dynamo 2.12.0.5650)
# packages: Clockwork for Dynamo 2.x 2.4.0

# group: Select a Random Furniture Elements
code_block = CodeBlock { Category.ByName("Furniture"); }
all_family_types_of_category = Custom[All Family Types Of Category](category=code_block)  # package Clockwork for Dynamo 2.x; Gets all family types/symbols of a given category in the model.
integer_slider = IntegerSlider(16, range=0..100 step 1)
code_block_2 = CodeBlock { 0; }
count = List.Count(list=all_family_types_of_category)
code_block_3 = CodeBlock(x=count) { x-1; }
integer_slider_2 = IntegerSlider(52, range=0..100 step 1)
randomList = Math.RandomList(amount=integer_slider, value1=code_block_2, value2=code_block_3, seed=integer_slider_2)
round = Math.Round(number=randomList)
getItemAtIndex = List.GetItemAtIndex(list=all_family_types_of_category, index=round)

# group: Create a Surface
XY = Plane.XY()
W = IntegerSlider(16000, range=5000..20000 step 1000)
W_2 = IntegerSlider(17000, range=5000..20000 step 1000)
byWidthLength = Rectangle.ByWidthLength(plane=XY, width=W, length=W_2)
patch = Curve.Patch(curve=byWidthLength)

# group: Create Random Points in the surface
code_block_4 = CodeBlock { 0; 1; }
code_block_5 = CodeBlock(x=integer_slider_2) { x+1; x+2; }
randomList_2 = Math.RandomList(amount=integer_slider, value1=code_block_4.out0, value2=code_block_4.out1, seed=code_block_5.out0)
randomList_3 = Math.RandomList(amount=integer_slider, value1=code_block_4.out0, value2=code_block_4.out1, seed=code_block_5.out1)
pointAtParameter = Surface.PointAtParameter(surface=patch, u=randomList_2, v=randomList_3)

# group: Create Families and Rotate them
byPoint = FamilyInstance.ByPoint(familyType=getItemAtIndex, point=pointAtParameter)
code_block_6 = CodeBlock(x=integer_slider_2)
# ---------- code_block_6.designscript (5 lines) ----------
0;
360;

//Seed
x+3;
# ----------------------------------------
randomList_4 = Math.RandomList(amount=integer_slider, value1=code_block_6.out0, value2=code_block_6.out1, seed=code_block_6.out2)
setRotation = FamilyInstance.SetRotation(familyInstance=byPoint, degree=randomList_4)
