# Dynamo graph Dyn_00_09_Points and Lines_extra.dyn (Dynamo 2.12.0.5650)

# group: By Coordinate system
byCartesianCoordinates = Point.ByCartesianCoordinates()

# group: Coordinate System XYZ
code_block = CodeBlock { 0; 30000; 5000; }
byOrigin = CoordinateSystem.ByOrigin(x=code_block.out0, y=code_block.out1, z=code_block.out2)

# group: Coordinate System XY (Z is always 0)
code_block_2 = CodeBlock { 0; 3000; }
byOrigin_2 = CoordinateSystem.ByOrigin(x=code_block_2.out0, y=code_block_2.out1)

# group: Cylindrical Coordinates
code_block_3 = CodeBlock { 5000; }
angle = CodeBlock { 15; }
code_block_4 = CodeBlock(x=angle) { 0..360..x; }
h = CodeBlock { 1000; }
code_block_5 = CodeBlock(x=h) { 0..6000..x; }
byCylindricalCoordinates = Point.ByCylindricalCoordinates(coordinateSystem=byOrigin_2, angle=code_block_4, elevation=code_block_5, radius=code_block_3, lacing=CrossProduct)

# group: Spherical coordinates
angle_2 = CodeBlock { 15; }
code_block_6 = CodeBlock(x=angle_2) { 0..360..x; }
bySphericalCoordinates = Point.BySphericalCoordinates(coordinateSystem=byOrigin, phi=code_block_6, theta=code_block_6, radius=code_block_3, lacing=CrossProduct)

count = List.Count(list=code_block_6)

# group: Point to lines
chop = List.Chop(list=bySphericalCoordinates, lengths=count)
transpose = List.Transpose(lists=chop@L3)
byBestFitThroughPoints = Circle.ByBestFitThroughPoints(points=transpose)
byBestFitThroughPoints_2 = Circle.ByBestFitThroughPoints(points=chop)
clean = List.Clean(list=byBestFitThroughPoints_2)

# group: Point to Lines
byBestFitThroughPoints_3 = Line.ByBestFitThroughPoints(bestFitPoints=byCylindricalCoordinates)
transpose_2 = List.Transpose(lists=byCylindricalCoordinates@L3)
byBestFitThroughPoints_4 = Circle.ByBestFitThroughPoints(points=transpose_2)
