# Dynamo graph Dyn_Element Collector.dyn "Element Collector" (Dynamo 2.6.1.8786)

elementinstance_collector = Python()
# ---------- elementinstance_collector.python (78 lines) ----------
import clr
clr.AddReference('RevitAPI')
from Autodesk.Revit.DB import *

clr.AddReference("RevitNodes")
import Revit
clr.ImportExtensions(Revit.Elements)
clr.ImportExtensions(Revit.GeometryConversion)

clr.AddReference("RevitServices")
import RevitServices
from RevitServices.Persistence import DocumentManager
from RevitServices.Transactions import TransactionManager

from System.Collections.Generic import *

doc = DocumentManager.Instance.CurrentDBDocument

SpaceCats = List[BuiltInCategory]()
SpaceCats.Add(BuiltInCategory.OST_Rooms)
SpaceCats.Add(BuiltInCategory.OST_Areas)

BuiltInCats = List[BuiltInCategory]()
BuiltInCats.Add(BuiltInCategory.OST_Ceilings)
BuiltInCats.Add(BuiltInCategory.OST_Columns)
BuiltInCats.Add(BuiltInCategory.OST_Casework)
BuiltInCats.Add(BuiltInCategory.OST_CurtainWallPanels)
BuiltInCats.Add(BuiltInCategory.OST_CurtainWallMullions)
BuiltInCats.Add(BuiltInCategory.OST_Doors)
BuiltInCats.Add(BuiltInCategory.OST_Floors)
BuiltInCats.Add(BuiltInCategory.OST_Furniture)
BuiltInCats.Add(BuiltInCategory.OST_GenericModel)
BuiltInCats.Add(BuiltInCategory.OST_Mass)
BuiltInCats.Add(BuiltInCategory.OST_Parking)
BuiltInCats.Add(BuiltInCategory.OST_PlumbingFixtures)
BuiltInCats.Add(BuiltInCategory.OST_StairsRailing)
BuiltInCats.Add(BuiltInCategory.OST_Ramps)
BuiltInCats.Add(BuiltInCategory.OST_Roofs)
BuiltInCats.Add(BuiltInCategory.OST_Stairs)
BuiltInCats.Add(BuiltInCategory.OST_StructuralColumns)
BuiltInCats.Add(BuiltInCategory.OST_StructuralFraming)
BuiltInCats.Add(BuiltInCategory.OST_Topography)
BuiltInCats.Add(BuiltInCategory.OST_Windows)
BuiltInCats.Add(BuiltInCategory.OST_Walls)
BuiltInCats.Add(BuiltInCategory.OST_Grids)
BuiltInCats.Add(BuiltInCategory.OST_Levels)

Materials = List[BuiltInCategory]()
Materials.Add(BuiltInCategory.OST_Materials)

OpeningCats = List[BuiltInCategory]()
OpeningCats.Add(BuiltInCategory.OST_CeilingOpening)
OpeningCats.Add(BuiltInCategory.OST_FloorOpening)
OpeningCats.Add(BuiltInCategory.OST_RoofOpening)
OpeningCats.Add(BuiltInCategory.OST_ShaftOpening)

CoordCats = List[BuiltInCategory]()
CoordCats.Add(BuiltInCategory.OST_DuctTerminal)
CoordCats.Add(BuiltInCategory.OST_FireAlarmDevices)
CoordCats.Add(BuiltInCategory.OST_LightingFixtures)
CoordCats.Add(BuiltInCategory.OST_SecurityDevices)
CoordCats.Add(BuiltInCategory.OST_Sprinklers)

SpaceFilter = ElementMulticategoryFilter(SpaceCats)
BuiltInFilter = ElementMulticategoryFilter(BuiltInCats)
MaterialFilter = ElementMulticategoryFilter(Materials)
OpeningFilter = ElementMulticategoryFilter(OpeningCats)
CoordFilter = ElementMulticategoryFilter(CoordCats)


SpaceElements = FilteredElementCollector(doc).WherePasses(SpaceFilter).WhereElementIsNotElementType().ToElements()
BuiltInElements = FilteredElementCollector(doc).WherePasses(BuiltInFilter).WhereElementIsNotElementType().ToElements()
MaterialElements = FilteredElementCollector(doc).WherePasses(MaterialFilter).WhereElementIsNotElementType().ToElements()
OpeningElements = FilteredElementCollector(doc).WherePasses(OpeningFilter).WhereElementIsNotElementType().ToElements()
CoordElements = FilteredElementCollector(doc).WherePasses(CoordFilter).WhereElementIsNotElementType().ToElements()


OUT = SpaceElements, BuiltInElements, MaterialElements, OpeningElements, CoordElements
# ----------------------------------------
code_block = CodeBlock(x=elementinstance_collector) { RoomsOut = x[0]; ModelElementsOut = x[1]; MaterialsOut = x[2]; OpeningsOut = x[3]; CoordinationOut = x[4]; }
code_block_2 = CodeBlock()
# ---------- code_block_2.designscript (37 lines) ----------
/* Possible Spreadsheets:

1. Rooms
2. Areas


3. Materials
3. Families in the model
5. Views
	View Templates
	View Filters
6. Sheets
7. Workset overview
8. Grids & Levels
8. Model Overview:
	Warning count
	File Size
	Total elements in model
	Purgable elements
	Views count
	Views not on sheets
	Views with hidden elements

9.Performance
	Model groups
	Detail groups
	Imports
		CAD
		Custom Object Styles
		Images
	Links
		Revit
		CAD links
	Worksets
	Design options

*/;
# ----------------------------------------
documentelement_collector = Python()
# ---------- documentelement_collector.python (78 lines) ----------
import clr
clr.AddReference('RevitAPI')
from Autodesk.Revit.DB import *

clr.AddReference("RevitNodes")
import Revit
clr.ImportExtensions(Revit.Elements)
clr.ImportExtensions(Revit.GeometryConversion)

clr.AddReference("RevitServices")
import RevitServices
from RevitServices.Persistence import DocumentManager
from RevitServices.Transactions import TransactionManager

from System.Collections.Generic import *

doc = DocumentManager.Instance.CurrentDBDocument

SpaceCats = List[BuiltInCategory]()
SpaceCats.Add(BuiltInCategory.OST_Rooms)
SpaceCats.Add(BuiltInCategory.OST_Areas)

BuiltInCats = List[BuiltInCategory]()
BuiltInCats.Add(BuiltInCategory.OST_Ceilings)
BuiltInCats.Add(BuiltInCategory.OST_Columns)
BuiltInCats.Add(BuiltInCategory.OST_Casework)
BuiltInCats.Add(BuiltInCategory.OST_CurtainWallPanels)
BuiltInCats.Add(BuiltInCategory.OST_CurtainWallMullions)
BuiltInCats.Add(BuiltInCategory.OST_Doors)
BuiltInCats.Add(BuiltInCategory.OST_Floors)
BuiltInCats.Add(BuiltInCategory.OST_Furniture)
BuiltInCats.Add(BuiltInCategory.OST_GenericModel)
BuiltInCats.Add(BuiltInCategory.OST_Mass)
BuiltInCats.Add(BuiltInCategory.OST_Parking)
BuiltInCats.Add(BuiltInCategory.OST_PlumbingFixtures)
BuiltInCats.Add(BuiltInCategory.OST_StairsRailing)
BuiltInCats.Add(BuiltInCategory.OST_Ramps)
BuiltInCats.Add(BuiltInCategory.OST_Roofs)
BuiltInCats.Add(BuiltInCategory.OST_Stairs)
BuiltInCats.Add(BuiltInCategory.OST_StructuralColumns)
BuiltInCats.Add(BuiltInCategory.OST_StructuralFraming)
BuiltInCats.Add(BuiltInCategory.OST_Topography)
BuiltInCats.Add(BuiltInCategory.OST_Windows)
BuiltInCats.Add(BuiltInCategory.OST_Walls)
BuiltInCats.Add(BuiltInCategory.OST_Grids)
BuiltInCats.Add(BuiltInCategory.OST_Levels)

Materials = List[BuiltInCategory]()
Materials.Add(BuiltInCategory.OST_Materials)

OpeningCats = List[BuiltInCategory]()
OpeningCats.Add(BuiltInCategory.OST_CeilingOpening)
OpeningCats.Add(BuiltInCategory.OST_FloorOpening)
OpeningCats.Add(BuiltInCategory.OST_RoofOpening)
OpeningCats.Add(BuiltInCategory.OST_ShaftOpening)

CoordCats = List[BuiltInCategory]()
CoordCats.Add(BuiltInCategory.OST_DuctTerminal)
CoordCats.Add(BuiltInCategory.OST_FireAlarmDevices)
CoordCats.Add(BuiltInCategory.OST_LightingFixtures)
CoordCats.Add(BuiltInCategory.OST_SecurityDevices)
CoordCats.Add(BuiltInCategory.OST_Sprinklers)

SpaceFilter = ElementMulticategoryFilter(SpaceCats)
BuiltInFilter = ElementMulticategoryFilter(BuiltInCats)
MaterialFilter = ElementMulticategoryFilter(Materials)
OpeningFilter = ElementMulticategoryFilter(OpeningCats)
CoordFilter = ElementMulticategoryFilter(CoordCats)


SpaceElements = FilteredElementCollector(doc).WherePasses(SpaceFilter).ToElements()
BuiltInElements = FilteredElementCollector(doc).WherePasses(BuiltInFilter).ToElements()
MaterialElements = FilteredElementCollector(doc).WherePasses(MaterialFilter).ToElements()
OpeningElements = FilteredElementCollector(doc).WherePasses(OpeningFilter).ToElements()
CoordElements = FilteredElementCollector(doc).WherePasses(CoordFilter).ToElements()


OUT = SpaceElements, BuiltInElements, MaterialElements, OpeningElements, CoordElements
# ----------------------------------------
code_block_3 = CodeBlock(x=documentelement_collector) { RoomsOut = x[0]; ModelElementsOut = x[1]; MaterialsOut = x[2]; OpeningsOut = x[3]; CoordinationOut = x[4]; }
annotationinstance_collector = Python()
# ---------- annotationinstance_collector.python (53 lines) ----------
import clr
clr.AddReference('RevitAPI')
from Autodesk.Revit.DB import *

clr.AddReference("RevitNodes")
import Revit
clr.ImportExtensions(Revit.Elements)
clr.ImportExtensions(Revit.GeometryConversion)

clr.AddReference("RevitServices")
import RevitServices
from RevitServices.Persistence import DocumentManager
from RevitServices.Transactions import TransactionManager

from System.Collections.Generic import *

doc = DocumentManager.Instance.CurrentDBDocument

AnnCats = List[BuiltInCategory]()
AnnCats.Add(BuiltInCategory.OST_Callouts)
AnnCats.Add(BuiltInCategory.OST_DetailComponents)
AnnCats.Add(BuiltInCategory.OST_Dimensions)
AnnCats.Add(BuiltInCategory.OST_ElevationMarks)
AnnCats.Add(BuiltInCategory.OST_Elev)
AnnCats.Add(BuiltInCategory.OST_FilledRegion)
AnnCats.Add(BuiltInCategory.OST_GridHeads)
AnnCats.Add(BuiltInCategory.OST_LevelHeads)
AnnCats.Add(BuiltInCategory.OST_Lines)
AnnCats.Add(BuiltInCategory.OST_MaskingRegion)



LayoutCats = List[BuiltInCategory]()
LayoutCats.Add(BuiltInCategory.OST_ScheduleGraphics)
LayoutCats.Add(BuiltInCategory.OST_Schedules)
LayoutCats.Add(BuiltInCategory.OST_PanelScheduleGraphics)
LayoutCats.Add(BuiltInCategory.OST_ColorFillLegends)
LayoutCats.Add(BuiltInCategory.OST_TitleBlocks)
LayoutCats.Add(BuiltInCategory.OST_Views)
LayoutCats.Add(BuiltInCategory.OST_Sheets)




AnnFilter = ElementMulticategoryFilter(AnnCats)
LayoutFilter = ElementMulticategoryFilter(LayoutCats)


AnnElements = FilteredElementCollector(doc).WherePasses(AnnFilter).WhereElementIsNotElementType().ToElements()
LayoutElements = FilteredElementCollector(doc).WherePasses(LayoutFilter).WhereElementIsNotElementType().ToElements()


OUT = AnnElements, LayoutElements
# ----------------------------------------
code_block_4 = CodeBlock(x=annotationinstance_collector) { AnnotationsOut = x[0]; LayoutsOut = x[1]; }
