# Dynamo graph Dyn_ReadExcel_temp.dyn "ReadExcel" (Dynamo 2.6.1.8786)
# packages: archi-lab.net 2020.23.13, Rhythm 2021.7.3

file_path = Filename("C:\Users\Javier\Desktop\K000_drawinglist.xlsx")
file_from_path = FileObject(path=file_path)
string = StringInput("Deliverables")
code_block = CodeBlock { true; false; }
importExcel = Data.ImportExcel(file=file_from_path, sheetName=string, readAsStrings=code_block.out0, showExcel=code_block.out1)
transpose = List.Transpose(lists=importExcel)
first_architecture_item = StringInput("26")  # graph input
toNumber = String.ToNumber(str=first_architecture_item)
dropItems = List.DropItems(list=transpose@L2, amount=toNumber)
code_block_2 = CodeBlock(x=dropItems) { x[24]; }
code_block_3 = CodeBlock { ""; }
isNull = Object.IsNull()  # unwired: obj
replaceByCondition = Replace(item=code_block_2, replaceWith=code_block_3, condition=isNull)
code_block_4 = CodeBlock { ""; }
allIndicesOf = List.AllIndicesOf(list=replaceByCondition, item=code_block_4)
# note: Clean Excel input list!
removeItemAtIndex = List.RemoveItemAtIndex(list=dropItems@L2, indices=allIndicesOf)
excel_input = CodeBlock(x=removeItemAtIndex) { "D_"+x[18]+"_"+x[20]+"_"+x[24]+"00_"+x[2]; }

# group: Elements Collector
annotationinstance_collector = Python()
# ---------- annotationinstance_collector.python (33 lines) ----------
import clr
clr.AddReference('RevitAPI')
from Autodesk.Revit.DB import *

clr.AddReference("RevitNodes")
import Revit
clr.ImportExtensions(Revit.Elements)
clr.ImportExtensions(Revit.GeometryConversion)

clr.AddReference("RevitServices")
import RevitServices
from RevitServices.Persistence import DocumentManager
from RevitServices.Transactions import TransactionManager

from System.Collections.Generic import *

doc = DocumentManager.Instance.CurrentDBDocument


CollectorTTB = FilteredElementCollector(doc).OfCategory(BuiltInCategory.OST_TitleBlocks).WhereElementIsNotElementType().ToElements()

CollectorViews = FilteredElementCollector(doc).OfCategory(BuiltInCategory.OST_Views).WhereElementIsNotElementType().ToElements()

CollectorSheets = FilteredElementCollector(doc).OfCategory(BuiltInCategory.OST_Sheets).WhereElementIsNotElementType().ToElements()

CollectorLevels = FilteredElementCollector(doc).OfCategory(BuiltInCategory.OST_Levels).WhereElementIsNotElementType().ToElements()

CollectorViewTemplates =[t for t in  FilteredElementCollector(doc).OfClass(View).ToElements() if t.IsTemplate and t.ViewType < ViewType.ThreeD]

CollectorAreaScheme = FilteredElementCollector(doc).OfClass(AreaScheme).WhereElementIsNotElementType().ToElements()


OUT = CollectorTTB, CollectorViews, CollectorSheets, CollectorLevels, CollectorViewTemplates, CollectorAreaScheme
# ----------------------------------------
code_block_5 = CodeBlock(x=annotationinstance_collector)
# ---------- code_block_5.designscript (17 lines) ----------
CollectorTB = List.UniqueItems(x[0]);
TBName = CollectorTB.Name;

CollectorViews = x[1];
ViewName = CollectorViews.Name;

CollectorSheets = x[2];

CollectorLevels = x[3];
LevelNaming = CollectorLevels.Name;
Elements.Element.GetParameterValueByName(CollectorLevels, "ID_LevelLocation");
CollectorViewTemplate = x[4];

CollectorAreaScheme = List.RemoveItemAtIndex(x[5],0);
CollectorAreaScheme.Name;
LevelsInModel = List.Count(CollectorLevels);
PlansPerScheme = List.Cycle(CollectorAreaScheme.Name@L1<1>, LevelsInModel);
# ----------------------------------------

py_onlynewviews = Python(IN[0]=excel_input, IN[1]=code_block_5.ViewName)
# ---------- py_onlynewviews.python (10 lines) ----------
excel_sheets = IN[0]
revit_sheets = IN[1]

new_sheets = []

dif = [item for item in excel_sheets if item not in revit_sheets]
for i in dif:
	new_sheets.append(i)

OUT = new_sheets
# ----------------------------------------
indexOf = List.IndexOf(list=excel_input, element=py_onlynewviews)
getItemAtIndex = List.GetItemAtIndex(list=removeItemAtIndex@L2, index=indexOf)
createCallout = archilab.Revit.Views.Views.CreateCallout()  # unwired: view, viewFamilyType, extents

# group: Check if Sheet already exits
code_block_6 = CodeBlock(x=removeItemAtIndex) { RevitSheetNumber = x[16]+"-"+x[18]+"-"+x[20]+"-"+x[24]+x[25]; }
code_block_7 = CodeBlock(e=code_block_5.CollectorSheets) { e.SheetNumber; }
py_OnlyNewSheets = Python(IN[0]=code_block_6, IN[1]=code_block_7)  # same code as py_onlynewviews
indexOf_2 = List.IndexOf(list=code_block_6, element=py_OnlyNewSheets)
# note: Sheets not in the Model
getItemAtIndex_2 = List.GetItemAtIndex(list=removeItemAtIndex@L2, index=indexOf_2)

# group: Data From Excel
excel_input_2 = CodeBlock(x=getItemAtIndex_2)
# ---------- excel_input_2.designscript (18 lines) ----------
ExcelRevitSheetNumber = x[1];
RevitSheetName = x[2];
SheetFormat = x[4];
SheetDate = x[8];

ID_ProjectCode = x[10];
ProjectPhase = x[12];
ID_Originator = x[14];

ID_Discipline = x[16];
ID_VolumeSystem = x[18];
ID_LevelLocation = x[20];
ID_DocumentType = x[22];
DrawingType = x[24];
ID_DocumentNumber = x[24]+x[25];
RevitSheetNumber = ID_Discipline+"-"+ID_VolumeSystem+"-"+ID_LevelLocation+"-"+ID_DocumentNumber;

ViewName = "D_"+ID_VolumeSystem+"_"+ID_LevelLocation+"_"+DrawingType+"00_"+RevitSheetName+" ";
# ----------------------------------------

uniqueItems = List.UniqueItems(list=code_block_5.TBName)
indexOf_3 = List.IndexOf(list=code_block_5.TBName, element=uniqueItems)
getItemAtIndex_3 = List.GetItemAtIndex(list=code_block_5.CollectorTB, index=indexOf_3)
code_block_8 = CodeBlock(e=getItemAtIndex_3) { e.Name; }
byKeysValues = DesignScript.Builtin.Dictionary.ByKeysValues(keys=code_block_8, values=getItemAtIndex_3)
valueAtKey = DesignScript.Builtin.Dictionary.ValueAtKey(dictionary=byKeysValues, key=excel_input_2.SheetFormat)
elementType = Element.ElementType(element=valueAtKey)
python_script = Python(IN[0]=excel_input_2.RevitSheetName, IN[1]=excel_input_2.RevitSheetNumber, IN[2]=elementType)
# ---------- python_script.python (43 lines) ----------
#From Dynamo Forum
import clr
clr.AddReference('RevitAPI')
from Autodesk.Revit.DB import ViewSheet

clr.AddReference("RevitNodes")
import Revit
clr.ImportExtensions(Revit.Elements)

clr.AddReference("RevitServices")
import RevitServices
from RevitServices.Persistence import DocumentManager
from RevitServices.Transactions import TransactionManager
doc = DocumentManager.Instance.CurrentDBDocument

def tolist(obj1):
	if hasattr(obj1,"__iter__"): return obj1
	else: return [obj1]

sheetnames = tolist(IN[0])
sheetnumbers = tolist(IN[1])
titleblock = tolist(UnwrapElement(IN[2]))
sheetList,notCreated = [], []

TransactionManager.Instance.EnsureInTransaction(doc) 
for number in range(len(sheetnumbers)):
	if len(titleblock) > 1:
		newsheet = ViewSheet.Create(doc,titleblock[number].Id)
		#new sheets with different titleblocks
	else:
		newsheet = ViewSheet.Create(doc,titleblock[0].Id) 
		#new sheets whith identical titleblock
	newsheet.Name = sheetnames[number]
	try:
		newsheet.SheetNumber = sheetnumbers[number]
		sheetList.append(newsheet.ToDSType(False))
	except:
		notCreated.append(number)
		doc.Delete(newsheet.Id)

TransactionManager.Instance.TransactionTaskDone()

OUT = sheetList, notCreated
# ----------------------------------------
code_block_9 = CodeBlock(wait=python_script, pass=python_script) { out = [wait, pass]; List.Flatten(out[1],-1); }
watch = Watch(excel_input_2.DrawingType)

# group: Mapping
code_block_10 = CodeBlock(input=watch)
# ---------- code_block_10.designscript (3 lines) ----------
SplitMap02 = String.Split(input, [""]);
FirstMap02 = List.GetItemAtIndex(SplitMap02@L2<1>, 0);
K_Browser02 = FirstMap02 + "000";
# ----------------------------------------
K_Browser02 = CodeBlock(map02=code_block_10.K_Browser02)
# ---------- K_Browser02.designscript (11 lines) ----------
map02 == "0000" ? map02+"_Starting Documents":
map02 =="1000" ? map02+"_Plans":
map02 =="2000" ? map02+"_Sections":
map02 =="3000" ? map02+"_Elevations":
map02 =="4000" ? map02+"_Fragments":
map02 =="5000" ? map02+"_Details":
map02 =="6000" ? map02+"_Element drawings":
map02 =="7000" ? map02+"_Furniture drawings":
map02 =="8000" ? map02+"_Overview plans":
map02 =="9000" ? map02+"_Existing plans":
null;
# ----------------------------------------
code_block_11 = CodeBlock(a=watch) { a + "00"; }
K_Browser03 = CodeBlock(map03=code_block_11)
# ---------- K_Browser03.designscript (40 lines) ----------
map03 == "0000" ? map03+"_Base documents":
map03 == "0100" ? map03+"_Presentation":
map03 =="0200" ? map03+"_Plans":
map03 =="0300" ? map03+"_Sections":

map03 =="1000" ? map03+"_Site plan":
map03 =="1100" ? map03+"_Floor plan type 1":
map03 =="1200" ? map03+"_Floor plan type 2":
map03 =="1500" ? map03+"_Ceiling plan type 1":
map03 =="1600" ? map03+"_Ceiling plan type 2":

map03 =="2000" ? map03+"_Urban section":
map03 =="2100" ? map03+"_Section type 1":
map03 =="2200" ? map03+"_Section type 2":

map03 =="3100" ? map03+"_Elevation type 1":
map03 =="3200" ? map03+"_Elevation type 2":

map03 =="4100" ? map03+"_Fragment type 1":
map03 =="4200" ? map03+"_Fragment type 2":

map03 =="5000" ? map03+"_Detail principles":
map03 =="5100" ? map03+"_Detail book - exterior":
map03 =="5200" ? map03+"_Detail book - interior":

map03 =="6100" ? map03+"_Doors and windows - exterior":
map03 =="6200" ? map03+"_Doors and windows - interior":
map03 =="6300" ? map03+"_Prefabricated elements":

map03 =="7000" ? map03+"_Furniture - general arrangement":
map03 =="7100" ? map03+"_Furniture - fixed furniture":
map03 =="7200" ? map03+"_Furniture - movable furniture":

map03 =="8100" ? map03+"_Overview plan - areas":
map03 =="8200" ? map03+"_Overview plan - fire security":
map03 =="8300" ? map03+"_Overview plan - interior finishes":

map03 =="9100" ? map03+"_Existing plans":
map03 =="9200" ? map03+"_Demolition plans":
null;
# ----------------------------------------

K_Browser01 = CodeBlock(input=code_block_10.K_Browser02) { List.Cycle("D_Deliverables",List.Count(input)); }
string_from_object = FromObject(obj=excel_input_2.SheetDate)
code_block_12 = CodeBlock(SheetsInput=code_block_9.out1, K_Browser01=K_Browser01, K_Browser02=K_Browser02, K_Browser03=K_Browser03, ID_VolumeSystem=excel_input_2.ID_VolumeSystem, ID_LevelLocation=excel_input_2.ID_LevelLocation, ID_DocType=excel_input_2.ID_DocumentType, ID_DocNr=excel_input_2.ID_DocumentNumber, SheetIssueDate=string_from_object, ID_PaperSize=excel_input_2.SheetFormat)
# ---------- code_block_12.designscript (14 lines) ----------
Elements.Element.SetParameterByName(SheetsInput, "K_Browser01", K_Browser01);
Elements.Element.SetParameterByName(SheetsInput, "K_Browser02", K_Browser02);
Elements.Element.SetParameterByName(SheetsInput, "K_Browser03", K_Browser03);

Elements.Element.SetParameterByName(SheetsInput, "ID_VolumeSystem", ID_VolumeSystem);
Elements.Element.SetParameterByName(SheetsInput, "ID_LevelLocation", ID_LevelLocation);
Elements.Element.SetParameterByName(SheetsInput, "ID_Document_Type", ID_DocType);
Elements.Element.SetParameterByName(SheetsInput, "ID_Document_Number", ID_DocNr);


RemoveTime = String.Remove(SheetIssueDate,10,9);
CleanDate = String.Replace(RemoveTime,"/",".");
Elements.Element.SetParameterByName(SheetsInput, "ID_PaperSize", ID_PaperSize);
Elements.Element.SetParameterByName(SheetsInput, "Sheet Issue Date", CleanDate);
# ----------------------------------------
# note: A-ZZ-ZZ-1101
code_block_13 = CodeBlock(e=code_block_12.out10) { List.Flatten(e.SheetNumber, -1); }

# group: This is where i left it!
floorPlansFiltering = CodeBlock(CollectorLevels=code_block_5.CollectorLevels, ID_DrawingType=excel_input_2.DrawingType, ID_VolumeSystem=excel_input_2.ID_VolumeSystem, ID_LevelLocation=excel_input_2.ID_LevelLocation, RevitName=excel_input_2.RevitSheetName)
# ---------- floorPlansFiltering.designscript (68 lines) ----------
CollectorLevels;
LevelNaming = CollectorLevels.Name;
LevelCount = List.Count(CollectorLevels);
SplitLevel = String.Split(LevelNaming, [" "]);
List.GetItemAtIndex(SplitLevel@L2<1>, 0);


FloorPlanValues = ["10","11","12","13","14"];
CeilingPlanValues = ["15","16","17","18","19"];
SectionValues = ["20","21","22","23","24","25","26","27","28","29"];
ElevationValues = ["30","31","32","33","34","35","36","37","38","39"];
//FragmentValues = ["40","41","42","43","44","45","46","47","48","49"];
//DetailValues = ["50","51","52"];
//ElementValues = ["61","62"];
//FurnitueValues = ["70","71","72"];
OverviewValues = ["80","81","82","83","84","85"];


//Get AllIndices of each DrawingType
FpIndices = List.Flatten(List.AllIndicesOf(ID_DrawingType, FloorPlanValues),-1);
CpIndices = List.Flatten(List.AllIndicesOf(ID_DrawingType, CeilingPlanValues),-1);
SectIndices = List.Flatten(List.AllIndicesOf(ID_DrawingType, SectionValues),-1);
ElevIndices = List.Flatten(List.AllIndicesOf(ID_DrawingType, ElevationValues),-1);
OvIndices = List.Flatten(List.AllIndicesOf(ID_DrawingType, OverviewValues),-1);


//Floor Plans Values
Fp_VolumeSystem = List.GetItemAtIndex(ID_VolumeSystem, FpIndices);
Fp_LevelLocation = List.GetItemAtIndex(ID_LevelLocation, FpIndices);
Fp_DrawingType = List.GetItemAtIndex(ID_DrawingType, FpIndices) + "00";
Fp_Name = List.GetItemAtIndex(RevitName, FpIndices);
Fp_ViewName = "D_"+Fp_VolumeSystem+"_"+Fp_LevelLocation+"_"+Fp_DrawingType +"_"+Fp_Name;

//Ceiling Plans Values
Cp_VolumeSystem = List.GetItemAtIndex(ID_VolumeSystem, CpIndices);
Cp_LevelLocation = List.GetItemAtIndex(ID_LevelLocation, CpIndices);
Cp_DrawingType = List.GetItemAtIndex(ID_DrawingType, CpIndices) + "00";
Cp_Name = List.GetItemAtIndex(RevitName, CpIndices);
Cp_ViewName = "D_"+Cp_VolumeSystem+"_"+Cp_LevelLocation+"_"+Cp_DrawingType +"_"+Cp_Name;







//Section Values
Sect_VolumeSystem = List.GetItemAtIndex(ID_VolumeSystem, SectIndices);
Sect_LevelLocation = List.GetItemAtIndex(ID_LevelLocation, SectIndices);
Sect_DrawingType = List.GetItemAtIndex(ID_DrawingType, SectIndices) + "00";
Sect_Name = List.GetItemAtIndex(RevitName, SectIndices);
Sect_ViewName = "D_"+Sect_VolumeSystem+"_"+Sect_LevelLocation+"_"+Sect_DrawingType +"_"+Sect_Name;
List.Count(Sect_VolumeSystem);

//Elevation Values
Elev_VolumeSystem = List.GetItemAtIndex(ID_VolumeSystem, ElevIndices);
Elev_LevelLocation = List.GetItemAtIndex(ID_LevelLocation, ElevIndices);
Elev_DrawingType = List.GetItemAtIndex(ID_DrawingType, ElevIndices) + "00";
Elev_Name = List.GetItemAtIndex(RevitName, ElevIndices);
Elev_ViewName = "D_"+Elev_VolumeSystem+"_"+Elev_LevelLocation+"_"+Elev_DrawingType +"_"+Elev_Name;
List.Count(Elev_VolumeSystem);

//Overview Values




// Filter them out!
# ----------------------------------------

byKeysValues_2 = DesignScript.Builtin.Dictionary.ByKeysValues(keys=floorPlansFiltering.out4, values=floorPlansFiltering.CollectorLevels)
groupByKey = List.GroupByKey(list=floorPlansFiltering.Fp_ViewName, keys=floorPlansFiltering.Fp_LevelLocation)
valueAtKey_2 = DesignScript.Builtin.Dictionary.ValueAtKey(dictionary=byKeysValues_2, key=groupByKey.unique_keys)
count = List.Count(list=groupByKey.groups@L2)
cycle = List.Cycle(list=valueAtKey_2@L1, amount=count@L1)
byLevel = FloorPlanView.ByLevel(level=cycle)
groupByKey_2 = List.GroupByKey(list=floorPlansFiltering.Cp_ViewName, keys=floorPlansFiltering.Cp_LevelLocation)
valueAtKey_3 = DesignScript.Builtin.Dictionary.ValueAtKey(dictionary=byKeysValues_2, key=groupByKey_2.unique_keys)
count_2 = List.Count(list=groupByKey_2.groups@L2)
cycle_2 = List.Cycle(list=valueAtKey_3@L1, amount=count_2@L1)
byLevel_2 = CeilingPlanView.ByLevel(level=cycle_2)
code_block_14 = CodeBlock { CoordinateSystem.ByPlane(Plane.XZ()); }
code_block_15 = CodeBlock(SectionCount=floorPlansFiltering.out30, ElevationCount=floorPlansFiltering.out36)
# ---------- code_block_15.designscript (4 lines) ----------
TotalCount = SectionCount + ElevationCount;

List.Cycle(Point.ByCoordinates(0,0,0), TotalCount);
List.Cycle(Point.ByCoordinates(10000,10000,10000), TotalCount);
# ----------------------------------------
byCoordinateSystemMinPointMaxPoint = SectionView.ByCoordinateSystemMinPointMaxPoint(cs=code_block_14, minPoint=code_block_15.out1, maxPoint=code_block_15.out2)
list_create = List.Create(item0=byLevel, item1=byLevel_2, item2=byCoordinateSystemMinPointMaxPoint)
flatten = List.Flatten(list=list_create)
join = List.Join(list0=floorPlansFiltering.Sect_ViewName, list1=floorPlansFiltering.Elev_ViewName)
list_create_2 = List.Create(item0=groupByKey.groups, item1=groupByKey_2.groups, item2=join)
flatten_2 = List.Flatten(list=list_create_2)
code_block_16 = CodeBlock(input=flatten, values=flatten_2)
# ---------- code_block_16.designscript (3 lines) ----------
Elements.Element.SetParameterByName(input, "View Name", values);

//Elements.Element.SetParameterByName(input, "View Template", VTvalues);
# ----------------------------------------
code_block_17 = CodeBlock(e=code_block_16) { String.Remove(e.Name,12,-13); }
indexOf_4 = List.IndexOf(list=excel_input_2.RevitSheetName, element=code_block_17)
getItemAtIndex_4 = List.GetItemAtIndex(list=excel_input_2.RevitSheetNumber, index=indexOf_4)
indexOf_5 = List.IndexOf(list=code_block_13, element=getItemAtIndex_4)
getItemAtIndex_5 = List.GetItemAtIndex(list=code_block_9.out1, index=indexOf_5)
watch_2 = Watch(flatten)
code_block_18 = CodeBlock(InputViews=watch_2) { InputViews; }
viewPortLocation = CodeBlock(SheetsInput=code_block_12.out10)
# ---------- viewPortLocation.designscript (17 lines) ----------
PaperSize = Elements.Element.GetParameterValueByName(SheetsInput, "ID_PaperSize");

PaperSize == "A4" ? Point.ByCoordinates(0, 0, 0):
PaperSize == "A3" ? Point.ByCoordinates(546.81, 153.5, 0):
PaperSize == "A2" ? Point.ByCoordinates(522.294, 210, 0):
PaperSize == "A2+" ? Point.ByCoordinates(417.294, 210, 0):
PaperSize == "A2++" ? Point.ByCoordinates(312.294, 210, 0):
PaperSize == "A2+++" ? Point.ByCoordinates(207.294, 210, 0):
PaperSize == "A1" ? Point.ByCoordinates(399.794, 297, 0):
PaperSize == "A1+" ? Point.ByCoordinates(293.794, 297, 0):
PaperSize == "A1++" ? Point.ByCoordinates(188.794, 297, 0):
PaperSize == "A1+++" ? Point.ByCoordinates(83.794, 297, 0):
PaperSize == "A0" ? Point.ByCoordinates(224.794, 420.5, 0):
PaperSize == "A0+" ? Point.ByCoordinates(119.794, 420.5, 0):
PaperSize == "A0++" ? Point.ByCoordinates(14.794, 420.5, 0):
PaperSize == "A0+++" ? Point.ByCoordinates(-90.206, 420.5, 0):
null;
# ----------------------------------------
getItemAtIndex_6 = List.GetItemAtIndex(list=viewPortLocation.out1, index=indexOf_5)
ʳʰʸᵗʰᵐ_viewport_create = Rhythm.Revit.Elements.Viewport.Create(sheet=getItemAtIndex_5, view=code_block_18, location=getItemAtIndex_6)
code_block_19 = CodeBlock()
# ---------- code_block_19.designscript (11 lines) ----------
// logic behind it


// add extra rows to import based on:
	//1. if doc naming 8XXX

//Doc naming A-ZZ-ZZ-8XXX
	// Detail number 8XXX.YY

// View Naming
	//D_ZZ_level_8X00.YY_description
# ----------------------------------------
byLevelAndAreaScheme = AreaPlanView.ByLevelAndAreaScheme()  # unwired: level, areaScheme
code_block_20 = CodeBlock { 0.01..0.08..0.01; }
string_from_object_2 = FromObject(obj=code_block_20)
# note: SheetNumber
# A-ZZ-01-8301
# note: DetailNumber
# 8301.01
sheetNumber = CodeBlock(ID_LevelLocation=string_from_object_2, Sequence=code_block_5.LevelsInModel)  # unwired: ID_DocumentNumber
# ---------- sheetNumber.designscript (8 lines) ----------
ID_Discipline = "A";
ID_VolumeSystem = "ZZ";
ID_LevelLocation;
ID_DocumentType = "DR";
ID_DocumentNumber;


ID_DetailNumber = ID_DocumentNumber+"."+Sequence;
# ----------------------------------------
# note: ViewName
# D_ZZ_01_8301_BVO first floor
code_block_21 = CodeBlock { "D"; ID_VolumeSystem = "ZZ"; ID_LevelLocation; ID_DocumentType = "DR"; ID_DocumentNumber; }  # unwired: ID_LevelLocation, ID_DocumentNumber
excel_input_3 = CodeBlock(x=removeItemAtIndex)  # same code as excel_input_2
list_create_3 = List.Create(item0=excel_input_3.ID_Discipline, item1=excel_input_3.ID_VolumeSystem, item2=excel_input_3.ID_LevelLocation)
code_block_22 = CodeBlock(ID_DocumentNumber=excel_input_3.ID_DocumentNumber)
# ---------- code_block_22.designscript (2 lines) ----------
BoolMask = List.FilterByBoolMask(ID_DocumentNumber, String.StartsWith(ID_DocumentNumber, "8", false));
IndexOf8XXX = List.IndexOf(ID_DocumentNumber, Dictionary.ValueAtKey(BoolMask, "in"));
# ----------------------------------------
getItemAtIndex_7 = List.GetItemAtIndex(list=list_create_3@L2, index=code_block_22.IndexOf8XXX)
code_block_23 = CodeBlock()
# ---------- code_block_23.designscript (12 lines) ----------
//Values Needed

//1.View Naming
//D_ZZ_ZZ_1200_name
//"D_"
//ID_VolumeSystem
//ID_LevelLocation
//DocumentType + 00
//Name

//2.Extra Overview plans
//Sheet input
# ----------------------------------------
