# Dynamo graph DynamoBasics_03.dyn (Dynamo 2.12.0.5650)

# note: Checking / Outputs
# Orange indicates checking nodes to ensure the script has deployed correctly.
# note: Working / Functions
# Green indicates the working of the script. No changes should be made in these groups unless advised.
# note: Variables / Inputs
# Red indicates Variables that can be altered per project and must be set accordingly before running the script.
# note: Important stuff
# Purple will indicate something important is going on here.

# group: Create a Series for multiple curves
E = IntegerSlider(300, range=0..1000 step 1)
E_2 = IntegerSlider(1000, range=0..1000 step 1)
D = IntegerSlider(500, range=0..1000 step 1)
code_block = CodeBlock(startTranslation=E, EndTranslation=E_2, DistanceBetweenCurves=D) { startTranslation..EndTranslation..DistanceBetweenCurves; }

# group: Inputs
start_number = IntegerSlider(0, range=0..360 step 1)
end_number = IntegerSlider(309, range=0..500 step 1)
step_value = IntegerSlider(41, range=0..360 step 1)
phase = IntegerSlider(130, range=0..200 step 1)
amplitude = IntegerSlider(84, range=0..100 step 1)
cruve_degree = IntegerSlider(3, range=1..5 step 1)

# group: Inputs
start_number_2 = IntegerSlider(0, range=0..360 step 1)
end_number_2 = IntegerSlider(312, range=0..360 step 1)
phase_2 = IntegerSlider(28, range=0..200 step 1)
amplitude_2 = IntegerSlider(18, range=0..50 step 1)
cruve_degree_2 = IntegerSlider(3, range=1..5 step 1)
horizontal_translation = IntegerSlider(130, range=1..500 step 1)

code_block_2 = CodeBlock(HorizontalTranslation=horizontal_translation) { -HorizontalTranslation; }

# group: Sin curves
sinCurveByPoints = Custom[SinCurveByPoints](StartNumber=start_number, EndNumber=end_number, NumberOfPoints=step_value, PhaseValue=phase, AmplitudeValue=amplitude, NurbsCurveDegree=cruve_degree)  # Creates a Sin curve
sinCurveByPoints_2 = Custom[SinCurveByPoints](StartNumber=start_number_2, EndNumber=end_number_2, NumberOfPoints=step_value, PhaseValue=phase_2, AmplitudeValue=amplitude_2, NurbsCurveDegree=cruve_degree_2, HorizontalTranslation=horizontal_translation)
sinCurveByPoints_3 = Custom[SinCurveByPoints](StartNumber=start_number_2, EndNumber=end_number_2, NumberOfPoints=step_value, PhaseValue=phase_2, AmplitudeValue=amplitude_2, NurbsCurveDegree=cruve_degree_2, HorizontalTranslation=code_block_2)

# group: Make sure curve points are the same
count = List.Count(list=sinCurveByPoints.CurvePoints)
count_2 = List.Count(list=sinCurveByPoints_2.CurvePoints)
count_3 = List.Count()  # unwired: list

# group: Create Loft
list_create = List.Create(item0=sinCurveByPoints_2.NurbsCurve, item1=sinCurveByPoints.NurbsCurve, item2=sinCurveByPoints_3.NurbsCurve)
byLoft = Surface.ByLoft(crossSections=list_create)

# group: Input 1st curve
start_number_3 = IntegerSlider(0, range=0..360 step 1)
end_number_3 = IntegerSlider(466, range=0..500 step 1)
step_value_2 = IntegerSlider(41, range=0..360 step 1)
phase_3 = IntegerSlider(130, range=0..200 step 1)
amplitude_3 = IntegerSlider(84, range=0..100 step 1)
cruve_degree_3 = IntegerSlider(3, range=1..5 step 1)
horizontal_translation_2 = IntegerSlider(443, range=1..500 step 1)

# group: Input 2nd curve
step_value_3 = IntegerSlider(246, range=0..360 step 1)
horizontal_translation_3 = IntegerSlider(581, range=1..750 step 1)

# group: Sin Curves
sinCurveByPoints_4 = Custom[SinCurveByPoints](StartNumber=start_number_3, EndNumber=end_number_3, NumberOfPoints=step_value_2, PhaseValue=phase_3, AmplitudeValue=amplitude_3, NurbsCurveDegree=cruve_degree_3, HorizontalTranslation=horizontal_translation_2)
sinCurveByPoints_5 = Custom[SinCurveByPoints](StartNumber=start_number_3, EndNumber=end_number_3, NumberOfPoints=step_value_3, PhaseValue=phase_3, AmplitudeValue=amplitude_3, NurbsCurveDegree=cruve_degree_3, HorizontalTranslation=horizontal_translation_3)

code_block_3 = CodeBlock(initial_curve=sinCurveByPoints_4.NurbsCurve) { initial_curve; }

# group: Points at curve (rebuild)
code_block_4 = CodeBlock { 0..1..0.1; }
code_block_5 = CodeBlock { 0..1..#30; }
pointAtParameter = Curve.PointAtParameter(curve=code_block_3, param=code_block_5)
byControlPoints = NurbsCurve.ByControlPoints(points=pointAtParameter)

code_block_6 = CodeBlock(rebuilt_curve=byControlPoints) { rebuilt_curve; }
code_block_7 = CodeBlock(initial_curve=sinCurveByPoints_5.NurbsCurve) { initial_curve; }

# group: Rebuild curve
pointAtParameter_2 = Curve.PointAtParameter(curve=code_block_7, param=code_block_5)
byControlPoints_2 = NurbsCurve.ByControlPoints(points=pointAtParameter_2)

code_block_8 = CodeBlock(rebuilt_curve=byControlPoints_2) { rebuilt_curve; }

# group: Surface
list_create_2 = List.Create(item0=code_block_6, item1=code_block_8)
byLoft_2 = Surface.ByLoft(crossSections=list_create_2)

# group: Lines
byStartPointEndPoint = Line.ByStartPointEndPoint(startPoint=pointAtParameter, endPoint=pointAtParameter_2)
