# Dynamo graph DynamoBasics_08.dyn (Dynamo 2.12.0.5650)

# group: Number of levels
# note: Variables / Inputs
# Red indicates Variables that can be altered per project and must be set accordingly before running the script.
tower_elevation = IntegerSlider(50, range=0..250 step 1)
# note: Working / Functions
# Green indicates the working of the script. No changes should be made in these groups unless advised.
number_of_floors = IntegerSlider(10, range=0..20 step 1)
code_block = CodeBlock(TowerElevation=tower_elevation, NumberOfFloors=number_of_floors) { 0..TowerElevation..#NumberOfFloors; }

# group: Inputs
radius = IntegerSlider(20, range=10..50 step 1)
x_scale = DoubleSlider(2.5, range=0.5..5 step 0.1)
y_scale = DoubleSlider(1.1, range=0.5..5 step 0.1)
# note: Checking / Outputs
# Orange indicates checking nodes to ensure the script has deployed correctly.
# note: Important stuff
# Purple will indicate something important is going on here.
number_of_floors_2 = IntegerSlider(25, range=0..25 step 1)
floor_elevation = IntegerSlider(9, range=0..10 step 1)
max_tower_rotation = IntegerSlider(180, range=10..360 step 1)
shell_distance = DoubleSlider(1.2, range=0.5..2 step 0.1)

# group: Creating Circles, then scale them and copy them
byCenterPointRadius = Circle.ByCenterPointRadius(radius=radius)
scale = Geometry.Scale(geometry=byCenterPointRadius, xamount=x_scale, yamount=y_scale)
ZAxis = Vector.ZAxis()
tower_elevation_2 = CodeBlock(NOF=number_of_floors_2, FE=floor_elevation) { NOF * FE; }
code_block_2 = CodeBlock(TowerElevation=tower_elevation_2, FloorElevation=floor_elevation) { 0..TowerElevation..FloorElevation; }
translate = Geometry.Translate(geometry=scale, direction=ZAxis, distance=code_block_2)

# group: Rotate the Ovals
byCoordinates = Point.ByCoordinates(z=code_block_2)
code_block_3 = CodeBlock(maxRotation=max_tower_rotation, numberOfRotations=number_of_floors_2) { 0..maxRotation..#numberOfRotations+1; }
rotate = Geometry.Rotate(geometry=translate, origin=byCoordinates, axis=ZAxis, degrees=code_block_3)

# group: Shell
offset = Curve.Offset(curve=rotate, distance=shell_distance)

# group: Surfaces
byLoft = Surface.ByLoft(crossSections=offset)
byLoft_2 = Surface.ByLoft(crossSections=rotate)

# group: Create Levels from Points Height
restOfItems = List.RestOfItems(list=code_block_2)
byElevation = Level.ByElevation(elevation=restOfItems)

# group: Create Plans and RCP
byLevel = FloorPlanView.ByLevel(level=byElevation)
byLevel_2 = CeilingPlanView.ByLevel(level=byElevation)

# group: Convert NURBS to PolyCurve
approximateWithArcAndLineSegments = Curve.ApproximateWithArcAndLineSegments(curve=rotate)
byJoinedCurves = PolyCurve.ByJoinedCurves(curves=approximateWithArcAndLineSegments)

# group: Add Floors
floor_types = FloorTypes("Standard")
byOutlineTypeAndLevel = Floor.ByOutlineTypeAndLevel(outlineCurves=byJoinedCurves, floorType=floor_types, level=byElevation)

# note: Add Panels from Lunchbox
watch = Watch()  # unwired: arg0

# group: Add Panels
family_types = FamilyTypes()  # nothing selected
byPoints = AdaptiveComponent.ByPoints(points=watch, familyType=family_types)
