# Dynamo custom node SinCurveByPoints.dyf (Dynamo 2.12.0.5650)
# category: DynamoTraining
# Creates a Sin curve

StartNumber = Input(StartNumber: double = 0)  # This is the start number for range
EndNumber = Input(EndNumber: double = 10)  # This is the end number for the range
NumberOfPoints = Input(NumberOfPoints: double = 10)  # Number of subdivisions
PhaseValue = Input(PhaseValue: double = 0)  # Phase value
AmplitudeValue = Input(AmplitudeValue: double = 1)  # Amplitude value
HorizontalTranslation = Input(HorizontalTranslation: double = 0)  # Horizontal translation
NurbsCurveDegree = Input(NurbsCurveDegree: double = 3)

# group: Cruves
# note: DesignScript
code_block = CodeBlock(startnumber=StartNumber, endnumber=EndNumber, step=NumberOfPoints, phase_value=PhaseValue, amplitude_value=AmplitudeValue, y=HorizontalTranslation, degree=NurbsCurveDegree)
# ---------- code_block.designscript (6 lines) ----------
x_value = startnumber..endnumber..#step;
phase_value;
amplitude_value;
z_value= Math.Sin(x_value + phase_value) * amplitude_value;
points = Point.ByCoordinates(x_value,y,z_value);
NurbsCurve.ByControlPoints(points,degree);
# ----------------------------------------

CurvePoints = Output(code_block.points)  # Output of curve points
NurbsCurve = Output(code_block.out5)  # Nurbs curve
