# Dynamo graph WIP_Dyn_RoomsFromExcel.dyn (Dynamo 2.16.1.2727)

# note: Important stuff
# Purple will indicate something important is going on here.
# note: Checking / Outputs
# Orange indicates checking nodes to ensure the script has deployed correctly.
# note: Working / Functions
# Green indicates the working of the script. No changes should be made in these groups unless advised.
# note: Variables / Inputs
# Red indicates Variables that can be altered per project and must be set accordingly before running the script.

# group: Excel file!
# note: Needed Excel File for creating volumes!

# group: Dyn_13_Spatial Plan from Excel
# note: Workflow
# To be filled in!

# group: File path
file_path = Filename("P:\K717 Tribunal Nancy\20_BIM\05_support files\10_excel\230731_Program\20230731_program with heights_C.2.3_input revit.xls")

# group: Excel Worksheet
excel_worksheet_name = CodeBlock { "Program"; }

# group: Import Excel file
file_from_path = FileObject(path=file_path)
code_block = CodeBlock { true; false; }
importExcel = Data.ImportExcel(file=file_from_path, sheetName=excel_worksheet_name, readAsStrings=code_block.out0, showExcel=code_block.out1)

string_from_object = FromObject(object=importExcel)

# group: Clean Sheet Imported data (and repeat values based on instance)
# note: clean nulls
# excel > dynamo replace , for .
code_block_2 = CodeBlock(input=string_from_object)
# ---------- code_block_2.designscript (33 lines) ----------
//Get Raw excel data
raw_excel = input;
headers = input[0];
drop_headers = List.DropItems(raw_excel,1);
transpose = List.Transpose(drop_headers);
clean_nulls = String.Replace(transpose, "null" ,"");
clean_data = String.Replace(clean_nulls, "," ,".");


// Gettting All parameters from the schedule
room_name = clean_data[11];
room_number = clean_data[9];

program_code01 = clean_data[0];
program_code02 = clean_data[1];
program_code03 = clean_data[2];
program_code04 = clean_data[3];
program_code01_desc = clean_data[4];
program_code02_desc = clean_data[5];
program_code03_desc = clean_data[6];
program_code04_desc = clean_data[7];

program_number = clean_data[8];
program_number_instance = clean_data[9];
program_roomtype = clean_data[10];
program_name = clean_data[11];
program_headroom = clean_data[12];
program_area = clean_data[17];

workingspots_one = clean_data[13];
workingspots_onebis = clean_data[14];
workingspots_two = clean_data[15];
workingspots_three = clean_data[16];
# ----------------------------------------

code_block_3 = CodeBlock(names=code_block_2.room_name) { names; }
code_block_4 = CodeBlock(numbers=code_block_2.room_number) { numbers; }
select_phase = RevitPhases()  # nothing selected
python_script = Python(IN[0]=code_block_3, IN[1]=code_block_4, IN[2]=select_phase)  # CPython3
# ---------- python_script.python (24 lines) ----------
import clr
clr.AddReference('RevitAPI')
from Autodesk.Revit.DB import *

clr.AddReference("RevitServices")
import RevitServices
from RevitServices.Persistence import DocumentManager
from RevitServices.Transactions import TransactionManager

def CreateUnplacedRoom(name, number, phase, doc):
	try:
		newroom = doc.Create.NewRoom(phase)
		newroom.Name = name
		newroom.Number = number
		return newroom
	except: return None

doc = DocumentManager.Instance.CurrentDBDocument
phase = UnwrapElement(IN[2])

TransactionManager.Instance.EnsureInTransaction(doc)
if isinstance(IN[0], list) and isinstance(IN[1], list): OUT = [CreateUnplacedRoom(x, y, phase, doc) for x, y in zip(IN[0], IN[1])]
else: OUT = None
TransactionManager.Instance.TransactionTaskDone()
# ----------------------------------------
code_block_5 = CodeBlock(headers=code_block_2.headers) { headers; }

# group: Get parameter names individually
code_block_6 = CodeBlock(clean_data=code_block_5)
# ---------- code_block_6.designscript (20 lines) ----------
program_code01 = clean_data[0];
program_code02 = clean_data[1];
program_code03 = clean_data[2];
program_code04 = clean_data[3];
program_code01_desc = clean_data[4];
program_code02_desc = clean_data[5];
program_code03_desc = clean_data[6];
program_code04_desc = clean_data[7];

program_number = clean_data[8];
program_number_instance = clean_data[9];
program_roomtype = clean_data[10];
program_name = clean_data[11];
program_headroom = clean_data[12];
program_area = clean_data[17];

workingspots_one = clean_data[13];
workingspots_onebis = clean_data[14];
workingspots_two = clean_data[15];
workingspots_three = clean_data[16];
# ----------------------------------------

# group: Flatten Values
code_block_7 = CodeBlock(program_number_code01=code_block_2.program_code01, program_number_code02=code_block_2.program_code02, program_number_code03=code_block_2.program_code03, program_number_code04=code_block_2.program_code04, program_number_code01_desc=code_block_2.program_code01_desc, program_number_code02_desc=code_block_2.program_code02_desc, program_number_code03_desc=code_block_2.program_code03_desc, program_number_code04_desc=code_block_2.program_code04_desc, program_number=code_block_2.program_number, program_number_instance=code_block_2.program_number_instance, room_type=code_block_2.program_roomtype, program_name=code_block_2.program_name, program_headroom=code_block_2.program_headroom, program_area=code_block_2.program_area, workingspots_one=code_block_2.workingspots_one, workingspots_onebis=code_block_2.workingspots_onebis, workingspots_two=code_block_2.workingspots_two, workingspots_three=code_block_2.workingspots_three)
# ---------- code_block_7.designscript (20 lines) ----------
input_program_code01 = List.Flatten(program_number_code01);
input_program_code02 = List.Flatten(program_number_code02);
input_program_code03 = List.Flatten(program_number_code03);
input_program_code04 = List.Flatten(program_number_code04);
input_program_code01_desc = List.Flatten(program_number_code01_desc);
input_program_code02_desc = List.Flatten(program_number_code02_desc);
input_program_code03_desc = List.Flatten(program_number_code03_desc);
input_program_code04_desc = List.Flatten(program_number_code04_desc);

input_program_number = List.Flatten(program_number);
input_program_number_instance = List.Flatten(program_number_instance);
input_room_type = List.Flatten(room_type);
input_program_name = List.Flatten(program_name);
input_program_headroom = String.ToNumber(List.Flatten(program_headroom));
input_program_area = String.ToNumber(List.Flatten(program_area));

input_workingspots_one = String.ToNumber(List.Flatten(workingspots_one));
input_workingspots_onebis = String.ToNumber(List.Flatten(workingspots_onebis));
input_workingspots_two = String.ToNumber(List.Flatten(workingspots_two));
input_workingspots_three = String.ToNumber(List.Flatten(workingspots_three));
# ----------------------------------------

# group: Set Parameter Values for each Room Instance (based on Row names)
code_block_8 = CodeBlock(input=python_script, program_code01_param=code_block_6.program_code01, program_code02_param=code_block_6.program_code02, program_code03_param=code_block_6.program_code03, program_code04_param=code_block_6.program_code04, program_code01_desc_param=code_block_6.program_code01_desc, program_code02_desc_param=code_block_6.program_code02_desc, program_code03_desc_param=code_block_6.program_code03_desc, program_code04_desc_param=code_block_6.program_code04_desc, program_number_param=code_block_6.program_number, program_number_instance_param=code_block_6.program_number_instance, program_roomtype_param=code_block_6.program_roomtype, program_name_param=code_block_6.program_name, program_headroom_param=code_block_6.program_headroom, program_area_param=code_block_6.program_area, workingspots_one_param=code_block_6.workingspots_one, workingspots_onebis_param=code_block_6.workingspots_onebis, workingspots_two_param=code_block_6.workingspots_two, workingspots_three_param=code_block_6.workingspots_three, program_code01=code_block_7.input_program_code01, program_code02=code_block_7.input_program_code02, program_code03=code_block_7.input_program_code03, program_code04=code_block_7.input_program_code04, program_code01_desc=code_block_7.input_program_code01_desc, program_code02_desc=code_block_7.input_program_code02_desc, program_code03_desc=code_block_7.input_program_code03_desc, program_code04_desc=code_block_7.input_program_code04_desc, program_number=code_block_7.input_program_number, program_number_instance=code_block_7.input_program_number_instance, program_roomtype=code_block_7.input_room_type, program_name=code_block_7.input_program_name, program_headroom=code_block_7.input_program_headroom, program_area=code_block_7.input_program_area, workingspots_one=code_block_7.input_workingspots_one, workingspots_onebis=code_block_7.input_workingspots_onebis, workingspots_two=code_block_7.input_workingspots_two, workingspots_three=code_block_7.input_workingspots_three)
# ---------- code_block_8.designscript (48 lines) ----------
// Inputs
rooms = input;

// Parameter Names
program_code01_param;
program_code02_param;
program_code03_param;
program_code04_param;
program_code01_desc_param;
program_code02_desc_param;
program_code03_desc_param;
program_code04_desc_param;

program_number_param;
program_number_instance_param;
program_roomtype_param;
program_name_param;
program_headroom_param;
program_area_param;

workingspots_one_param;
workingspots_onebis_param;
workingspots_two_param;
workingspots_three_param;


//Set Parameters
Elements.Element.SetParameterByName(rooms, program_code01_param, program_code01);
Elements.Element.SetParameterByName(rooms, program_code02_param, program_code02);
Elements.Element.SetParameterByName(rooms, program_code03_param, program_code03);
Elements.Element.SetParameterByName(rooms, program_code04_param, program_code04);
Elements.Element.SetParameterByName(rooms, program_code01_desc_param, program_code01_desc);
Elements.Element.SetParameterByName(rooms, program_code02_desc_param, program_code02_desc);
Elements.Element.SetParameterByName(rooms, program_code03_desc_param, program_code03_desc);
Elements.Element.SetParameterByName(rooms, program_code04_desc_param, program_code04_desc);

Elements.Element.SetParameterByName(rooms, program_number_param, program_number);
Elements.Element.SetParameterByName(rooms, program_number_instance_param, program_number_instance);
Elements.Element.SetParameterByName(rooms, program_roomtype_param, program_roomtype);
Elements.Element.SetParameterByName(rooms, program_name_param, program_name);
Elements.Element.SetParameterByName(rooms, program_headroom_param, program_headroom);
Elements.Element.SetParameterByName(rooms, program_area_param, program_area);


Elements.Element.SetParameterByName(rooms, workingspots_one_param, workingspots_one);
Elements.Element.SetParameterByName(rooms, workingspots_onebis_param, workingspots_onebis);
Elements.Element.SetParameterByName(rooms, workingspots_two_param, workingspots_two);
Elements.Element.SetParameterByName(rooms, workingspots_three_param, workingspots_three);
# ----------------------------------------
